# Grasshopper definition Mesh.gh (Grasshopper 0.9.76)
# Copyright: Co-de-iT
# plug-ins: MeshEdit Components

number_slider = Slider(5, range=1..100)
crv = Curve([<curve referenced from the Rhino model> x145])
crv_2 = Curve([<curve referenced from the Rhino model> x148])
topoly = CurveToPolyline(Curve=crv, ToleranceDistance=0, ToleranceAngle=0, MaxEdge=5)  # -> Polyline, Segments
bbox = BoundingBox(Content=crv_2, Plane=PlaneXY(0, 0, 0))  # -> Box, Box_2
debox = DeconstructBox(Box=bbox.Box)  # -> Plane, X, Y, Z
explode = Explode(Curve=topoly.Polyline, Recursive=True)  # -> Segments, Vertices
flatten = FlattenTree(Tree=explode.Vertices, Path="{0}")
project = Project(Geometry=flatten, Plane=PlaneXY(0, 0, 0))  # -> Geometry, Transform
Z = UnitZ(Factor=-100)
crv_3 = Curve(<curve referenced from the Rhino model>)
project_2 = Project(Geometry=crv_3, Plane=PlaneXY(0, 0, 0))  # -> Geometry, Transform
debox_2 = DeconstructBox(Box=project_2.Geometry)  # -> Plane, X, Y, Z
planesrf = PlaneSurface(Plane=debox_2.Plane, XSize=debox_2.X, YSize=debox_2.Y)
divide = DivideDomain²(Domain=planesrf, UCount=3, VCount=4)
subsrf = Isotrim(Surface=planesrf, Domain=divide)
debox_3 = DeconstructBox(Box=subsrf)  # -> Plane, X, Y, Z
dedomain = DeconstructDomain(Domain=debox_3.X)  # -> Start, End
dedomain_2 = DeconstructDomain(Domain=debox_3.Y)  # -> Start, End
expression = Expression(x=dedomain_2.Start, y=dedomain_2.End, z=number_slider, Expression="(y-x)/z")
expression_2 = Expression(x=dedomain.Start, y=dedomain.End, z=number_slider, Expression="(y-x)/z")
planesrf_2 = PlaneSurface(Plane=debox_3.Plane, XSize=debox_3.X, YSize=debox_3.Y)
range = Range(Domain=debox.Y, Steps=100)  # disabled
sdivide = DivideSurface(Surface=subsrf, UCount=expression_2, VCount=expression)  # -> simplify(Points), Normals, Parameters
Z_2 = UnitZ(Factor=-100)
incurve = PointInCurve(Point=project.Geometry, Curve=project_2.Geometry)  # -> Relationship, Point
move = Move(Geometry=crv_3, Motion=Z)  # -> Geometry, Transform
Z_3 = UnitZ(Factor=200)
dim = Dimensions(Surface=subsrf)  # -> UDimension, VDimension
pt = ConstructPoint(XCoordinate=0, YCoordinate=range, ZCoordinate=0)  # disabled
crv_4 = Curve(flatten([<curve referenced from the Rhino model> x147]))  # disabled
int = Integer(2)
move_2 = Move(Geometry=sdivide.Points, Motion=Z_2)  # -> Geometry, Transform
del = DelaunayMesh(Points=flatten(explode.Vertices), Plane=PlaneXY(0, 0, 0))
xz = XZPlane(Origin=pt)  # disabled
boundary = BoundarySurfaces(Edges=move.Geometry)
extr = Extrude(Base=move.Geometry, Direction=Z_3)
mindex = MemberIndex(Set=incurve.Relationship, Member=int)  # -> Index, Count
panel = Panel(dim.VDimension)
item = ListItem(Index=0, Wrap=True)
graft = GraftTree(Tree=xz, IncludeEmptyLists=True, IncludeNullItems=True)  # -> simplify(Tree); disabled
pcx = CurvePlane(Curve=crv_4, Plane=graft(xz))  # -> Points, ParamsC, ParamsP; disabled
mesh = MeshBrep(
    Brep=extr,
    Settings={GridMaxCount=0, GridMinCount=16, JaggedSeams=False, MaxEdgeLength=0, MinEdgeLength=0.0001, MinTolerance=0, Refine=True, RefineAngle=0, RelativeTolerance=0.65, SimplePlanes=True, Tolerance=0})
item_2 = ListItem(List=flatten, Index=mindex.Index, Wrap=True)
mmx = MeshMesh(MeshA=del, MeshB=extr, UseMeshMeshFast=True)
trim = TrimTree(Tree=pcx.Points, Depth=1)  # -> simplify(Tree); disabled
crv_5 = Curve(flatten([<curve referenced from the Rhino model> x147]))
msplit = MeshSplit(Mesh=del, Splitters=mesh)
plcoord = PlaneCoordinates(Point=trim, System=simplify(graft))  # -> XCoordinate, YCoordinate, ZCoordinate; disabled
topoly_2 = CurveToPolyline(Curve=mmx, ToleranceDistance=0, ToleranceAngle=0, MaxEdge=5)  # -> Polyline, Segments
sort = SortList(Keys=plcoord.XCoordinate, ValuesA=trim)  # -> Keys, ValuesA; disabled
explode_2 = Explode(Curve=topoly_2.Polyline, Recursive=True)  # -> Segments, Vertices
pt_2 = Point(explode_2.Vertices)
panel_2 = Panel(trim)  # disabled
pline = PolyLine(Vertices=sort.ValuesA, Closed=False)  # disabled
Z_4 = UnitZ(Factor=1)
del_2 = DelaunayMesh(Points=flatten([pt_2, item_2]), Plane=PlaneXY(0, 0, 0))
meshray = MeshRay(Mesh=del_2, Point=move_2.Geometry, Direction=Z_4)  # -> simplify(Point), Hit
area = Area(Geometry=planesrf)  # -> Area, Centroid
expression_3 = Expression(Expression="1/1")
trim_2 = TrimTree(Tree=meshray.Point, Depth=1)
bbox_2 = BoundingBox(Content=del_2, Plane=PlaneXY(0, 0, 0))  # -> Box, Box_2
xy = XYPlane(Origin=area.Centroid)
xy_2 = XYPlane(Origin=Point(0, 0, 0))
debox_4 = DeconstructBox(Box=bbox_2.Box)  # -> Plane, X, Y, Z
xy_3 = XYPlane(Origin=Point(0, 0, 0))
vec = VectorXYZ(XComponent=1, YComponent=1, ZComponent=0)  # -> Vector, Length
align = AlignPlane(Plane=xy_3, Direction=vec.Vector)  # -> Plane, Angle
dedomain_3 = DeconstructDomain(Domain=debox_4.Z)  # -> Start, End
orient = Orient(Geometry=trim_2, Source=xy, Target=xy_2)  # -> Geometry, Transform
scale = Scale(Geometry=orient.Geometry, Center=xy_2, Factor=expression_3)  # -> Geometry, Transform
expression_4 = Expression(x=dedomain_3.Start, y=dedomain_3.End, Expression="y-x")
scale_nu = ScaleNU(Geometry=scale.Geometry, Plane=align.Plane, ScaleX=2, ScaleY=1, ScaleZ=1)  # -> Geometry, Transform
toggle = BooleanToggle(False)
del_3 = DelaunayMesh(Points=scale_nu.Geometry, Plane=PlaneXY(0, 0, 0))  # -> flatten(Mesh)
panel_3 = Panel(expression_4)
vec_2 = VectorXYZ(XComponent=1, YComponent=1, ZComponent=0)  # -> Vector, Length
vec_3 = VectorXYZ(XComponent=1, YComponent=-1, ZComponent=0)  # -> Vector, Length
scale_nu_2 = ScaleNU(Geometry=del_3, Plane=align.Plane, ScaleX=0.5, ScaleY=1, ScaleZ=1)  # -> Geometry, Transform
area_2 = MeshArea(Mesh=scale_nu_2.Geometry)  # -> Area, Centroid
orient_2 = Orient(Geometry=scale_nu_2.Geometry, Source=xy_2, Target=xy)  # -> Geometry, Transform
xy_4 = XYPlane(Origin=Point(0, 0, 0))
pt_3 = Point(Point(302890.2564, -386301.0768, 352753.7049))
pt_4 = Point(Point(-2.515716553, 2.5, 10))
vec_4 = Vector(Vector(-0.3600616203, 0.4592156188, 0.8120816739))
medges = MeshEdges(Mesh=scale_nu_2.Geometry)  # -> NakedEdges, InteriorEdges, NonManifoldEdges
contour = Contour(Shape=scale_nu_2.Geometry, Point=Point(0, 0, 0), Direction=vec_3.Vector, Distance=10)
contour_2 = Contour(Shape=scale_nu_2.Geometry, Point=Point(0, 0, 0), Direction=vec_2.Vector, Distance=10)
cull_i = CullIndex(List=area_2.Centroid, Indices=[4, 5, 6, 7], Wrap=True)
xy_5 = XYPlane(Origin=Point(0, 0, 0))
vec2pt = Vector2Pt(PointA=pt_4, PointB=pt_3, Unitize=False)  # -> Vector, Length
join = JoinCurves(Curves=flatten(contour), Preserve=False)
crv_6 = Curve(medges.NakedEdges)
Y = UnitY(Factor=1)
join_2 = JoinCurves(Curves=flatten(contour_2), Preserve=False)
scale_nu_3 = ScaleNU(Geometry=cull_i, Plane=xy_4, ScaleX=Slider(1.419, range=1..2), ScaleY=1, ScaleZ=1)  # -> Geometry, Transform
scale_nu_4 = ScaleNU(Geometry=cull_i, Plane=xy_4, ScaleX=Slider(1.86, range=1..2), ScaleY=1, ScaleZ=1)  # -> Geometry, Transform
pl = PlaneNormal(Origin=pt_3, ZAxis=vec2pt.Vector)
join_3 = JoinCurves(Curves=crv_6, Preserve=False)  # -> flatten(Curves)
align_2 = AlignPlane(Plane=xy_5, Direction=Y)  # -> Plane, Angle
simplify = SimplifyCurve(Curve=join_2)  # -> Curve, Simplified
simplify_2 = SimplifyCurve(Curve=join)  # -> Curve, Simplified
align_3 = AlignPlane(Plane=pl, Direction=vec_4)  # -> Plane, Angle
xy_6 = XYPlane(Origin=Point(0, 0, 0))
sec = MeshPlane(Mesh=scale_nu_2.Geometry, Plane=xy_6)  # -> flatten(Curves)
panel_4 = Panel("""Dominic Hawton
Nariddh Khean
Michael Broderick
Ali Siddiqui
Peter Pitas
Nissie Bungrakearti
Edward Martin
Montanna Green
Sophie Scott
Simon Giang
Emily Leung
Sarah?
Mark Willoughby
Merk Willoughby
Luke Lushiwen?
Isabel Chia
Maddie Johanson
James Stevenson
Roger Sam
Lachlan Sarah
Kingsley Castillo
Harris Paneras
Catherin Erzetic
Sol Cutrera
Jason Vorapatrakul
Bob""")
project_3 = Project(Geometry=scale_nu_3.Geometry, Plane=align_3.Plane)  # -> Geometry, Transform
project_4 = Project(Geometry=scale_nu_4.Geometry, Plane=align_3.Plane)  # -> Geometry, Transform
project_5 = Project(Geometry=join_3, Plane=align_3.Plane)  # -> Geometry, Transform
project_6 = Project(Geometry=sec, Plane=align_3.Plane)  # -> Geometry, Transform
project_7 = Project(Geometry=simplify.Curve, Plane=align_3.Plane)  # -> Geometry, Transform
project_8 = Project(Geometry=simplify_2.Curve, Plane=align_3.Plane)  # -> Geometry, Transform
orient_3 = Orient(Geometry=project_3.Geometry, Source=align_3.Plane, Target=align_2.Plane)  # -> Geometry, Transform
orient_4 = Orient(Geometry=project_5.Geometry, Source=align_3.Plane, Target=align_2.Plane)  # -> Geometry, Transform
bbox_3 = BoundingBox(Content=orient_4.Geometry, Plane=PlaneXY(0, 0, 0), UnionBox=True)  # -> Box, Box_2
debox_5 = DeconstructBox(Box=bbox_3.Box)  # -> Plane, X, Y, Z
rectangle = Rectangle(Plane=debox_5.Plane, XSize=debox_5.X, YSize=debox_5.Y, Radius=0)  # -> Rectangle, Length
orient_5 = Orient(Geometry=project_4.Geometry, Source=align_3.Plane, Target=align_2.Plane)  # -> Geometry, Transform
orient_6 = Orient(Geometry=project_6.Geometry, Source=align_3.Plane, Target=align_2.Plane)  # -> Geometry, Transform
orient_7 = Orient(Geometry=project_7.Geometry, Source=align_3.Plane, Target=align_2.Plane)  # -> Geometry, Transform
orient_8 = Orient(Geometry=project_8.Geometry, Source=align_3.Plane, Target=align_2.Plane)  # -> Geometry, Transform
offset = Offset(Curve=rectangle.Rectangle, Distance=100, Plane=PlaneXY(0, 0, 0), Corners=1)
jitter = Jitter(List=panel_4, Jitter=1, Seed=2)  # -> Values, Indices
bbox_4 = BoundingBox(Content=offset, Plane=PlaneXY(0, 0, 0), UnionBox=True)  # -> Box, Box_2
area_3 = Area(Geometry=bbox_4.Box)  # -> Area, Centroid
partition = PartitionList(List=jitter.Values, Size=8)
Y_2 = UnitY(Factor=1)
graft_2 = GraftTree(Tree=orient_5.Geometry, IncludeEmptyLists=True, IncludeNullItems=True)
box = EvaluateBox(Box=bbox_4.Box, UParameter=0, VParameter=1, WParameter=0)  # -> Plane, Point, Include
ln = Line(StartPoint=orient_3.Geometry, EndPoint=orient_5.Geometry)
debox_6 = DeconstructBox(Box=bbox_4.Box)  # -> Plane, X, Y, Z
number_slider_2 = Slider(0.993, range=0..1)
flip = FlipMatrix(Data=partition)
scale_2 = Scale(Geometry=box.Plane, Center=area_3.Centroid, Factor=number_slider_2)  # -> Geometry, Transform
X = UnitX(Factor=Slider(3, range=0..500))
dedomain_4 = DeconstructDomain(Domain=debox_6.Y)  # -> Start, End
dedomain_5 = DeconstructDomain(Domain=debox_6.X)  # -> Start, End
clean = CleanTree(RemoveNulls=True, RemoveInvalid=True, RemoveEmpty=False, Tree=flip)
lng = ListLength(List=clean)
series = Series(Start=Slider(3, range=0..500), Step=Slider(18.795, range=0..500), Count=lng)
item_3 = ListItem(List=reverse(series), Index=0, Wrap=True)
Y_3 = UnitY(Factor=series)
line = LineSDL(Start=orient_5.Geometry, Direction=Y_2, Length=flatten(item_3))
move_3 = Move(Geometry=graft_2, Motion=Y_3)  # -> flatten(Geometry), Transform
expression_5 = Expression(x=dedomain_4.Start, y=dedomain_4.End, Expression="y-x")
expression_6 = Expression(x=dedomain_5.Start, y=dedomain_5.End, Expression="y-x")
flatten_2 = FlattenTree(Tree=clean, Path="{0}")
move_4 = Move(Geometry=move_3.Geometry, Motion=X)  # -> Geometry, Transform
expression_7 = Expression(x=expression_6, y=number_slider_2, Expression="x*y")
expression_8 = Expression(x=expression_5, y=number_slider_2, Expression="x*y")
int_2 = Integer(expression_8)
int_3 = Integer(expression_7)
panel_5 = Panel(clean)
expression_9 = Expression(x=int_3, y=int_2, Expression="Format(\"{0},{1}\", x, y)")  # -> flatten(R)
panel_6 = Panel("""A1
A2
A3
A4
B1
B2
B3
B4""")
svg_plane_by_page = SVGPlaneByPage(plane=scale_2.Geometry, M=expression_9, T="1:1")  # -> R_2, R
svg_text_object = SVGTextObject(txt=flatten_2, P=move_4.Geometry, T=svg_plane_by_page.R_2)  # -> R_2, txt_4
rep = ReplaceText(Text="loc=\"\\CODE 2121\\Assignment 4\\source files\\█.3dm\"", Find="█", Replace=panel_6, RecursiveReplace=False)
svg_polyline = SVGPolyline(crv=orient_6.Geometry, layout=svg_plane_by_page.R_2, class="cut")  # -> svg_2, crv_4
svg_polyline_2 = SVGPolyline(crv=flatten(orient_4.Geometry), layout=svg_plane_by_page.R_2, class="outline1", attributes=rep)  # -> reverse(svg_2), crv_4
svg_polyline_3 = SVGPolyline(crv=flatten([ln, line]), layout=svg_plane_by_page.R_2, class="outline")  # -> svg_2, crv_4
svg_polyline_4 = SVGPolyline(crv=[orient_8.Geometry, orient_7.Geometry], layout=svg_plane_by_page.R_2, class="grid")  # -> svg_2, crv_4
flatten_3 = FlattenTree(
    Tree=[svg_text_object.R_2, svg_polyline_3.svg_2, svg_polyline_2.svg_2, svg_polyline_4.svg_2, svg_polyline.svg_2],
    Path="{0}")
panel_7 = Panel("""*{
fill:none;
stroke:none;
}
.outline {
stroke:#000;
}
.outline1 {
fill:#FFF;
stroke:#000;
}
.outline1:hover{
fill:#FF0;
}
polyline.grid {
stroke:#BBB;
stroke-width:0.2;
}
polyline.cut {
stroke:#F00;
stroke-width:0.5;
}
text{
fill:#000;
font-size:12px;
}""")
svg_compiler = SVGCompiler()
svg_compiler_2 = SVGCompiler_2()
html_compiler = HTMLCompiler(css=panel_7, svg_text=flatten_3, T=svg_plane_by_page.R_2)
panel_8 = Panel("C:\Users\s-abutler\Documents\GitHub\unsw_scripts\CODE 2121\Assignment 4\source files")
file_write = FileWrite(content=html_compiler, file_path=panel_8, T="plan.html", activate=Toggle(False))

# ==== cluster SVGPolyline
crv = ClusterInput()
layout = ClusterInput()
class = ClusterInput()
attributes = ClusterInput()
text = ClusterInput()  # "---------"
layout_2 = Data(layout)
class_2 = Text(class)
attributes_2 = Data(attributes)
concat = Concatenate(FragmentA="class=\"", FragmentB=class_2, FragmentC="\"")
text_2 = Text(text)  # "---------"
laysplit_new = LAYSPLITNEW(T=layout_2)  # -> pl_2, data_3, data_4
concat_2 = Concatenate(FragmentA=concat, FragmentB=" ", FragmentC=attributes_2)
null = NullItem(Item=class_2)  # -> NullFlags, InvalidFlags, Description
filter = StreamFilter(Gate=null.NullFlags, Stream0=concat_2, Stream1=attributes_2)
graft = GraftTree(Tree=filter, IncludeEmptyLists=True, IncludeNullItems=True)  # -> simplify(Tree)
null_2 = NullItem(Item=graft)  # -> NullFlags, InvalidFlags, Description
data = Data(laysplit_new.data_3)
dispatch = Dispatch(List="attributes=\"empty\"", DispatchPattern=null_2.NullFlags)  # -> ListA, ListB
item = ListItem(List=data, Index=0, Wrap=True)  # -> Item, Item1
merge = Merge(Data1=graft, Data2=dispatch.ListA)
null_3 = NullItem(Item=laysplit_new.data_4)  # -> NullFlags, InvalidFlags, Description
dom²num = ConstructDomain²(UMin=0, UMax=item.Item1, VMin=0, VMax=item.Item)
dispatch_2 = Dispatch(List="1", DispatchPattern=null_3.NullFlags)  # -> ListA, ListB
merge_2 = Merge(Data1=laysplit_new.data_4, Data2=dispatch_2.ListA)
crv_2 = Curve(simplify(crv))
num = Number(merge_2)
lng = ListLength(List=laysplit_new.pl_2)
cls = Closed(Curve=crv_2)  # -> Closed, Periodic
repeat = RepeatData(Data=num, Length=lng)
dispatch_3 = Dispatch(List=graft(crv_2), DispatchPattern=graft(cls.Closed))  # -> ListA, ListB
explode = Explode(Curve=dispatch_3.ListA, Recursive=True)  # -> Segments, Vertices
eval = EvaluateLength(Curve=explode.Segments, Length=0, Normalized=True)  # -> simplify(Point), Tangent, Parameter
item_2 = ListItem(List=eval.Point, Index=0, Wrap=True)
merge_3 = Merge(Data1=eval.Point, Data2=item_2)  # -> simplify(Result)
explode_2 = Explode(Curve=dispatch_3.ListB, Recursive=True)  # -> Segments, simplify(Vertices)
weave = Weave(Pattern=graft(cls.Closed), Stream0=explode_2.Vertices, Stream1=merge_3, NullGaps=False)  # -> simplify(Weave)
lng_2 = ListLength(List=crv_2)
repeat_2 = RepeatData(Data=repeat, Length=lng_2)  # -> simplify(graft(Data))
plcoord = PlaneCoordinates(Point=simplify(weave), System=simplify(laysplit_new.pl_2))  # -> XCoordinate, YCoordinate, ZCoordinate
clean = CleanTree(RemoveNulls=True, RemoveInvalid=True, RemoveEmpty=True, Tree=plcoord.YCoordinate)
clean_2 = CleanTree(RemoveNulls=True, RemoveInvalid=True, RemoveEmpty=True, Tree=repeat_2)
clean_3 = CleanTree(RemoveNulls=True, RemoveInvalid=True, RemoveEmpty=True, Tree=merge)
clean_4 = CleanTree(RemoveNulls=True, RemoveInvalid=True, RemoveEmpty=True, Tree=plcoord.XCoordinate)
expression = Expression(x=clean, Expression="-(x)")
expression_2 = Expression(x=clean_4, y=clean_2, Expression="x/y")
expression_3 = Expression(x=expression, y=clean_2, Expression="x/y")
expression_4 = Expression(x=expression_2, y=expression_3, Expression="Format(\"{0},{1}\", x, y)")
null_4 = NullItem(Item=expression_3)  # -> NullFlags, InvalidFlags, Description
bool = Boolean(cls.Closed)
txt = Text("~")
ma = MassAddition(Input=null_4.NullFlags)  # -> Result, PartialResults
dispatch_4 = Dispatch(List=expression_4, DispatchPattern=ma.Result)  # -> ListA, ListB
weave_2 = Weave(Pattern=bool, Stream0="<polyline ` points=\"~\"/>", Stream1="<polygon ` points=\"~\"/>", NullGaps=False)
join = TextJoin(Text=dispatch_4.ListB, Join=" ")
cluster = Cluster(data=join)
rep = ReplaceText(Text=weave_2, Find=txt, Replace=cluster, RecursiveReplace=False)  # -> simplify(Result)
txt_2 = Text("`")
rep_2 = ReplaceText(Text=rep, Find=txt_2, Replace=clean_3, RecursiveReplace=False)  # -> simplify(Result)
panel = Panel(rep_2)
flatten = FlattenTree(Tree=rep_2, Path="{0}")
svg = Text(flatten)
crv_3 = Curve(crv_2)
svg_2 = ClusterOutput(svg)
crv_4 = ClusterOutput(crv_3)

# ==== cluster SVGPlaneByPage
panel = Panel("""A4 (L),297,210
A4 (P),210,297
A3 (L),420,297
A3 (P),297,420
A1 (L),841,594
A1 (P),594,841""")
split = TextSplit(Text=panel, Separators=",")
item = ListItem(List=split, Index=0, Wrap=True)  # -> flatten(Item), flatten(Item1), flatten(Item2)
plane = ClusterInput()
M = ClusterInput()
mindex = MemberIndex(Set=item.Item, Member=simplify(M))  # -> simplify(flatten(Index)), Count
item_2 = ListItem(List=panel, Index=mindex.Index, Wrap=True)  # -> simplify(Item)
T = ClusterInput()
merge = Merge(Data1=simplify(item_2), Data2=simplify(M))
split_2 = TextSplit(Text=T, Separators=":")
item_3 = ListItem(List=merge, Index=0, Wrap=True)
item_4 = ListItem(List=split_2, Index=0, Wrap=True)  # -> Item, Item1
panel_2 = Panel(M)
split_3 = TextSplit(Text=item_3, Separators=",")
item_5 = ListItem(List=reverse(split_3), Index=[0, 1], Wrap=True)  # -> reverse(Item)
num = Number(item_4.Item1)
num_2 = Number(item_5)
expression = Expression(x=num_2, y=num, Expression="x*y")
plane_2 = Data(plane)
dispatch = Dispatch(List=expression, DispatchPattern=[True, False])  # -> ListA, ListB
plane_3 = Plane(flatten(plane_2))
deplane = DeconstructPlane(Plane=plane_3)  # -> simplify(Origin), simplify(XAxis), simplify(YAxis), ZAxis
x_dim = Domain(dispatch.ListB)
y_dim = Domain(dispatch.ListA)
dims = Number(flatten(num_2))
neg = Negative(Value=x_dim)
pt = Point(deplane.Origin)
pt_2 = Point(deplane.XAxis)
pt_3 = Point(deplane.YAxis)
merge_2 = Merge(Data1=simplify(pt), Data2=simplify(pt_2), Data3=simplify(pt_3))  # -> simplify(Result)
rectangle = Rectangle(Plane=plane_2, XSize=y_dim, YSize=neg, Radius=0)  # -> Rectangle, Length
scale = Number(flatten(num))
pt2num = PointsToNumbers(Points=merge_2, Mask=4)  # -> simplify(Numbers)
path_mapper = PathMapper(scale, source="{0}", target="{0;2}")
path_mapper_2 = PathMapper(dims, source="{0}", target="{0;1}")
path_mapper_3 = PathMapper(plane_3, source="{0}", target="{0;0}")
join = TextJoin(Text=pt2num, Join=",")  # -> simplify(Result)
join_2 = TextJoin(Text=dims, Join=",")  # -> simplify(Result)
merge_3 = Merge(Data1=path_mapper_3, Data2=path_mapper_2, Data3=path_mapper)  # -> simplify(Result)
rep = ReplaceText(Text="~;", Find="~", Replace=simplify(join_2), RecursiveReplace=False)  # -> simplify(Result)
rep_2 = ReplaceText(Text="~", Find="~", Replace=simplify(scale), RecursiveReplace=False)  # -> simplify(Result)
rep_3 = ReplaceText(Text="~;", Find="~", Replace=simplify(join), RecursiveReplace=False)  # -> simplify(Result)
merge_4 = Merge(Data1=flatten(rep_3), Data2=flatten(rep), Data3=flatten(rep_2))
R = ClusterOutput(rectangle.Rectangle)
join_3 = TextJoin(Text=merge_4)
panel_3 = Panel(join_3)
R_2 = ClusterOutput(join_3)
panel_4 = Panel(merge_3)

# ==== cluster FileWrite
content = ClusterInput()
file_path = ClusterInput()
activate = ClusterInput()
T = ClusterInput()
content_2 = Data(content)
file_path_2 = Text(file_path)
join = TextJoin(Text=[file_path_2, T], Join="\")
vb = VBScript(path=simplify(join), lines=simplify(content_2), activate=activate)  # -> out, A
# ---------- vb: VB ----------
    If (activate = True)
      
      system.IO.File.WriteAllText(path, lines)
      A = "File written"
    Else
      A = "Not activated"
    End If
# ---------- end vb ----------

# ==== cluster SVGTextObject
text = ClusterInput()  # "-----------------------"
element = ClusterInput()
class = ClusterInput()
R = ClusterInput()
txt = ClusterInput()
P = ClusterInput()
T = ClusterInput()
element_2 = Text(element)
class_2 = Text(class)
text_2 = Text(text)  # "-----------------------"
null = NullItem(Item=element_2)  # -> NullFlags, InvalidFlags, Description
null_2 = NullItem(Item=class_2)  # -> NullFlags, InvalidFlags, Description
laysplit_new = LAYSPLITNEW(T=T)  # -> pl_2, data_3, data_4
and = GateAnd(A=null.NullFlags, B=null_2.NullFlags)
plcoord = PlaneCoordinates(Point=simplify(P), System=simplify(laysplit_new.pl_2))  # -> XCoordinate, YCoordinate, ZCoordinate
bool = Boolean(invert(and))
expression = Expression(x=plcoord.YCoordinate, Expression="abs(x)")
expression_2 = Expression(x=plcoord.XCoordinate, y=laysplit_new.data_4, Expression="x/y")
expression_3 = Expression(x=expression, y=laysplit_new.data_4, Expression="x/y")
expression_4 = Expression(x=expression_2, y=expression_3, Expression="Format(\"x=~{0}~ y=~{1}~\", x, y)")
rep = ReplaceText(Text="<* + ~>`</*>", Find="*", Replace=element_2, RecursiveReplace=False)
filter = StreamFilter(Gate=bool, Stream0="<text + ~>`</text>", Stream1=rep)
rep_2 = ReplaceText(Text=filter, Find="+", Replace=R, RecursiveReplace=False)
rep_3 = ReplaceText(Text=expression_4, Find="~", Replace="\"", RecursiveReplace=False)
txt_2 = Text("~")
rep_4 = ReplaceText(Text=rep_2, Find=txt_2, Replace=rep_3, RecursiveReplace=False)  # -> simplify(Result)
txt_3 = Text(txt)
rep_5 = ReplaceText(Text=rep_4, Find="`", Replace=txt_3, RecursiveReplace=False)  # -> simplify(Result)
R_2 = ClusterOutput(rep_5)
txt_4 = ClusterOutput(txt_3)

# ==== cluster HTMLCompiler
svg_text = ClusterInput()
T = ClusterInput()
panel = Panel("""<html>
<body>
<head>
</head>
<body>
<svg version="1.1" xmlns="http://www.w3.org/2000/svg" xmlns:xlink="http://www.w3.org/1999/xlink" x="0px" y="0px"
width="100%" height="100%" viewBox="0 0 420 297"
xml:space="preserve">
<style type="text/css">""")
css = ClusterInput()
laysplit_new = LAYSPLITNEW(T=T)  # -> pl_2, data_3, data_4
css_2 = Data(css)
svg_text_2 = Data(svg_text)
dispatch = Dispatch(List=laysplit_new.data_3, DispatchPattern=[True, False])  # -> ListA, ListB
rep = ReplaceText(Text="width=\"100%\" height=\"auto\" viewBox=\"0 0 ` ~\"", Find="`", Replace=dispatch.ListA, RecursiveReplace=False)
tstat = TreeStatistics(Tree=flatten(svg_text_2))  # -> Paths, Length, Count
rep_2 = ReplaceText(Text=rep, Find="~", Replace=dispatch.ListB, RecursiveReplace=False)  # -> simplify(Result)
viewer = ParamViewer("</svg>")
int = Integer(tstat.Count)
merge = Merge(Data2=panel, Data3=css_2, Data4="</style>")
repeat = RepeatData(Data=viewer, Length=int)
branch = TreeBranch(Tree="</svg>", Path=repeat, MaintainPaths=False)
tmatch = MatchText(Text=merge, RegEx="viewBox", Case=True)
mindex = MemberIndex(Set=tmatch, Member=Toggle(True))  # -> Index, Count
replace = ReplaceItems(List=merge, Item=rep_2, Indices=mindex.Index, Wrap=False)  # -> simplify(List)
merge_2 = Merge(
    Data1=flatten(replace),
    Data2=flatten(svg_text_2),
    Data3=flatten(branch),
    Data4=flatten("</body>"),
    Data6=flatten("</html>"))
svg_text_3 = Text(merge_2)
rep_3 = ReplaceText(Text=svg_text_3, Find=" =\"\" ", Replace=" ", RecursiveReplace=False)
join = TextJoin(Text=rep_3)
html_content = Text(join)
html_content_2 = ClusterOutput(html_content)

# ==== cluster SVGCompiler
data = ClusterInput()
T = ClusterInput()
panel = Panel("""<?xml version="1.0" encoding="utf-8"?>
<!-- Generator: Adobe Illustrator 16.0.0, SVG Export Plug-In . SVG Version: 6.00 Build 0)  -->
<!DOCTYPE svg PUBLIC "-//W3C//DTD SVG 1.1//EN" "http://www.w3.org/Graphics/SVG/1.1/DTD/svg11.dtd">
<svg version="1.1" xmlns="http://www.w3.org/2000/svg" xmlns:xlink="http://www.w3.org/1999/xlink" x="0px" y="0px"
width="100%" height="100%" viewBox="0 0 420 297"
xml:space="preserve">
<style type="text/css">""")
css = ClusterInput()
branch = TreeBranch(Tree=T, Path="{1}", MaintainPaths=True)
css_2 = Data(css)
data_2 = Data(data)
dispatch = Dispatch(List=branch, DispatchPattern=[True, False])  # -> ListA, ListB
rep = ReplaceText(Text="width=\"`mm\" height=\"~mm\" viewBox=\"0 0 ` ~\"", Find="`", Replace=dispatch.ListA, RecursiveReplace=False)
tstat = TreeStatistics(Tree=flatten(data_2))  # -> Paths, Length, Count
rep_2 = ReplaceText(Text=rep, Find="~", Replace=dispatch.ListB, RecursiveReplace=False)  # -> simplify(Result)
viewer = ParamViewer("</svg>")
int = Integer(tstat.Count)
merge = Merge(Data1=panel, Data2=css_2)
repeat = RepeatData(Data=viewer, Length=int)
branch_2 = TreeBranch(Tree="</svg>", Path=repeat, MaintainPaths=False)
tmatch = MatchText(Text=merge, RegEx="viewBox", Case=True)
mindex = MemberIndex(Set=tmatch, Member=Toggle(True))  # -> Index, Count
replace = ReplaceItems(List=merge, Item=rep_2, Indices=mindex.Index, Wrap=False)  # -> simplify(List)
merge_2 = Merge(Data1=flatten(replace), Data2=flatten(data_2), Data3=flatten(branch_2))
svg_text = Text(merge_2)
rep_3 = ReplaceText(Text=svg_text, Find=" =\"\" ", Replace=" ", RecursiveReplace=False)
join = TextJoin(Text=rep_3)
svg_content = Text(join)
svg_content_2 = ClusterOutput(svg_content)

# ==== cluster SVGCompiler_2
data = ClusterInput()
T = ClusterInput()
panel = Panel("""<?xml version="1.0" encoding="utf-8"?>
<!-- Generator: Adobe Illustrator 16.0.0, SVG Export Plug-In . SVG Version: 6.00 Build 0)  -->
<!DOCTYPE svg PUBLIC "-//W3C//DTD SVG 1.1//EN" "http://www.w3.org/Graphics/SVG/1.1/DTD/svg11.dtd">
<svg version="1.1" xmlns="http://www.w3.org/2000/svg" xmlns:xlink="http://www.w3.org/1999/xlink" x="0px" y="0px"
width="100%" height="100%" viewBox="0 0 420 297"
xml:space="preserve">
<style type="text/css">""")
css = ClusterInput()
laysplit_new = LAYSPLITNEW(T=T)  # -> pl_2, data_3, data_4
css_2 = Data(css)
data_2 = Data(data)
dispatch = Dispatch(List=laysplit_new.data_3, DispatchPattern=[True, False])  # -> ListA, ListB
rep = ReplaceText(Text="width=\"`mm\" height=\"~mm\" viewBox=\"0 0 ` ~\"", Find="`", Replace=dispatch.ListA, RecursiveReplace=False)
tstat = TreeStatistics(Tree=flatten(data_2))  # -> Paths, Length, Count
rep_2 = ReplaceText(Text=rep, Find="~", Replace=dispatch.ListB, RecursiveReplace=False)  # -> simplify(Result)
viewer = ParamViewer("</svg>")
int = Integer(tstat.Count)
merge = Merge(Data1=panel, Data2=css_2, Data3="</style>")
repeat = RepeatData(Data=viewer, Length=int)
branch = TreeBranch(Tree="</svg>", Path=repeat, MaintainPaths=False)
tmatch = MatchText(Text=merge, RegEx="viewBox", Case=True)
mindex = MemberIndex(Set=tmatch, Member=Toggle(True))  # -> Index, Count
replace = ReplaceItems(List=merge, Item=rep_2, Indices=mindex.Index, Wrap=False)  # -> simplify(List)
merge_2 = Merge(Data1=flatten(replace), Data2=flatten(data_2), Data3=flatten(branch))
svg_text = Text(merge_2)
rep_3 = ReplaceText(Text=svg_text, Find=" =\"\" ", Replace=" ", RecursiveReplace=False)
join = TextJoin(Text=rep_3)
svg_content = Text(join)
svg_content_2 = ClusterOutput(svg_content)

# ==== cluster Cluster
data = ClusterInput()
data_2 = Data(data)
trim = TrimTree(Tree=data_2, Depth=1)
null = NullItem(Item=trim)  # -> NullFlags, InvalidFlags, Description
ma = MassAddition(Input=null.NullFlags)  # -> Result, PartialResults
bool = Boolean(invert(ma.Result))
trim_2 = TrimTree(Tree=data_2, Depth=bool)
data_3 = Data(trim_2)
data_4 = ClusterOutput(data_3)

# ==== cluster LAYSPLITNEW
T = ClusterInput()
split = TextSplit(Text=T, Separators=";")
split_2 = TextSplit(Text=split, Separators=",")
partition = PartitionList(List=split_2, Size=[9, 2, 1])  # -> simplify(Chunks)
branch = TreeBranch(Tree=partition, Path="{0}", MaintainPaths=True)
branch_2 = TreeBranch(Tree=partition, Path="{1}", MaintainPaths=True)
branch_3 = TreeBranch(Tree=partition, Path="{2}", MaintainPaths=True)
item = ListItem(List=branch, Index=0, Wrap=True)  # -> Item, Item1, Item2
item_2 = ListItem(List=branch, Index=3, Wrap=True)  # -> Item, Item1, Item2
item_3 = ListItem(List=branch, Index=6, Wrap=True)  # -> Item, Item1, Item2
pt = ConstructPoint(XCoordinate=item.Item, YCoordinate=item.Item1, ZCoordinate=item.Item2)
vec = VectorXYZ(XComponent=item_2.Item, YComponent=item_2.Item1, ZComponent=item_2.Item2)  # -> Vector, Length
vec_2 = VectorXYZ(XComponent=item_3.Item, YComponent=item_3.Item1, ZComponent=item_3.Item2)  # -> Vector, Length
pl = ConstructPlane(Origin=pt, XAxis=vec.Vector, YAxis=vec_2.Vector)
data = Data(branch_3)
data_2 = Data(branch_2)
data_3 = ClusterOutput(data_2)
data_4 = ClusterOutput(data)
pl_2 = ClusterOutput(pl)
