# Grasshopper definition 001_DH_Comments.gh (Grasshopper 0.9.76)

central_offset = Slider(5, range=0..100)
rotation = Slider(496, range=0..1080)
number_slider = Slider(10, range=0..100)
total_height = Slider(6, range=0..100)
central_offset_2 = Slider(5, range=0..100)
rotation_2 = Slider(783, range=0..1080)
total_height_2 = Slider(6, range=0..100)
pt = Point(<point referenced from the Rhino model>)
number_slider_2 = Slider(30, range=0..100)
pt_2 = Point(<point referenced from the Rhino model>)
Z = UnitZ(Factor=Slider(47, range=0..100))
line = LineSDL(Start=pt, Direction=Vector(0, 0, 1), Length=Slider(200, range=0..1000))
X = UnitX(Factor=1)
Z_2 = UnitZ(Factor=number_slider_2)
division = Division(A=total_height, B=rotation)
X_2 = UnitX(Factor=1)
pt_3 = Point(pt)
pt_4 = Point(pt_2)
division_2 = Division(A=total_height_2, B=rotation_2)
line_2 = LineSDL(Start=pt, Direction=Z, Length=1)
series = Series(Start=0, Step=1, Count=expr("x+1", rotation))
line_3 = LineSDL(Start=pt, Direction=X, Length=number_slider)
series_2 = Series(Start=0, Step=1, Count=expr("x+1", rotation_2))
series_3 = Series(Start=0, Step=division, Count=expr("x+1", rotation))
line_4 = LineSDL(Start=pt_2, Direction=X_2, Length=Slider(10, range=0..100))
X_3 = UnitX(Factor=central_offset)
ln = Line(StartPoint=pt_3, EndPoint=pt_4)
series_4 = Series(Start=0, Step=division_2, Count=expr("x+1", rotation_2))
X_4 = UnitX(Factor=central_offset_2)
move = Move(Geometry=line_3, Motion=X_3)  # -> Geometry, Transform
curvepoint = PointOnCurve(ln, parameter=0.5)
move_2 = Move(Geometry=line_4, Motion=X_4)  # -> Geometry, Transform
line_5 = LineSDL(Start=pt_2, Direction=Z_2, Length=number_slider_2)
Z_3 = UnitZ(Factor=series_3)
Z_4 = UnitZ(Factor=series_4)
rotate = Rotate(Geometry=move.Geometry, Angle=degrees(series), Plane=pt)  # -> Geometry, Transform
rotate_2 = Rotate(Geometry=move_2.Geometry, Angle=degrees(series_2), Plane=pt_2)  # -> Geometry, Transform
Z_5 = UnitZ(Factor=Slider(15, range=0..100))
end = EndPoints(Curve=line_5)  # -> Start, End
move_3 = Move(Geometry=curvepoint, Motion=Z_5)  # -> Geometry, Transform
move_4 = Move(Geometry=rotate.Geometry, Motion=Z_3)  # -> Geometry, Transform
move_5 = Move(Geometry=rotate_2.Geometry, Motion=Z_4)  # -> Geometry, Transform
cir = Circle(Plane=[end.Start, end.End], Radius=central_offset_2)
rotax = RotateAxis(Geometry=move_4.Geometry, Angle=degrees(Slider(153, range=0..360)), Axis=line_2)  # -> Geometry, Transform
curvepoint_2 = PointOnCurve(rotax.Geometry, parameter=0.5)
loft = Loft(Curves=cir, Options={Adjust=False, Closed=False, LoftEnds=0, LoftSimp=0, LoftType=0, Rebuild=10, Refit=0.01})
arc = Arc3Pt(PointA=pt_3, PointB=move_3.Geometry, PointC=pt_4)  # -> Arc, Plane, Radius
rotax_2 = RotateAxis(Geometry=move_5.Geometry, Angle=degrees(Slider(758, range=0..1000)), Axis=line_5)  # -> Geometry, Transform
curvepoint_3 = PointOnCurve(rotax_2.Geometry, parameter=0.5)
lng = ListLength(List=curvepoint_3)
lng_2 = ListLength(List=curvepoint_2)
number_slider_3 = Slider(5, range=0..10)
Z_6 = UnitZ(Factor=Slider(10, range=0..10))
move_6 = Move(Geometry=arc.Arc, Motion=Z_6)  # -> Geometry, Transform
subtraction = Subtraction(A=lng, B=Slider(1, range=0..1))
subtraction_2 = Subtraction(A=lng_2, B=Slider(1, range=0..1))
neg = Negative(Value=number_slider_3)
end_2 = EndPoints(Curve=rotax.Geometry)  # -> Start, End
end_3 = EndPoints(Curve=rotax_2.Geometry)  # -> Start, End
end_4 = EndPoints(Curve=rotax.Geometry)  # -> Start, End
end_5 = EndPoints(Curve=rotax_2.Geometry)  # -> Start, End
item = ListItem(List=curvepoint_3, Index=subtraction, Wrap=True)
lng_3 = ListLength(List=rotax.Geometry)
item_2 = ListItem(List=curvepoint_2, Index=subtraction_2, Wrap=True)
number_slider_4 = Slider(1, range=0..1)
number_slider_5 = Slider(1, range=0..1)

eval = EvaluateLength(Curve=rotax.Geometry, Length=0.5, Normalized=True)  # -> Point, Tangent, Parameter
eval_2 = EvaluateLength(Curve=rotax_2.Geometry, Length=0.5, Normalized=True)  # -> Point, Tangent, Parameter
intcrv = Interpolate(Vertices=eval.Point, Degree=3, Periodic=False, KnotStyle=1)  # -> Curve, Length, Domain
intcrv_2 = Interpolate(Vertices=eval_2.Point, Degree=3, Periodic=False, KnotStyle=1)  # -> Curve, Length, Domain
# Instead of using the end points, you can use the centerline of the ramps to define the curve.
number_slider_6 = Slider(326.656, range=0..1000)
eval_3 = EvaluateLength(Curve=intcrv.Curve, Length=number_slider_5, Normalized=True)  # -> Point, Tangent, Parameter
eval_4 = EvaluateLength(Curve=intcrv_2.Curve, Length=number_slider_5, Normalized=True)  # -> Point, Tangent, Parameter
amp = Amplitude(Vector=eval_4.Tangent, Amplitude=Slider(296.96, range=0..1000))
amp_2 = Amplitude(Vector=eval_3.Tangent, Amplitude=number_slider_6)
# Flattening the points and the vectors allows you to control the shape of the deck in plan.
project = Project(Geometry=eval_3.Point, Plane=PlaneXY(0, 0, 0))  # -> Geometry, Transform
project_2 = Project(Geometry=eval_4.Point, Plane=PlaneXY(0, 0, 0))  # -> Geometry, Transform
devec = DeconstructVector(Vector=amp_2)  # -> XComponent, YComponent, ZComponent
devec_2 = DeconstructVector(Vector=amp)  # -> XComponent, YComponent, ZComponent
expression = Expression(x=devec.ZComponent, y=Slider(0, range=0..1), Expression="x*y")
expression_2 = Expression(x=devec_2.ZComponent, y=Slider(0, range=0..1), Expression="x*y")
vec = VectorXYZ(XComponent=devec.XComponent, YComponent=devec.YComponent, ZComponent=expression)  # -> Vector, Length
vec_2 = VectorXYZ(XComponent=devec_2.XComponent, YComponent=devec_2.YComponent, ZComponent=expression_2)  # -> Vector, Length
# Whilst you can then define the elavation of the deck with a straight line.
ln_2 = Line(StartPoint=eval_3.Point, EndPoint=eval_4.Point)
num = Number(number_slider)
bzspan = BezierSpan(StartPoint=project.Geometry, StartTangent=vec.Vector, EndPoint=project_2.Geometry, EndTangent=vec_2.Vector)  # -> Curve, Length, Domain
offset_l = OffsetLoose(Curve=bzspan.Curve, Distance=expr("-x/2", num))
offset_l_2 = OffsetLoose(Curve=bzspan.Curve, Distance=expr("x/2", num))
divide = DivideCurve(Curve=ln_2, Count=100, Kinks=False)  # -> Points, Tangents, Parameters
pdecon = Deconstruct(Point=divide.Points)  # -> XComponent, YComponent, ZComponent
divide_2 = DivideCurve(Curve=offset_l_2, Count=100, Kinks=False)  # -> Points, Tangents, Parameters
divide_3 = DivideCurve(Curve=offset_l, Count=100, Kinks=False)  # -> Points, Tangents, Parameters
pdecon_2 = Deconstruct(Point=divide_2.Points)  # -> XComponent, YComponent, ZComponent
pdecon_3 = Deconstruct(Point=divide_3.Points)  # -> XComponent, YComponent, ZComponent
# Combining the decks XY values, with the Z values of the straight line can give you result that is curved in one direction, and linear in another. The straight line doesn't need to be straight, it could have a summit.
pt_5 = ConstructPoint(XCoordinate=pdecon_2.XComponent, YCoordinate=pdecon_2.YComponent, ZCoordinate=pdecon.ZComponent)
pt_6 = ConstructPoint(XCoordinate=pdecon_3.XComponent, YCoordinate=pdecon_3.YComponent, ZCoordinate=pdecon.ZComponent)
intcrv_3 = Interpolate(Vertices=pt_5, Degree=3, Periodic=False, KnotStyle=1)  # -> Curve, Length, Domain
intcrv_4 = Interpolate(Vertices=pt_6, Degree=3, Periodic=False, KnotStyle=1)  # -> Curve, Length, Domain
loft_2 = Loft(
    Curves=[intcrv_4.Curve, intcrv_3.Curve],
    Options={Adjust=False, Closed=False, LoftEnds=0, LoftSimp=0, LoftType=0, Rebuild=10, Refit=0.01})

merge = Merge(Data1=number_slider_3, Data2=neg)
xy = XYPlane(Origin=Point(0, 0, 0))
intcrv_5 = Interpolate(Vertices=end_2.End, Degree=3, Periodic=False, KnotStyle=1)  # -> Curve, Length, Domain
intcrv_6 = Interpolate(Vertices=end_3.Start, Degree=3, Periodic=False, KnotStyle=1)  # -> Curve, Length, Domain
intcrv_7 = Interpolate(Vertices=end_4.Start, Degree=3, Periodic=False, KnotStyle=1)  # -> Curve, Length, Domain
intcrv_8 = Interpolate(Vertices=end_5.End, Degree=3, Periodic=False, KnotStyle=1)  # -> Curve, Length, Domain
subtraction_3 = Subtraction(A=lng_3, B=Slider(1, range=0..1))
lng_4 = ListLength(List=rotax_2.Geometry)
offset_l_3 = OffsetLoose(Curve=move_6.Geometry, Distance=merge, Plane=xy)
item_3 = ListItem(List=rotax.Geometry, Index=subtraction_3, Wrap=True)
eval_5 = EvaluateLength(Curve=intcrv_6.Curve, Length=number_slider_4, Normalized=True)  # -> Point, Tangent, Parameter
eval_6 = EvaluateLength(Curve=intcrv_5.Curve, Length=number_slider_4, Normalized=True)  # -> Point, Tangent, Parameter
eval_7 = EvaluateLength(Curve=intcrv_8.Curve, Length=number_slider_5, Normalized=True)  # -> Point, Tangent, Parameter
eval_8 = EvaluateLength(Curve=intcrv_7.Curve, Length=number_slider_5, Normalized=True)  # -> Point, Tangent, Parameter
subtraction_4 = Subtraction(A=lng_4, B=Slider(1, range=0..1))
end_6 = EndPoints(Curve=move_6.Geometry)  # -> Start, End
loft_3 = Loft(Curves=offset_l_3, Options={Adjust=False, Closed=False, LoftEnds=0, LoftSimp=0, LoftType=0, Rebuild=10, Refit=0.01})
item_4 = ListItem(List=rotax_2.Geometry, Index=subtraction_4, Wrap=True)
amp_3 = Amplitude(Vector=eval_5.Tangent, Amplitude=Slider(488, range=0..1000))
amp_4 = Amplitude(Vector=eval_6.Tangent, Amplitude=Slider(88, range=0..1000))
amp_5 = Amplitude(Vector=eval_7.Tangent, Amplitude=Slider(488, range=0..1000))
amp_6 = Amplitude(Vector=eval_8.Tangent, Amplitude=Slider(88, range=0..1000))
end_7 = EndPoints(Curve=item_4)  # -> Start, End
end_8 = EndPoints(Curve=item_3)  # -> Start, End
bzspan_2 = BezierSpan(StartPoint=eval_6.Point, StartTangent=amp_4, EndPoint=eval_5.Point, EndTangent=amp_3)  # -> Curve, Length, Domain
bzspan_3 = BezierSpan(StartPoint=eval_8.Point, StartTangent=amp_6, EndPoint=eval_7.Point, EndTangent=amp_5)  # -> Curve, Length, Domain
ln_3 = Line(StartPoint=end_8.Start, EndPoint=end_7.End)
ln_4 = Line(StartPoint=item_2, EndPoint=item)
ln_5 = Line(StartPoint=end_8.End, EndPoint=end_7.Start)
loft_4 = Loft(
    Curves=[bzspan_2.Curve, bzspan_3.Curve],
    Options={Adjust=False, Closed=False, LoftEnds=0, LoftSimp=0, LoftType=0, Rebuild=10, Refit=0.01})
loft_5 = Loft(Curves=rotax.Geometry, Options={Adjust=False, Closed=False, LoftEnds=0, LoftSimp=0, LoftType=0, Rebuild=10, Refit=0.01})
loft_6 = Loft(Curves=[ln_3, ln_5], Options={Adjust=False, Closed=False, LoftEnds=0, LoftSimp=0, LoftType=0, Rebuild=10, Refit=0.01})
loft_7 = Loft(
    Curves=rotax_2.Geometry,
    Options={Adjust=False, Closed=False, LoftEnds=0, LoftSimp=0, LoftType=0, Rebuild=10, Refit=0.01})
join = BrepJoin(Breps=[loft_5, loft_6, loft_7])  # -> Breps, Closed
debrep = DeconstructBrep(Brep=join.Breps)  # -> Faces, Edges, Vertices
bang = ExplodeTree(Data=simplify(graft(debrep.Edges)))  # -> Branch0, Branch1, Branch2, Branch3, Branch4, Branch5, Branch6, Branch7, Branch8, Branch9
