# Grasshopper definition 002_AS_Comments.gh (Grasshopper 0.9.76)

number_slider = Slider(4, range=0..10)
crv = Curve(<curve referenced from the Rhino model>)
number_slider_2 = Slider(4, range=0..10)  # disabled
number_slider_3 = Slider(30, range=0..100)
crv_2 = Curve(<curve referenced from the Rhino model>)
xy = XYPlane(Origin=Point(0, 0, 0))
crv_3 = Curve([<curve referenced from the Rhino model> x2])  # disabled
crv_4 = Curve([<curve referenced from the Rhino model> x2])  # disabled
pln = Plane(crv_2)
divide = DivideCurve(Curve=crv_4, Count=number_slider_2, Kinks=False)  # -> Points, Tangents, Parameters; disabled
divide_2 = DivideCurve(Curve=crv_3, Count=number_slider_2, Kinks=False)  # -> Points, Tangents, Parameters; disabled
brep = Brep([<brep referenced from the Rhino model> x2])
offset_l = OffsetLoose(Curve=crv, Distance=expr("-x", Slider(30, range=0..100)), Plane=xy)
offset_l_2 = OffsetLoose(Curve=crv, Distance=Slider(30, range=0..100), Plane=xy)
Z = UnitZ(Factor=Slider(1, range=0..1))

divide_3 = DivideCurve(Curve=crv, Count=number_slider, Kinks=False)  # -> Points, Tangents, Parameters
dispatch = Dispatch(List=divide_3.Points, DispatchPattern=[True, False])  # -> ListA, ListB

divide_4 = DivideCurve(Curve=offset_l_2, Count=number_slider, Kinks=False)  # -> Points, Tangents, Parameters
divide_5 = DivideCurve(Curve=offset_l, Count=number_slider, Kinks=False)  # -> Points, Tangents, Parameters
extr = Extrude(Base=brep, Direction=Z)
dispatch_2 = Dispatch(List=divide_5.Points, DispatchPattern=[True, False])  # -> ListA, ListB
dispatch_3 = Dispatch(List=divide_4.Points, DispatchPattern=[True, False])  # -> ListA, ListB
number_slider_4 = Slider(10, range=0..10)
suspension_cables = Slider(11, range=0..100)
divide_6 = DivideCurve(Curve=crv_2, Count=suspension_cables, Kinks=False)  # -> Points, Tangents, Parameters
xprod = CrossProduct(VectorA=pln, VectorB=divide_6.Tangents, Unitize=False)  # -> Vector, Length
lng = ListLength(List=xprod.Vector)
range = Range(Domain=Domain(0, 1), Steps=expr("X-1", lng))
graph = GraphMapper(
    range,
    x0=0,
    x1=1,
    y0=0,
    y1=1,
    container_name="Parabola",
    Ox=0.494840771,
    Oy=0.1557679176,
    Px=0.9669565558,
    Py=0.8449277878)
multiplication = Multiplication(A=graph, B=Slider(18.9, range=0..100))
amp = Amplitude(Vector=xprod.Vector, Amplitude=multiplication)
move = Move(Geometry=divide_6.Points, Motion=amp)  # -> Geometry, Transform
weave = Weave(Pattern=[0, 1], Stream0=dispatch.ListA, Stream1=dispatch_2.ListB, NullGaps=False)
weave_2 = Weave(Pattern=[0, 1], Stream0=dispatch.ListA, Stream1=dispatch_3.ListB, NullGaps=False)
panel = Panel(graph)
ln = Line(StartPoint=divide_6.Points, EndPoint=move.Geometry)
intcrv = Interpolate(Vertices=reverse(weave), Degree=3, Periodic=False, KnotStyle=1)  # -> Curve, Length, Domain
intcrv_2 = Interpolate(Vertices=weave_2, Degree=3, Periodic=False, KnotStyle=1)  # -> Curve, Length, Domain
loft = Loft(Curves=ln, Options={Adjust=False, Closed=False, LoftEnds=0, LoftSimp=0, LoftType=0, Rebuild=10, Refit=0.01})
Y = UnitY(Factor=Slider(0.5, range=0..1))
number_slider_5 = Slider(10, range=0..10)
extr_2 = Extrude(Base=loft, Direction=Y)
crv_5 = Curve(flatten([intcrv_2.Curve, intcrv.Curve]))
divide_7 = DivideCurve(Curve=intcrv_2.Curve, Count=Slider(500, range=0..1000), Kinks=False)  # -> Points, Tangents, Parameters
divide_8 = DivideCurve(Curve=intcrv.Curve, Count=Slider(500, range=0..1000), Kinks=False)  # -> Points, Tangents, Parameters
crv_6 = Curve(simplify(graft(crv_5)))
number_slider_6 = Slider(300, range=0..1000)

cluster = Cluster(C=intcrv.Curve, t=divide_8.Parameters, A=expr("-x", number_slider_5))
srf = Surface(cluster)

cluster_2 = Cluster_2(C=intcrv_2.Curve, t=divide_7.Parameters, A=number_slider_5)
Z_2 = UnitZ(Factor=Slider(1, range=0..100))
srf_2 = Surface(cluster_2)
offset = Offset(Curve=crv_6, Distance=Slider(10, range=0..10), Plane=PlaneXY(0, 0, 0), Corners=1)  # -> simplify(Curve)
move_2 = Move(Geometry=[crv_6, offset], Motion=Z_2)  # -> Geometry, Transform
crv_7 = Curve([offset, crv_6])
divide_9 = DivideCurve(Curve=move_2.Geometry, Count=number_slider_6, Kinks=False)  # -> Points, Tangents, Parameters
divide_10 = DivideCurve(Curve=crv_7, Count=number_slider_6, Kinks=False)  # -> Points, Tangents, Parameters
debrep = DeconstructBrep(Brep=srf)  # -> Faces, Edges, Vertices
debrep_2 = DeconstructBrep(Brep=srf_2)  # -> Faces, Edges, Vertices
crv_8 = Curve(simplify([crv_6, offset]))
bang = ExplodeTree(Data=divide_9.Points)  # -> Branch0, Branch1, Branch2, Branch3
bang_2 = ExplodeTree(Data=divide_10.Points)  # -> Branch0, Branch1, Branch2, Branch3
loft_2 = Loft(Curves=[offset, crv_6], Options={Adjust=False, Closed=False, LoftEnds=0, LoftSimp=0, LoftType=0, Rebuild=10, Refit=0.01})
crv_9 = Curve(crv)
item = ListItem(List=debrep_2.Edges, Index=Slider(0, range=0..10), Wrap=True)
item_2 = ListItem(List=debrep.Edges, Index=Slider(0, range=0..10), Wrap=True)
divide_11 = DivideCurve(Curve=simplify(graft(crv_8)), Count=suspension_cables, Kinks=False)  # -> simplify(Points), Tangents, Parameters
ln_2 = Line(StartPoint=bang.Branch0, EndPoint=bang_2.Branch1)
ln_3 = Line(StartPoint=bang.Branch1, EndPoint=bang_2.Branch0)
ln_4 = Line(StartPoint=bang.Branch2, EndPoint=bang_2.Branch3)
ln_5 = Line(StartPoint=bang.Branch3, EndPoint=bang_2.Branch2)
len = Length(Curve=item_2)
len_2 = Length(Curve=item_2)
path_mapper = PathMapper(divide_11.Points, source="{a;b}(i)", target="{a;i}(b)")
pipe = Pipe(Curve=[ln_2, ln_3, ln_4, move_2.Geometry, crv_7, ln_5], Radius=Slider(0.1, range=0..0.1), Caps=0)
pull = PullPoint(Point=path_mapper, Geometry=crv_9, ClosestOnly=True)  # -> ClosestPoint, Distance
multiplication_2 = Multiplication(A=len, B=Slider(0.366, range=0..1))
multiplication_3 = Multiplication(A=len_2, B=Slider(0.633, range=0..1))
eval = EvaluateLength(Curve=reparameterize(item_2), Length=multiplication_2, Normalized=invert(True))  # -> Point, Tangent, Parameter
sort = SortList(Keys=pull.Distance, ValuesA=path_mapper)  # -> Keys, ValuesA
eval_2 = EvaluateLength(Curve=reparameterize(item_2), Length=multiplication_3, Normalized=invert(True))  # -> Point, Tangent, Parameter
divide_12 = DivideCurve(Curve=crv_2, Count=Slider(21, range=0..100), Kinks=False)  # -> Points, Tangents, Parameters
item_3 = ListItem(List=sort.ValuesA, Index=0, Wrap=True)
rev = ReverseList(List=divide_12.Points)
shatter = Shatter(Curve=item_2, Parameters=[eval_2.Parameter, eval.Parameter])
entwine = Entwine(Branch00=divide_12.Points, Branch01=rev, FlattenInputs=True)
pshift = ShiftPaths(Data=item_3, Offset=-1)
ln_6 = Line(StartPoint=pshift, EndPoint=entwine)
pipe_2 = Pipe(Curve=ln_6, Radius=Slider(0.3, range=0..1), Caps=0)

# ==== cluster Cluster
C = ClusterInput()
t = ClusterInput()
hframe = HorizontalFrame(Curve=C, Parameter=t)
deplane = DeconstructPlane(Plane=hframe)  # -> Origin, XAxis, YAxis, ZAxis
A = ClusterInput()
amp = Amplitude(Vector=deplane.YAxis, Amplitude=A)
pt = Point(deplane.Origin)
move = Move(Geometry=deplane.Origin, Motion=amp)  # -> Geometry, Transform
ln = Line(StartPoint=pt, EndPoint=move.Geometry)
loft = Loft(Curves=ln, Options={Adjust=False, Closed=False, LoftEnds=0, LoftSimp=0, LoftType=0, Rebuild=10, Refit=0.01})
L = ClusterOutput(loft)

# ==== cluster Cluster_2
C = ClusterInput()
t = ClusterInput()
hframe = HorizontalFrame(Curve=C, Parameter=t)
deplane = DeconstructPlane(Plane=hframe)  # -> Origin, XAxis, YAxis, ZAxis
A = ClusterInput()
amp = Amplitude(Vector=deplane.YAxis, Amplitude=A)
rev = Reverse(Vector=amp)
pt = Point(deplane.Origin)
move = Move(Geometry=deplane.Origin, Motion=rev)  # -> Geometry, Transform
ln = Line(StartPoint=pt, EndPoint=move.Geometry)
loft = Loft(Curves=ln, Options={Adjust=False, Closed=False, LoftEnds=0, LoftSimp=0, LoftType=0, Rebuild=10, Refit=0.01})
L = ClusterOutput(loft)
