# Grasshopper definition 003_PP_Comments.gh (Grasshopper 0.9.76)

# ---- group: Islands
crv = Curve(<curve referenced from the Rhino model>)
crv_2 = Curve(<curve referenced from the Rhino model>)
pt = Point([<point referenced from the Rhino model> x4])
circle = CircleCNR(Center=pt, Normal=Vector(0, 0, 1), Radius=Slider(10, range=0..100))
neg = Negative(Value=Slider(30, range=0..100))
area = Area(Geometry=[crv, crv_2])  # -> Area, Centroid
divide = DivideCurve(Curve=graft([crv_2, crv]), Count=13, Kinks=False)  # -> Points, Tangents, Parameters
Z = UnitZ(Factor=neg)
avr = Average(Input=area.Centroid)
extr = Extrude(Base=[crv, crv_2], Direction=Z)
dist = Distance(PointA=avr, PointB=divide.Points)
sort = SortList(Keys=dist, ValuesA=divide.Points)  # -> Keys, ValuesA
series = Series(Start=0, Step=1, Count=Slider(3, range=0..10))
cull_i = CullIndex(List=sort.ValuesA, Indices=series, Wrap=True)  # -> simplify(List)

# ----
pt_2 = Point(<point referenced from the Rhino model>)
pt_3 = Point(<point referenced from the Rhino model>)
pt_4 = Point(<point referenced from the Rhino model>)
neg_2 = Negative(Value=Slider(20, range=0..100))
Z_2 = UnitZ(Factor=neg_2)
number_slider = Slider(77, range=0..100)
number_slider_2 = Slider(2, range=0..10)
move = Move(Geometry=pt_2, Motion=Z_2)  # -> Geometry, Transform
move_2 = Move(Geometry=pt_4, Motion=Z_2)  # -> Geometry, Transform

# ---- group: central island
pt_5 = Point(<point referenced from the Rhino model>)
circle_2 = CircleCNR(Center=pt_5, Normal=Vector(0, 0, 1), Radius=Slider(20, range=0..100))
cyl = Cylinder(Base=circle_2, Radius=Slider(20, range=0..100), Length=Slider(25, range=0..100))
divide_2 = DivideCurve(Curve=circle_2, Count=Slider(8, range=0..10), Kinks=False)  # -> Points, Tangents, Parameters
Z_3 = UnitZ(Factor=Slider(25, range=0..100))
move_3 = Move(Geometry=divide_2.Points, Motion=Z_3)  # -> Geometry, Transform
item = ListItem(List=move_3.Geometry, Index=Slider(7, range=0..10), Wrap=True)
item_2 = ListItem(List=move_3.Geometry, Index=Slider(3, range=0..10), Wrap=True)
item_3 = ListItem(List=move_3.Geometry, Index=Slider(5, range=0..10), Wrap=True)
item_4 = ListItem(List=move_3.Geometry, Index=Slider(9, range=0..10), Wrap=True)

# ----
cyl_2 = Cylinder(Base=move_2.Geometry, Radius=number_slider_2, Length=number_slider)
cyl_3 = Cylinder(Base=move.Geometry, Radius=number_slider_2, Length=number_slider)
partition = PartitionList(List=cull_i, Size=[1, 2])

# ---- group: deck
ln = Line(StartPoint=pt_3, EndPoint=pt_2)
ln_2 = Line(StartPoint=pt_4, EndPoint=pt_3)
neg_3 = Negative(Value=Slider(4, range=0..10))
offset = Offset(Curve=[ln_2, ln], Distance=graft([Slider(4, range=0..10), neg_3]), Plane=PlaneXY(0, 0, 0), Corners=1)
Z_4 = UnitZ(Factor=Slider(5, range=0..10))
move_4 = Move(Geometry=offset, Motion=Z_4)  # -> Geometry, Transform
divdist = DivideDistance(Curve=move_4.Geometry, Distance=Slider(13, range=0..100))  # -> Points, Tangents, Parameters

# ----
debrep = DeconstructBrep(Brep=extr)  # -> Faces, Edges, Vertices
item_5 = ListItem(List=debrep.Faces, Index=Slider(3, range=0..10), Wrap=True)
item_6 = ListItem(List=debrep.Faces, Index=Slider(5, range=0..10), Wrap=True)
pull = PullCurve(Curve=flatten(offset), Surface=item_6)
pull_2 = PullCurve(Curve=flatten(offset), Surface=item_5)
crv_3 = Curve(<curve referenced from the Rhino model>)
crv_4 = Curve(<curve referenced from the Rhino model>)
end = EndPoints(Curve=[crv_3, crv_4])  # -> Start, End
Z_5 = UnitZ(Factor=Slider(5, range=0..10))
move_5 = Move(Geometry=[end.Start, end.End], Motion=Z_5)  # -> Geometry, Transform

viewer = ParamViewer(divdist.Points)
item_7 = ListItem(List=viewer, Index=0, Wrap=True)
branch = TreeBranch(Tree=divdist.Points, Path=item_7, MaintainPaths=True)

item_8 = ListItem(List=move_5.Geometry, Index=Slider(4, range=0..10), Wrap=True)
item_9 = ListItem(List=move_5.Geometry, Index=Slider(6, range=0..10), Wrap=True)
item_10 = ListItem(List=move_5.Geometry, Index=Slider(3, range=0..10), Wrap=True)
item_11 = ListItem(List=move_5.Geometry, Index=Slider(1, range=0..10), Wrap=True)
# Trying to isolate a single set of points, however there are always 2 sets selected.
item_12 = ListItem(List=branch, Index=simplify(flatten(Slider(6, range=0..10))), Wrap=True)

# ---- group: suspension
edges = BrepEdges(Brep=cyl_3)  # -> Naked, Interior, NonManifold
edges_2 = BrepEdges(Brep=cyl_2)  # -> Naked, Interior, NonManifold
crv_5 = Curve(edges_2.Naked)
crv_6 = Curve(edges.Naked)
cull_i_2 = CullIndex(List=crv_5, Indices=2, Wrap=True)
cull_i_3 = CullIndex(List=crv_6, Indices=2, Wrap=True)
divide_3 = DivideCurve(Curve=cull_i_2, Count=20, Kinks=False)  # -> Points, Tangents, Parameters
divide_4 = DivideCurve(Curve=cull_i_3, Count=20, Kinks=False)  # -> Points, Tangents, Parameters

# ----
shift = ShiftList(List=divide_4.Points, Shift=6, Wrap=True)
shift_2 = ShiftList(List=divide_3.Points, Shift=-5, Wrap=True)

# ---- group: suspension (continued)
cull_i_4 = CullIndex(List=shift, Indices=[0, 1, 2, 3, 4, 5, 6, 7, 8, 9], Wrap=True)
cull_i_5 = CullIndex(List=shift_2, Indices=[0, 1, 2, 3, 4, 5, 6, 7, 8, 9], Wrap=True)
merge = Merge(Data1=cull_i_5, Data2=cull_i_4)  # -> simplify(graft(Result))
ln_3 = Line(StartPoint=graft(cull_i_4), EndPoint=[item, item_4])
ln_4 = Line(StartPoint=graft(cull_i_5), EndPoint=[item_2, item_3])

# ----
group = Group(Objects=cull_i_5)
group_2 = Group(Objects=cull_i_4)
merge_2 = Merge(Data1=group, Data2=group_2)  # -> simplify(graft(Result))
ungroup = Ungroup(Group=merge_2)  # -> simplify(Objects)

# ---- group: suspension (continued)
# Not sure how to prevent the lines that travel across to the other side.
# Not sure if this is what you want.
ln_5 = Line(StartPoint=ungroup, EndPoint=cull_i)
