# Grasshopper definition 004_SC_Comments.gh (Grasshopper 0.9.76)

pt = ConstructPoint(XCoordinate=0, YCoordinate=0, ZCoordinate=0)
number_slider = Slider(2, range=0..10)
number_slider_2 = Slider(2.3, range=0..10)
number_slider_3 = Slider(1.1, range=0..10)
pt_2 = ConstructPoint(XCoordinate=0, YCoordinate=0, ZCoordinate=0)
centre_point = Point(pt_2)
X = UnitX(Factor=Slider(2, range=0..10))
X_2 = UnitX(Factor=Slider(4, range=0..10))
X_3 = UnitX(Factor=number_slider_2)
Y = UnitY(Factor=number_slider_3)
X_4 = UnitX(Factor=number_slider)
X_5 = UnitX(Factor=number_slider)
Y_2 = UnitY(Factor=number_slider_3)
X_6 = UnitX(Factor=number_slider_2)
move = Move(Geometry=pt, Motion=X)  # -> Geometry, Transform
Y_3 = UnitY(Factor=Slider(0.593, range=0..11))
neg = Negative(Value=X_3)
neg_2 = Negative(Value=Y)
neg_3 = Negative(Value=X_4)
move_2 = Move(Geometry=pt, Motion=X_2)  # -> Geometry, Transform
move_3 = Move(Geometry=move.Geometry, Motion=Y_3)  # -> Geometry, Transform
move_4 = Move(Geometry=centre_point, Motion=neg_3)  # -> Geometry, Transform
move_5 = Move(Geometry=move_4.Geometry, Motion=neg)  # -> Geometry, Transform
move_6 = Move(Geometry=move_4.Geometry, Motion=neg_2)  # -> Geometry, Transform
move_7 = Move(Geometry=centre_point, Motion=X_5)  # -> Geometry, Transform
move_8 = Move(Geometry=move_7.Geometry, Motion=Y_2)  # -> Geometry, Transform
move_9 = Move(Geometry=move_7.Geometry, Motion=X_6)  # -> Geometry, Transform
pt_3 = Point([pt, move_3.Geometry, move_2.Geometry])
X_7 = UnitX(Factor=1)
Y_4 = UnitY(Factor=1)
parc = PolyArc(Vertices=pt_3, Tangent=X_7, Closed=False)
pt_4 = Point([move_5.Geometry, move_6.Geometry, centre_point, move_8.Geometry, move_9.Geometry])
intcrv = Interpolate(Vertices=pt_3, Degree=3, Periodic=False, KnotStyle=1)  # -> Curve, Length, Domain
ln = Line(StartPoint=move_5.Geometry, EndPoint=move_9.Geometry)
X_8 = UnitX(Factor=1)
Y_5 = UnitY(Factor=1)
len = Length(Curve=ln)
panel = Panel(len)
intcrv_2 = Interpolate(Vertices=pt_4, Degree=3, Periodic=False, KnotStyle=1)  # -> Curve, Length, Domain
parc_2 = PolyArc(Vertices=pt_4, Tangent=X_8, Closed=False)

# ---- group: changing the thickness of the seat deck
N = Count(100)
range = Range(Domain=Domain(0, 1), Steps=N)
graph = GraphMapper(
    range,
    x0=0,
    x1=1,
    y0=0,
    y1=1,
    container_name="Sine",
    Equation_px=[0, 0.6449275613],
    Equation_py=[0.6449275017, 0.03623187542])
dom = ConstructDomain(DomainStart=Slider(0.41, range=0..1), DomainEnd=Slider(1.5, range=0..3))
crv = Curve(parc_2)
remap = RemapNumbers(Value=graph, Source=Domain(0, 1), Target=dom)  # -> Mapped, Clipped
line = Line(Line((-576.8980916, -375.8383168, 0), (2176.901229, -601.1073764, 0)))
panel_2 = Panel(remap.Mapped)
pt_5 = ConstructPoint(XCoordinate=expr("-x", remap.Mapped), YCoordinate=0, ZCoordinate=0)
pframes = PerpFrames(Curve=crv, Count=N, Align=True)  # -> Frames, Parameters
Z = UnitZ(Factor=1)
pt_6 = ConstructPoint(XCoordinate=remap.Mapped, YCoordinate=0, ZCoordinate=0)
xy = XYPlane(Origin=Point(0, 0, 0))
Y_6 = UnitY(Factor=1)
align = AlignPlane(Plane=pframes.Frames, Direction=Z)  # -> Plane, Angle
ln_2 = Line(StartPoint=pt_6, EndPoint=pt_5)
align_2 = AlignPlane(Plane=xy, Direction=Y_6)  # -> Plane, Angle
orient = Orient(Geometry=ln_2, Source=align_2.Plane, Target=align.Plane)  # -> Geometry, Transform
geo = Geometry(orient.Geometry)
loft = Loft(Curves=geo, Options={Adjust=False, Closed=False, LoftEnds=0, LoftSimp=0, LoftType=0, Rebuild=10, Refit=0.01})

# ----
xz = XZPlane(Origin=Point(0, 0, 0))

# ---- group: changing the height of the seat rest
N_2 = Count(100)
range_2 = Range(Domain=Domain(0, 1), Steps=N_2)
graph_2 = GraphMapper(
    range_2,
    x0=0,
    x1=1,
    y0=0,
    y1=1,
    container_name="Sine",
    Equation_px=[0.0637684688, 0.2539133132],
    Equation_py=[0.7631888986, 0])
dom_2 = ConstructDomain(DomainStart=Slider(0.4, range=0..1), DomainEnd=Slider(1, range=0..3))
remap_2 = RemapNumbers(Value=graph_2, Source=Domain(0, 1), Target=dom_2)  # -> Mapped, Clipped
panel_3 = Panel(remap_2.Mapped)
crv_2 = Curve(parc_2)
pt_7 = ConstructPoint(XCoordinate=expr("0", remap_2.Mapped), YCoordinate=0, ZCoordinate=0)
pt_8 = ConstructPoint(XCoordinate=expr("-x", remap_2.Mapped), YCoordinate=0, ZCoordinate=0)
pframes_2 = PerpFrames(Curve=crv_2, Count=N_2, Align=True)  # -> Frames, Parameters
Y_7 = UnitY(Factor=1)
Z_2 = UnitZ(Factor=1)
align_3 = AlignPlane(Plane=pframes_2.Frames, Direction=Y_7)  # -> Plane, Angle
ln_3 = Line(StartPoint=pt_7, EndPoint=pt_8)
align_4 = AlignPlane(Plane=xz, Direction=Z_2)  # -> Plane, Angle
orient_2 = Orient(Geometry=ln_3, Source=align_4.Plane, Target=align_3.Plane)  # -> Geometry, Transform
# Could you fix these points?
geo_2 = Geometry(orient_2.Geometry)
loft_2 = Loft(Curves=geo_2, Options={Adjust=False, Closed=False, LoftEnds=0, LoftSimp=0, LoftType=0, Rebuild=10, Refit=0.01})

# ----
seating_height = Slider(0.4, range=0..1)
rest_height = Slider(0.2, range=0..1)
flip = FlipCurve(Curve=geo)  # -> Curve, Flag
flip_2 = FlipCurve(Curve=geo)  # -> Curve, Flag
curvepoint = PointOnCurve(geo, parameter=0.5)
end = EndPoints(Curve=geo)  # -> Start, End
# This will do the trick.
flip_3 = FlipCurve(Curve=geo_2)  # -> Curve, Flag
curvepoint_2 = PointOnCurve(geo, parameter=0.267)

curvepoint_3 = PointOnCurve(geo, parameter=0.9)
curvepoint_4 = PointOnCurve(flip.Curve, parameter=0.9)

curvepoint_5 = PointOnCurve(flip_2.Curve, parameter=0.267)
end_2 = EndPoints(Curve=flip_3.Curve)  # -> Start, End
addition = Addition(A=seating_height, B=rest_height)
preview = CustomPreview(
    Geometry=end.Start,
    Shader={ambient=RGB(0, 0, 0), diffuse=RGB(255, 105, 180), emission=RGB(76, 32, 54), shine=0.5, specular=RGB(255, 255, 255), transparency=0})
Z_3 = UnitZ(Factor=seating_height)
Z_4 = UnitZ(Factor=seating_height)
Z_5 = UnitZ(Factor=addition)
Z_6 = UnitZ(Factor=seating_height)
Z_7 = UnitZ(Factor=seating_height)
preview_2 = CustomPreview(
    Geometry=end_2.End,
    Shader={ambient=RGB(0, 0, 0), diffuse=RGB(255, 105, 180), emission=RGB(76, 32, 54), shine=0.5, specular=RGB(255, 255, 255), transparency=0})
graft = GraftTree(Tree=end_2.End, IncludeEmptyLists=True, IncludeNullItems=True)
move_10 = Move(Geometry=curvepoint_3, Motion=Z_3)  # -> Geometry, Transform
move_11 = Move(Geometry=curvepoint_5, Motion=Z_4)  # -> Geometry, Transform
move_12 = Move(Geometry=curvepoint, Motion=Z_5)  # -> Geometry, Transform
move_13 = Move(Geometry=curvepoint_2, Motion=Z_6)  # -> Geometry, Transform
move_14 = Move(Geometry=curvepoint_4, Motion=Z_7)  # -> Geometry, Transform
graft_2 = GraftTree(Tree=end_2.End, IncludeEmptyLists=True, IncludeNullItems=True)
graft_3 = GraftTree(Tree=end.End, IncludeEmptyLists=True, IncludeNullItems=True)
graft_4 = GraftTree(Tree=move_10.Geometry, IncludeEmptyLists=True, IncludeNullItems=True)
graft_5 = GraftTree(Tree=move_11.Geometry, IncludeEmptyLists=True, IncludeNullItems=True)
graft_6 = GraftTree(Tree=move_12.Geometry, IncludeEmptyLists=True, IncludeNullItems=True)
graft_7 = GraftTree(Tree=move_13.Geometry, IncludeEmptyLists=True, IncludeNullItems=True)
graft_8 = GraftTree(Tree=move_14.Geometry, IncludeEmptyLists=True, IncludeNullItems=True)
graft_9 = GraftTree(Tree=end.Start, IncludeEmptyLists=True, IncludeNullItems=True)
intcrv_3 = Interpolate(Vertices=[graft_3, graft_4, graft_5, graft_2, graft_7, graft_8, graft_9], Degree=3, Periodic=False, KnotStyle=1)  # -> Curve, Length, Domain
loft_3 = Loft(
    Curves=flatten(intcrv_3.Curve),
    Options={Adjust=False, Closed=False, LoftEnds=0, LoftSimp=0, LoftType=0, Rebuild=10, Refit=0.01})
