# Grasshopper definition 005_PP_Comments.gh (Grasshopper 0.9.76)

# ---- group: Islands
crv = Curve(<curve referenced from the Rhino model>)
crv_2 = Curve(<curve referenced from the Rhino model>)
pt = Point([<point referenced from the Rhino model> x4])
circle = CircleCNR(Center=pt, Normal=Vector(0, 0, 1), Radius=Slider(10, range=0..100))
neg = Negative(Value=Slider(30, range=0..100))
area = Area(Geometry=[crv, crv_2])  # -> Area, Centroid
divide = DivideCurve(Curve=graft([crv_2, crv]), Count=13, Kinks=False)  # -> Points, Tangents, Parameters
Z = UnitZ(Factor=neg)
avr = Average(Input=area.Centroid)
extr = Extrude(Base=[crv, crv_2], Direction=Z)
dist = Distance(PointA=avr, PointB=divide.Points)
sort = SortList(Keys=dist, ValuesA=divide.Points)  # -> Keys, ValuesA
series = Series(Start=0, Step=1, Count=Slider(3, range=0..10))
cull_i = CullIndex(List=sort.ValuesA, Indices=series, Wrap=True)  # -> simplify(List)

# ----
pt_2 = Point(<point referenced from the Rhino model>)
pt_3 = Point(<point referenced from the Rhino model>)
pt_4 = Point(<point referenced from the Rhino model>)
neg_2 = Negative(Value=Slider(20, range=0..100))
Z_2 = UnitZ(Factor=neg_2)
number_slider = Slider(77, range=0..100)
number_slider_2 = Slider(2, range=0..10)
move = Move(Geometry=pt_2, Motion=Z_2)  # -> Geometry, Transform
move_2 = Move(Geometry=pt_4, Motion=Z_2)  # -> Geometry, Transform
cyl = Cylinder(Base=move_2.Geometry, Radius=number_slider_2, Length=number_slider)

# ---- group: central island
crv_3 = Curve(<curve referenced from the Rhino model>)
Z_3 = UnitZ(Factor=Slider(25, range=0..100))
extr_2 = Extrude(Base=crv_3, Direction=Z_3)
divide_2 = DivideCurve(Curve=crv_3, Count=Slider(8, range=0..10), Kinks=False)  # -> Points, Tangents, Parameters
Z_4 = UnitZ(Factor=Slider(25, range=0..100))
move_3 = Move(Geometry=divide_2.Points, Motion=Z_4)  # -> Geometry, Transform
item = ListItem(List=move_3.Geometry, Index=Slider(8, range=0..10), Wrap=True)
item_2 = ListItem(List=move_3.Geometry, Index=Slider(4, range=0..10), Wrap=True)
item_3 = ListItem(List=move_3.Geometry, Index=Slider(6, range=0..10), Wrap=True)
item_4 = ListItem(List=move_3.Geometry, Index=Slider(10, range=0..10), Wrap=True)

# ----
cyl_2 = Cylinder(Base=move.Geometry, Radius=number_slider_2, Length=number_slider)
partition = PartitionList(List=cull_i, Size=[1, 2])

# ---- group: deck
ln = Line(StartPoint=pt_3, EndPoint=pt_2)
ln_2 = Line(StartPoint=pt_4, EndPoint=pt_3)
neg_3 = Negative(Value=Slider(4, range=0..10))
offset = Offset(Curve=[ln_2, ln], Distance=graft([Slider(4, range=0..10), neg_3]), Plane=PlaneXY(0, 0, 0), Corners=1)
Z_5 = UnitZ(Factor=Slider(5, range=0..10))
move_4 = Move(Geometry=offset, Motion=Z_5)  # -> Geometry, Transform
divdist = DivideDistance(Curve=move_4.Geometry, Distance=Slider(13, range=0..100))  # -> Points, Tangents, Parameters

# ----
debrep = DeconstructBrep(Brep=extr)  # -> Faces, Edges, Vertices
explode = Explode(Curve=crv_2, Recursive=True)  # -> Segments, Vertices
explode_2 = Explode(Curve=crv, Recursive=True)  # -> Segments, Vertices
item_5 = ListItem(List=debrep.Faces, Index=Slider(3, range=0..10), Wrap=True)
item_6 = ListItem(List=debrep.Faces, Index=Slider(5, range=0..10), Wrap=True)
item_7 = ListItem(List=explode.Vertices, Index=[2, 3], Wrap=True)
pull = PullCurve(Curve=flatten(offset), Surface=item_6)
item_8 = ListItem(List=explode_2.Vertices, Index=[0, 1], Wrap=True)  # -> reverse(Item)
pull_2 = PullCurve(Curve=flatten(offset), Surface=item_5)
crv_4 = Curve(<curve referenced from the Rhino model>)
crv_5 = Curve(<curve referenced from the Rhino model>)
eval = EvaluateLength(Curve=move_4.Geometry, Length=0.5, Normalized=True)  # -> simplify(Point), Tangent, Parameter
merge = Merge(Data1=item_2, Data2=item_4, Data3=item_3, Data4=item)  # -> flatten(Result)
weave = Weave(Pattern=[0, 1], Stream0=item_7, Stream1=item_8, NullGaps=False)  # -> flatten(Weave)
end = EndPoints(Curve=[crv_4, crv_5])  # -> Start, End
flatten = FlattenTree(Tree=eval.Point, Path="{0}")
Z_6 = UnitZ(Factor=Slider(5, range=0..10))
move_5 = Move(Geometry=[end.Start, end.End], Motion=Z_6)  # -> Geometry, Transform

viewer = ParamViewer(divdist.Points)
item_9 = ListItem(List=viewer, Index=0, Wrap=True)
branch = TreeBranch(Tree=divdist.Points, Path=item_9, MaintainPaths=True)

merge_2 = Merge(Data1=graft(weave), Data2=graft(flatten), Data3=graft(merge))
points = PointList(Points=flatten)
item_10 = ListItem(List=branch, Index=simplify(flatten(Slider(6, range=0..10))), Wrap=True)
item_11 = ListItem(List=merge_2, Index=0, Wrap=True)  # -> Item, Item1, Item2
pline = PolyLine(Vertices=merge_2, Closed=False)
item_12 = ListItem(List=move_5.Geometry, Index=Slider(4, range=0..10), Wrap=True)
item_13 = ListItem(List=move_5.Geometry, Index=Slider(6, range=0..10), Wrap=True)
item_14 = ListItem(List=move_5.Geometry, Index=Slider(3, range=0..10), Wrap=True)
item_15 = ListItem(List=move_5.Geometry, Index=Slider(1, range=0..10), Wrap=True)
arc = Arc3Pt(PointA=item_11.Item, PointB=item_11.Item1, PointC=item_11.Item2)  # -> Arc, Plane, Radius
intcrv = Interpolate(Vertices=merge_2, Degree=3, Periodic=False, KnotStyle=1)  # -> Curve, Length, Domain

# ---- group: suspension
edges = BrepEdges(Brep=cyl_2)  # -> Naked, Interior, NonManifold
edges_2 = BrepEdges(Brep=cyl)  # -> Naked, Interior, NonManifold
crv_6 = Curve(edges_2.Naked)
crv_7 = Curve(edges.Naked)
cull_i_2 = CullIndex(List=crv_6, Indices=2, Wrap=True)
cull_i_3 = CullIndex(List=crv_7, Indices=2, Wrap=True)
divide_3 = DivideCurve(Curve=cull_i_2, Count=20, Kinks=False)  # -> Points, Tangents, Parameters
divide_4 = DivideCurve(Curve=cull_i_3, Count=20, Kinks=False)  # -> Points, Tangents, Parameters

# ----
shift = ShiftList(List=divide_4.Points, Shift=6, Wrap=True)
shift_2 = ShiftList(List=divide_3.Points, Shift=-5, Wrap=True)

# ---- group: suspension (continued)
cull_i_4 = CullIndex(List=shift, Indices=[0, 1, 2, 3, 4, 5, 6, 7, 8, 9], Wrap=True)
cull_i_5 = CullIndex(List=shift_2, Indices=[0, 1, 2, 3, 4, 5, 6, 7, 8, 9], Wrap=True)
merge_3 = Merge(Data1=cull_i_5, Data2=cull_i_4)  # -> simplify(graft(Result))
ln_3 = Line(StartPoint=graft(cull_i_4), EndPoint=[item, item_4])
ln_4 = Line(StartPoint=graft(cull_i_5), EndPoint=[item_2, item_3])

# ----
group = Group(Objects=cull_i_5)
group_2 = Group(Objects=cull_i_4)
merge_4 = Merge(Data1=group, Data2=group_2)  # -> simplify(graft(Result))
ungroup = Ungroup(Group=merge_4)  # -> simplify(Objects)

# ---- group: suspension (continued)
ln_5 = Line(StartPoint=ungroup, EndPoint=cull_i)
