# Grasshopper definition 007_NB_Comments.gh (Grasshopper 0.9.76)
# plug-ins: Karamba, Bifocals

pt = Point(<point referenced from the Rhino model>)
pt_2 = Point(<point referenced from the Rhino model>)
pt_3 = Point(<point referenced from the Rhino model>)
pt_4 = Point(<point referenced from the Rhino model>)
pt_5 = Point(<point referenced from the Rhino model>)
pt_6 = Point(<point referenced from the Rhino model>)
pt_7 = Point(pt_6)
pt_8 = Point(<point referenced from the Rhino model>)
pt_9 = Point(<point referenced from the Rhino model>)
pt_10 = Point(pt_9)
pt_11 = Point(<point referenced from the Rhino model>)
ln = Line(StartPoint=pt_7, EndPoint=pt_10)
number_slider = Slider(10, range=0..100)

# ---- group: BENCH
cir = Circle(Plane=PlaneXY(0, 0, 0), Radius=0.7)
cir_2 = Circle(Plane=PlaneXY(0, 0, 0), Radius=0.65)
cir_3 = Circle(Plane=PlaneXY(0, 0, 0), Radius=0.85)
cir_4 = Circle(Plane=PlaneXY(0, 0, 0), Radius=0.9)
Z = UnitZ(Factor=Slider(0.47, range=0..1))
move = Move(Geometry=cir, Motion=Z)  # -> Geometry, Transform
move_2 = Move(Geometry=cir_2, Motion=Z)  # -> Geometry, Transform
move_3 = Move(Geometry=cir_3, Motion=Z)  # -> Geometry, Transform
move_4 = Move(Geometry=cir_4, Motion=Z)  # -> Geometry, Transform
tweencrv = TweenCurve(CurveA=move.Geometry, CurveB=move_2.Geometry, Factor=0.5, BlendType=0)
loft = Loft(
    Curves=[move.Geometry, move_2.Geometry],
    Options={Adjust=False, Closed=False, LoftEnds=0, LoftSimp=0, LoftType=0, Rebuild=10, Refit=0.01})
loft_2 = Loft(
    Curves=[move_3.Geometry, move_4.Geometry],
    Options={Adjust=False, Closed=False, LoftEnds=0, LoftSimp=0, LoftType=0, Rebuild=10, Refit=0.01})
tweencrv_2 = TweenCurve(CurveA=move_3.Geometry, CurveB=move_4.Geometry, Factor=0.5, BlendType=0)
crv = Curve(<curve referenced from the Rhino model>)
neg = Negative(Value=Slider(0.05, range=0..0.1))
Z_2 = UnitZ(Factor=Slider(0.5, range=0..1))
neg_2 = Negative(Value=Slider(0.03, range=0..0.1))
boundary = BoundarySurfaces(Edges=crv)
Z_3 = UnitZ(Factor=neg)
move_5 = Move(Geometry=boundary, Motion=Z_2)  # -> Geometry, Transform
Z_4 = UnitZ(Factor=neg_2)
divide = DivideCurve(Curve=tweencrv, Count=7, Kinks=False)  # -> Points, Tangents, Parameters
extr = Extrude(Base=loft, Direction=Z_3)
extr_2 = Extrude(Base=loft_2, Direction=Z_3)
divide_2 = DivideCurve(Curve=tweencrv_2, Count=7, Kinks=False)  # -> Points, Tangents, Parameters
extr_3 = Extrude(Base=move_5.Geometry, Direction=Z_4)
circle = CircleCNR(Center=divide.Points, Normal=Vector(0, 0, 1), Radius=0.02)
circle_2 = CircleCNR(Center=divide_2.Points, Normal=Vector(0, 0, 1), Radius=0.02)
ln_2 = Line(StartPoint=divide.Points, EndPoint=divide_2.Points)
arrpolar = PolarArray(Geometry=extr_3, Plane=PlaneXY(0, 0, 0), Count=35, Angle=6.283185307)  # -> Geometry, Transform
neg_3 = Negative(Value=Slider(0.47, range=0..1))
neg_4 = Negative(Value=Slider(0.35, range=0..1))
brep = Brep(arrpolar.Geometry)
Z_5 = UnitZ(Factor=neg_3)
Z_6 = UnitZ(Factor=neg_4)
move_6 = Move(Geometry=ln_2, Motion=Z_6)  # -> Geometry, Transform
extr_4 = Extrude(Base=[circle, circle_2], Direction=Z_5)
pipe = Pipe(Curve=move_6.Geometry, Radius=0.02, Caps=0)
brep_2 = Brep([extr_4, pipe, brep, extr, extr_2])

# ----
crv_2 = Curve(<curve referenced from the Rhino model>)
cir_5 = Circle(Plane=PlaneXY(0, 0, 0), Radius=0.8)
cir_6 = Circle(Plane=PlaneXY(0, 0, 0), Radius=0.85)
cir_7 = Circle(Plane=PlaneXY(0, 0, 0), Radius=0.6)
cir_8 = Circle(Plane=PlaneXY(0, 0, 0), Radius=0.65)
divide_3 = DivideCurve(Curve=ln, Count=2, Kinks=False)  # -> Points, Tangents, Parameters
neg_5 = Negative(Value=Slider(0.03, range=0..0.1))
neg_6 = Negative(Value=Slider(0.03, range=0..0.1))
vec2pt = Vector2Pt(PointA=pt_2, PointB=pt_3, Unitize=False)  # -> Vector, Length
vec2pt_2 = Vector2Pt(PointA=pt_4, PointB=pt_5, Unitize=False)  # -> Vector, Length
vec2pt_3 = Vector2Pt(PointA=pt_6, PointB=pt_8, Unitize=False)  # -> Vector, Length
vec2pt_4 = Vector2Pt(PointA=pt_9, PointB=pt_11, Unitize=False)  # -> Vector, Length
rotax = RotateAxis(Geometry=crv_2, Angle=Slider(0.15, range=0..1), Axis=Line((0, 0, 0), (0, 0, 1)))  # -> Geometry, Transform
Z_7 = UnitZ(Factor=neg_5)
Z_8 = UnitZ(Factor=neg_6)
item = ListItem(List=divide_3.Points, Index=1, Wrap=True)
Z_9 = UnitZ(Factor=number_slider)
Z_10 = UnitZ(Factor=number_slider)
loft_3 = Loft(Curves=[cir_5, cir_6], Options={Adjust=False, Closed=False, LoftEnds=0, LoftSimp=0, LoftType=0, Rebuild=10, Refit=0.01})
loft_4 = Loft(Curves=[cir_7, cir_8], Options={Adjust=False, Closed=False, LoftEnds=0, LoftSimp=0, LoftType=0, Rebuild=10, Refit=0.01})
bzspan = BezierSpan(StartPoint=pt_2, StartTangent=vec2pt.Vector, EndPoint=pt_4, EndTangent=vec2pt_2.Vector)  # -> Curve, Length, Domain
bzspan_2 = BezierSpan(StartPoint=pt_6, StartTangent=vec2pt_3.Vector, EndPoint=pt_9, EndTangent=vec2pt_4.Vector)  # -> Curve, Length, Domain
ln_3 = Line(StartPoint=pt_2, EndPoint=pt_3)
ln_4 = Line(StartPoint=pt_4, EndPoint=pt_5)
ln_5 = Line(StartPoint=pt_6, EndPoint=pt_8)
ln_6 = Line(StartPoint=pt_9, EndPoint=pt_11)
mirror = Mirror(
    Geometry=rotax.Geometry,
    Plane=Plane(origin=(0, 0, 0), x=(-0.9715099672, 0.000452706171, -0.2369982674), y=(0.2369986816, 0.001464842028, -0.9715088672)))  # -> Geometry, Transform
move_7 = Move(Geometry=pt, Motion=Z_9)  # -> Geometry, Transform
move_8 = Move(Geometry=item, Motion=Z_10)  # -> Geometry, Transform
extr_5 = Extrude(Base=loft_3, Direction=Z_7)
extr_6 = Extrude(Base=loft_4, Direction=Z_8)
pt_12 = Point(<point referenced from the Rhino model>)
pt_13 = Point(<point referenced from the Rhino model>)
crv_3 = Curve(rotax.Geometry)
crv_4 = Curve(mirror.Geometry)
arc = Arc3Pt(PointA=pt_12, PointB=move_7.Geometry, PointC=pt_13)  # -> Arc, Plane, Radius
arc_2 = Arc3Pt(PointA=pt_7, PointB=move_8.Geometry, PointC=pt_10)  # -> Arc, Plane, Radius
loft_5 = Loft(
    Curves=[crv_3, crv_2, crv_4],
    Options={Adjust=False, Closed=False, LoftEnds=0, LoftSimp=0, LoftType=0, Rebuild=10, Refit=0.01})
rulesrf = RuledSurface(CurveA=arc.Arc, CurveB=arc_2.Arc)
cap = CapHoles(Brep=loft_5)
project = Project(Curve=[bzspan.Curve, bzspan_2.Curve], Brep=rulesrf, Direction=Vector(0, 0, 1))  # -> flatten(Curve)
arrpolar_2 = PolarArray(Geometry=cap, Plane=PlaneXY(0, 0, 0), Count=17, Angle=6.283185307)  # -> Geometry, Transform
brep_3 = Brep(arrpolar_2.Geometry)
item_2 = ListItem(List=project, Index=0, Wrap=True)
item_3 = ListItem(List=project, Index=1, Wrap=True)
loft_6 = Loft(
    Curves=[item_2, item_3],
    Options={Adjust=False, Closed=False, LoftEnds=0, LoftSimp=0, LoftType=0, Rebuild=10, Refit=0.01})

# ---- group: RAILING
offsets = OffsetOnSrf(Curve=item_2, Distance=-0.3, Surface=loft_6)
offsets_2 = OffsetOnSrf(Curve=item_3, Distance=0.3, Surface=loft_6)
Z_11 = UnitZ(Factor=Slider(2, range=0..3))
Z_12 = UnitZ(Factor=Slider(0.8, range=0..1))
Z_13 = UnitZ(Factor=Slider(0.4, range=0..1))
move_9 = Move(Geometry=[offsets, offsets_2], Motion=Z_11)  # -> Geometry, Transform
move_10 = Move(Geometry=[offsets, offsets_2], Motion=Z_12)  # -> Geometry, Transform
move_11 = Move(Geometry=[offsets, offsets_2], Motion=Z_13)  # -> Geometry, Transform

# ---- group: SIDE CURB
number_slider_2 = Slider(0.5, range=0..1)
neg_7 = Negative(Value=number_slider_2)
offsets_3 = OffsetOnSrf(Curve=item_3, Distance=number_slider_2, Surface=loft_6)
offsets_4 = OffsetOnSrf(Curve=item_2, Distance=neg_7, Surface=loft_6)
rulesrf_2 = RuledSurface(CurveA=offsets_3, CurveB=item_3)
rulesrf_3 = RuledSurface(CurveA=offsets_4, CurveB=item_2)
tweencrv_3 = TweenCurve(CurveA=offsets_3, CurveB=offsets_4, Factor=0.5, BlendType=0)
Z_14 = UnitZ(Factor=Slider(0.2, range=0..1))
extr_7 = Extrude(Base=rulesrf_3, Direction=Z_14)
extr_8 = Extrude(Base=rulesrf_2, Direction=Z_14)

# ---- group: WINDSCREEN/BALUSTRADE
offsets_5 = OffsetOnSrf(Curve=item_2, Distance=-0.3, Surface=loft_6)
offsets_6 = OffsetOnSrf(Curve=item_3, Distance=0.3, Surface=loft_6)
offsets_7 = OffsetOnSrf(Curve=item_2, Distance=-0.425, Surface=loft_6)
offsets_8 = OffsetOnSrf(Curve=item_3, Distance=0.425, Surface=loft_6)
item_4 = ListItem(List=move_9.Geometry, Index=0, Wrap=True)
item_5 = ListItem(List=move_9.Geometry, Index=1, Wrap=True)
item_6 = ListItem(List=move_11.Geometry, Index=0, Wrap=True)
item_7 = ListItem(List=move_11.Geometry, Index=1, Wrap=True)
number_slider_3 = Slider(0.02, range=0..0.1)
divide_4 = DivideCurve(Curve=[offsets_5, offsets_6], Count=266, Kinks=False)  # -> Points, Tangents, Parameters
loft_7 = Loft(
    Curves=[item_4, item_6],
    Options={Adjust=False, Closed=False, LoftEnds=0, LoftSimp=0, LoftType=0, Rebuild=10, Refit=0.01})
loft_8 = Loft(
    Curves=[item_7, item_5],
    Options={Adjust=False, Closed=False, LoftEnds=0, LoftSimp=0, LoftType=0, Rebuild=10, Refit=0.01})
circle_3 = CircleCNR(Center=divide_4.Points, Normal=Vector(0, 0, 1), Radius=0.05)
Z_15 = UnitZ(Factor=Slider(2.1, range=0..10))
Z_16 = UnitZ(Factor=Slider(0.9, range=0..1))
Z_17 = UnitZ(Factor=Slider(0.9, range=0..1))
neg_8 = Negative(Value=number_slider_3)
crv_5 = Curve(offsets)
crv_6 = Curve(offsets_2)
extr_9 = Extrude(Base=circle_3, Direction=Z_15)
move_12 = Move(Geometry=offsets_7, Motion=Z_16)  # -> Geometry, Transform
move_13 = Move(Geometry=offsets_8, Motion=Z_16)  # -> Geometry, Transform
move_14 = Move(Geometry=crv_5, Motion=Z_17)  # -> Geometry, Transform
move_15 = Move(Geometry=crv_6, Motion=Z_17)  # -> Geometry, Transform
X = UnitX(Factor=number_slider_3)
X_2 = UnitX(Factor=neg_8)
divide_5 = DivideCurve(Curve=move_12.Geometry, Count=266, Kinks=False)  # -> Points, Tangents, Parameters
divide_6 = DivideCurve(Curve=move_13.Geometry, Count=266, Kinks=False)  # -> Points, Tangents, Parameters
divide_7 = DivideCurve(Curve=move_14.Geometry, Count=266, Kinks=False)  # -> Points, Tangents, Parameters
divide_8 = DivideCurve(Curve=move_15.Geometry, Count=266, Kinks=False)  # -> Points, Tangents, Parameters
extr_10 = Extrude(Base=loft_7, Direction=X)
extr_11 = Extrude(Base=loft_8, Direction=X_2)
cap_2 = CapHoles(Brep=extr_9)
pipe_2 = Pipe(Curve=[move_12.Geometry, move_13.Geometry], Radius=0.04, Caps=0)
ln_7 = Line(StartPoint=divide_5.Points, EndPoint=divide_7.Points)
ln_8 = Line(StartPoint=divide_6.Points, EndPoint=divide_8.Points)
pipe_3 = Pipe(Curve=[ln_7, ln_8], Radius=0.02, Caps=0)
brep_4 = Brep(pipe_2)
brep_5 = Brep(pipe_3)

# ---- group: PAVILION PANELS
number_slider_4 = Slider(101, range=0..200)
number_slider_5 = Slider(544, range=0..1000)
number_slider_6 = Slider(781, range=0..1000)
number_slider_7 = Slider(31, range=0..100)
dom = ConstructDomain(DomainStart=0, DomainEnd=number_slider_4)
dom_2 = ConstructDomain(DomainStart=Slider(103, range=0..200), DomainEnd=Slider(135, range=0..1000))
reldif = RelativeDifferences(Values=[number_slider_5, number_slider_6])
dom_3 = ConstructDomain(DomainStart=number_slider_5, DomainEnd=number_slider_6)
dom_4 = ConstructDomain(DomainStart=Slider(783, range=0..1000), DomainEnd=Slider(815, range=0..1000))
dom_5 = ConstructDomain(DomainStart=Slider(542, range=0..1000), DomainEnd=Slider(510, range=0..1000))
range = Range(Domain=dom_2, Steps=expr("x/2", Slider(32, range=0..100)))
range_2 = Range(Domain=dom, Steps=number_slider_4)
range_3 = Range(Domain=dom_4, Steps=expr("x/2", number_slider_7))
srf = Surface()
range_4 = Range(Domain=dom_5, Steps=expr("x/2", number_slider_7))
range_5 = Range(Domain=dom_3, Steps=reldif)
srf_2 = Surface()
item_8 = ListItem(List=srf, Index=range_2, Wrap=True)
item_9 = ListItem(List=srf, Index=range, Wrap=True)
item_10 = ListItem(List=srf_2, Index=range_5, Wrap=True)
item_11 = ListItem(List=srf_2, Index=range_3, Wrap=True)
item_12 = ListItem(List=srf_2, Index=range_4, Wrap=True)
srf_3 = Surface(item_8)
srf_4 = Surface(item_9)
srf_5 = Surface(item_10)
srf_6 = Surface(item_12)
srf_7 = Surface(item_11)
srf_8 = Surface([item_10, item_11, item_12])
number_slider_8 = Slider(1666, range=1000..2000)
number_slider_9 = Slider(1733, range=1001..2000)
number_slider_10 = Slider(1088, range=1000..2000)
number_slider_11 = Slider(1257, range=1001..2000)
number_slider_12 = Slider(31, range=0..100)
reldif_2 = RelativeDifferences(Values=[number_slider_8, number_slider_9])
reldif_3 = RelativeDifferences(Values=[number_slider_10, number_slider_11])
dom_6 = ConstructDomain(DomainStart=Slider(1259, range=1001..2000), DomainEnd=Slider(1291, range=1001..2000))
dom_7 = ConstructDomain(DomainStart=number_slider_8, DomainEnd=number_slider_9)
dom_8 = ConstructDomain(DomainStart=Slider(1664, range=1000..2000), DomainEnd=Slider(1632, range=1000..2000))
dom_9 = ConstructDomain(DomainStart=number_slider_10, DomainEnd=number_slider_11)
dom_10 = ConstructDomain(DomainStart=Slider(1086, range=1000..2000), DomainEnd=Slider(1054, range=1000..2000))
range_6 = Range(Domain=dom_6, Steps=expr("x/2", number_slider_12))
range_7 = Range(Domain=dom_8, Steps=expr("x/2", Slider(31, range=0..100)))
range_8 = Range(Domain=dom_10, Steps=expr("x/2", number_slider_12))
range_9 = Range(Domain=dom_7, Steps=reldif_2)
range_10 = Range(Domain=dom_9, Steps=reldif_3)
srf_9 = Surface()
srf_10 = Surface()
item_13 = ListItem(List=srf_10, Index=range_6, Wrap=True)
item_14 = ListItem(List=srf_9, Index=range_9, Wrap=True)
item_15 = ListItem(List=srf_9, Index=range_7, Wrap=True)
item_16 = ListItem(List=srf_10, Index=range_10, Wrap=True)
item_17 = ListItem(List=srf_10, Index=range_8, Wrap=True)
srf_11 = Surface(item_14)
srf_12 = Surface(item_15)
srf_13 = Surface([item_14, item_15])
srf_14 = Surface(item_16)
srf_15 = Surface(item_17)
srf_16 = Surface([item_16, item_17, item_13])
srf_17 = Surface(item_13)

# ---- group: MAIN PATH
number_slider_13 = Slider(4, range=0..10)
neg_9 = Negative(Value=number_slider_13)
offsets_9 = OffsetOnSrf(Curve=tweencrv_3, Distance=number_slider_13, Surface=loft_6)
offsets_10 = OffsetOnSrf(Curve=tweencrv_3, Distance=neg_9, Surface=loft_6)
neg_10 = Negative(Value=Slider(0.25, range=0..1))
loft_9 = Loft(
    Curves=[offsets_9, offsets_10],
    Options={Adjust=False, Closed=False, LoftEnds=0, LoftSimp=0, LoftType=0, Rebuild=10, Refit=0.01})
Z_18 = UnitZ(Factor=neg_10)
extr_12 = Extrude(Base=loft_9, Direction=Z_18)

# ---- group: MID CURB
number_slider_14 = Slider(4.2, range=0..10)
neg_11 = Negative(Value=number_slider_14)
offsets_11 = OffsetOnSrf(Curve=tweencrv_3, Distance=number_slider_14, Surface=loft_6)
offsets_12 = OffsetOnSrf(Curve=tweencrv_3, Distance=neg_11, Surface=loft_6)
loft_10 = Loft(
    Curves=[offsets_12, offsets_10],
    Options={Adjust=False, Closed=False, LoftEnds=0, LoftSimp=0, LoftType=0, Rebuild=10, Refit=0.01})
Z_19 = UnitZ(Factor=Slider(0.15, range=0..1))
loft_11 = Loft(
    Curves=[offsets_11, offsets_9],
    Options={Adjust=False, Closed=False, LoftEnds=0, LoftSimp=0, LoftType=0, Rebuild=10, Refit=0.01})
extr_13 = Extrude(Base=loft_11, Direction=Z_19)
extr_14 = Extrude(Base=loft_10, Direction=Z_19)

# ---- group: Curves in Rhino
crv_7 = Curve([<curve referenced from the Rhino model> x9])

# ----
number_slider_15 = Slider(22, range=0..100)
item_18 = ListItem(List=crv_7, Index=0, Wrap=True)
item_19 = ListItem(List=crv_7, Index=6, Wrap=True)
loft_12 = Loft(Curves=crv_7, Options={Adjust=False, Closed=False, LoftEnds=0, LoftSimp=0, LoftType=0, Rebuild=10, Refit=0.01})

# ---- group: pavilion brace alterations
number_slider_16 = Slider(22, range=0..100)
number_slider_17 = Slider(72, range=0..100)
srf_18 = Surface(<surface referenced from the Rhino model>)
mesh_uv = MeshSurface(Surface=srf_18, UCount=expr("x*1.5", number_slider_17), VCount=number_slider_17, Overhang=True, Equalize=False)
medges = MeshEdges(Mesh=mesh_uv)  # -> NakedEdges, InteriorEdges, NonManifoldEdges
project_2 = Project(Curve=medges.InteriorEdges, Brep=loft_12, Direction=Vector(0, 0, 1))
crv_8 = Curve()

# ----
brep_6 = Brep(<brep referenced from the Rhino model>)

# ---- group: PLANTING
rulesrf_4 = RuledSurface(CurveA=offsets_4, CurveB=offsets_11)
rulesrf_5 = RuledSurface(CurveA=offsets_3, CurveB=offsets_12)
Z_20 = UnitZ(Factor=Slider(0.12, range=0..1))
extr_15 = Extrude(Base=rulesrf_4, Direction=Z_20)
extr_16 = Extrude(Base=rulesrf_5, Direction=Z_20)

# ----
edges = BrepEdges(Brep=loft_12)  # -> Naked, Interior, NonManifold

# ---- group: Suspension Frame Pipe
pipe_4 = Pipe(Curve=item_18, Radius=1, Caps=0)
pipe_5 = Pipe(Curve=item_19, Radius=1, Caps=0)

# ----
brep_7 = Brep(<brep referenced from the Rhino model>)
brep_8 = Brep(<brep referenced from the Rhino model>)
item_20 = ListItem(List=edges.Naked, Index=2, Wrap=True)
item_21 = ListItem(List=edges.Naked, Index=0, Wrap=True)
crv_9 = Curve()
pipe_6 = Pipe(Curve=item_21, Radius=1, Caps=0)
pipe_7 = Pipe(Curve=item_20, Radius=1, Caps=0)
pipe_8 = Pipe(Curve=crv_9, Radius=0.15, Caps=0)
divide_9 = DivideCurve(Curve=item_21, Count=4, Kinks=True)  # -> Points, Tangents, Parameters
divide_10 = DivideCurve(Curve=item_20, Count=4, Kinks=True)  # -> Points, Tangents, Parameters
crv_cp = CurveClosestPoint(Point=divide_9.Points, Curve=item_21)  # -> Point, Parameter, Distance
crv_cp_2 = CurveClosestPoint(Point=divide_10.Points, Curve=item_20)  # -> Point, Parameter, Distance
shatter = Shatter(Curve=item_21, Parameters=crv_cp.Parameter)
shatter_2 = Shatter(Curve=item_20, Parameters=crv_cp_2.Parameter)
crv_10 = Curve(item_21)
crv_11 = Curve([item_21, item_20])
divide_11 = DivideCurve(Curve=crv_10, Count=100, Kinks=False)  # -> Points, Tangents, Parameters
divide_12 = DivideCurve(Curve=crv_11, Count=100, Kinks=False)  # -> Points, Tangents, Parameters
knob = ControlKnob(Decimals=2, Limit=True, Maximum=10, Minimum=0, Range=1, Value=0)
item_22 = ListItem(List=shatter, Index=0, Wrap=True)
item_23 = ListItem(List=shatter, Index=1, Wrap=True)
item_24 = ListItem(List=shatter, Index=2, Wrap=True)
item_25 = ListItem(List=shatter, Index=3, Wrap=True)
item_26 = ListItem(List=shatter_2, Index=0, Wrap=True)
item_27 = ListItem(List=shatter_2, Index=1, Wrap=True)
item_28 = ListItem(List=shatter_2, Index=2, Wrap=True)
item_29 = ListItem(List=shatter_2, Index=3, Wrap=True)
pline = PolyLine(Vertices=divide_11.Points, Closed=False)
pline_2 = PolyLine(Vertices=divide_12.Points, Closed=False)
neg_12 = Negative(Value=knob)
disc = Discontinuity(Curve=pline, Level=2)  # -> Points, Parameters
disc_2 = Discontinuity(Curve=pline_2, Level=2)  # -> Points, Parameters
shatter_3 = Shatter(Curve=pline, Parameters=disc.Parameters)
shatter_4 = Shatter(Curve=pline_2, Parameters=disc_2.Parameters)
line = Line(shatter_4)
line_2 = Line(shatter_3)

# ---- group: KARAMBA: SUSPENSION FRAME
crv_12 = Curve(flatten([line_2, line]))  # disabled

# ----
cross_sections = CrossSectionsKaramba(
    ElementsIdentifiers="deck lines",
    Height_cm=Slider(30, range=0..100),
    UpperFlangeWidth_cm=Slider(30, range=0..100),
    LowerFlangeWidth_cm=Slider(30, range=0..100),
    mode="Trapezoid")

cross_sections_2 = CrossSectionsKaramba(
    ElementsIdentifiers="cables",
    Diameter_cm=Slider(10, range=0..100),
    WallThickness_cm=Slider(5, range=0..100),
    mode="Circular Hollow")

cross_sections_3 = CrossSectionsKaramba(
    ElementsIdentifiers="suspension frame",
    Diameter_cm=Slider(200, range=0..1000),
    WallThickness_cm=Slider(100, range=0..1000),
    mode="Circular Hollow")

cross_sections_4 = CrossSectionsKaramba(
    ElementsIdentifiers="grid lines",
    Diameter_cm=Slider(30, range=0..100),
    WallThickness_cm=Slider(15, range=0..100),
    mode="Circular Hollow")

divide_13 = DivideCurve(Curve=item_22, Count=25, Kinks=False)  # -> Points, Tangents, Parameters
divide_14 = DivideCurve(Curve=item_29, Count=25, Kinks=False)  # -> Points, Tangents, Parameters
divide_15 = DivideCurve(Curve=item_23, Count=25, Kinks=False)  # -> Points, Tangents, Parameters
divide_16 = DivideCurve(Curve=item_28, Count=25, Kinks=False)  # -> Points, Tangents, Parameters
divide_17 = DivideCurve(Curve=item_24, Count=25, Kinks=False)  # -> Points, Tangents, Parameters
divide_18 = DivideCurve(Curve=item_27, Count=25, Kinks=False)  # -> Points, Tangents, Parameters
divide_19 = DivideCurve(Curve=item_25, Count=25, Kinks=False)  # -> Points, Tangents, Parameters
divide_20 = DivideCurve(Curve=item_26, Count=25, Kinks=False)  # -> Points, Tangents, Parameters
linetobeam = LineToBeamKaramba(Line=crv_12, New=True, Remove=True, LimitDistance_m=0.005, BeamIdentifier="suspension frame")  # -> Points, Element, Info; disabled
loads = LoadsKaramba(Vector=Vector(0, 0, -1), LCase=0, mode="Gravity")
cull_i = CullIndex(List=divide_14.Points, Indices=0, Wrap=True)
cull_i_2 = CullIndex(List=divide_15.Points, Indices=0, Wrap=True)
cull_i_3 = CullIndex(List=divide_16.Points, Indices=0, Wrap=True)
cull_i_4 = CullIndex(List=divide_17.Points, Indices=0, Wrap=True)
cull_i_5 = CullIndex(List=divide_18.Points, Indices=0, Wrap=True)
cull_i_6 = CullIndex(List=divide_19.Points, Indices=0, Wrap=True)
cull_i_7 = CullIndex(List=divide_15.Points, Indices=0, Wrap=True)
cull_i_8 = CullIndex(List=divide_16.Points, Indices=25, Wrap=True)
cull_i_9 = CullIndex(List=divide_17.Points, Indices=[0, 25], Wrap=True)
cull_i_10 = CullIndex(List=divide_18.Points, Indices=[0, 25], Wrap=True)
matselect = MaterialSelectionKaramba(menu=[dropdown(1), dropdown(1)])
pt_14 = Point(divide_13.Points)
pt_15 = Point(divide_14.Points)
pt_16 = Point(cull_i_7)
pt_17 = Point(cull_i_8)
pt_18 = Point(cull_i_9)
pt_19 = Point(cull_i_10)
pt_20 = Point(divide_20.Points)
pt_21 = Point(divide_19.Points)
rev = ReverseList(List=pt_14)
rev_2 = ReverseList(List=pt_16)
rev_3 = ReverseList(List=pt_18)
rev_4 = ReverseList(List=pt_20)
l0 = Start(5)
ln_9 = Line(StartPoint=rev, EndPoint=pt_15)  # -> flatten(Line)
ln_10 = Line(StartPoint=rev_2, EndPoint=pt_17)  # -> flatten(Line)
ln_11 = Line(StartPoint=rev_3, EndPoint=pt_19)  # -> flatten(Line)
# 2: The last line wasn't intersecting completely with this. I've extended the surface so it projects properly.
ln_12 = Line(StartPoint=rev_4, EndPoint=pt_21)  # -> flatten(Line)
flip = FlipCurve(Curve=ln_12)  # -> Curve, Flag
merge = Merge(Data1=reverse(ln_9), Data2=reverse(ln_10), Data3=reverse(ln_11), Data4=flip.Curve)
eval = EvaluateLength(Curve=merge, Length=0.5, Normalized=True)  # -> Point, Tangent, Parameter
points = PointList(Points=eval.Point)
toggle = BooleanToggle(False)
dcon = DeleteConsecutive(Wrap=False)  # -> Set, Count

# ---- group: DECK
tweencrv_4 = TweenCurve(CurveA=item_2, CurveB=tweencrv_3, Factor=0.5, BlendType=0)
tweencrv_5 = TweenCurve(CurveA=item_3, CurveB=tweencrv_3, Factor=0.5, BlendType=0)
neg_13 = Negative(Value=Slider(1.8, range=0..10))
Z_21 = UnitZ(Factor=neg_13)
move_16 = Move(Geometry=tweencrv_4, Motion=Z_21)  # -> Geometry, Transform
move_17 = Move(Geometry=tweencrv_5, Motion=Z_21)  # -> Geometry, Transform
crv_13 = Curve(item_2)
crv_14 = Curve(item_3)
rulesrf_6 = RuledSurface(CurveA=crv_14, CurveB=move_17.Geometry)
rulesrf_7 = RuledSurface(CurveA=crv_13, CurveB=move_16.Geometry)
srf_19 = Surface(loft_6)
divide_21 = DivideCurve(Curve=crv_13, Count=1, Kinks=False)  # -> Points, Tangents, Parameters
divide_22 = DivideCurve(Curve=move_16.Geometry, Count=1, Kinks=False)  # -> Points, Tangents, Parameters
divide_23 = DivideCurve(Curve=crv_14, Count=1, Kinks=False)  # -> Points, Tangents, Parameters
divide_24 = DivideCurve(Curve=move_17.Geometry, Count=1, Kinks=False)  # -> Points, Tangents, Parameters
divide_25 = DivideCurve(Curve=crv_13, Count=1, Kinks=False)  # -> Points, Tangents, Parameters
divide_26 = DivideCurve(Curve=move_16.Geometry, Count=1, Kinks=False)  # -> Points, Tangents, Parameters
divide_27 = DivideCurve(Curve=crv_14, Count=1, Kinks=False)  # -> Points, Tangents, Parameters
divide_28 = DivideCurve(Curve=move_17.Geometry, Count=1, Kinks=False)  # -> Points, Tangents, Parameters
item_30 = ListItem(List=divide_25.Points, Index=0, Wrap=True)
item_31 = ListItem(List=divide_26.Points, Index=0, Wrap=True)
item_32 = ListItem(List=divide_27.Points, Index=0, Wrap=True)
item_33 = ListItem(List=divide_28.Points, Index=0, Wrap=True)
srf4pt = _4PointSurface(CornerA=divide_21.Points, CornerB=divide_22.Points, CornerC=divide_24.Points, CornerD=divide_23.Points)
srf4pt_2 = _4PointSurface(CornerA=item_30, CornerB=item_31, CornerC=item_33, CornerD=item_32)

# ----
rulesrf_8 = RuledSurface(CurveA=move_16.Geometry, CurveB=move_17.Geometry)

# ---- group: DECK (continued)
join = BrepJoin(Breps=[rulesrf_7, rulesrf_6, srf_19, rulesrf_8])  # -> Breps, Closed
sunion = SolidUnion(Breps=[join.Breps, srf4pt, srf4pt_2])

# ----
brep_9 = Brep(flatten(sunion))
split = SplitBrep(Brep=brep_9, Cutter=brep_6)
item_34 = ListItem(List=split, Index=0, Wrap=True)
item_35 = ListItem(List=split, Index=1, Wrap=True)
split_2 = SplitBrep(Brep=item_34, Cutter=brep_7)
split_3 = SplitBrep(Brep=item_35, Cutter=brep_8)
item_36 = ListItem(List=split_2, Index=0, Wrap=True)
item_37 = ListItem(List=split_2, Index=1, Wrap=True)
item_38 = ListItem(List=split_3, Index=0, Wrap=True)
item_39 = ListItem(List=split_3, Index=1, Wrap=True)
edges_2 = BrepEdges(Brep=item_37)  # -> flatten(Naked), Interior, NonManifold
edges_3 = BrepEdges(Brep=item_38)  # -> flatten(Naked), Interior, NonManifold
item_40 = ListItem(List=edges_2.Naked, Index=Slider(2, range=0..10), Wrap=True)
item_41 = ListItem(List=edges_3.Naked, Index=Slider(2, range=0..10), Wrap=True)
divide_29 = DivideCurve(Curve=item_40, Count=2, Kinks=False)  # -> Points, Tangents, Parameters
divide_30 = DivideCurve(Curve=item_41, Count=2, Kinks=False)  # -> Points, Tangents, Parameters
item_42 = ListItem(List=divide_29.Points, Index=0, Wrap=True)
item_43 = ListItem(List=divide_29.Points, Index=2, Wrap=True)
item_44 = ListItem(List=divide_29.Points, Index=1, Wrap=True)
item_45 = ListItem(List=divide_30.Points, Index=1, Wrap=True)
item_46 = ListItem(List=divide_30.Points, Index=0, Wrap=True)
item_47 = ListItem(List=divide_30.Points, Index=2, Wrap=True)
vec2pt_5 = Vector2Pt(PointA=item_42, PointB=item_43, Unitize=False)  # -> Vector, Length
vec2pt_6 = Vector2Pt(PointA=item_46, PointB=item_47, Unitize=False)  # -> Vector, Length
rot3d = Rotate3D(Geometry=item_37, Angle=knob, Center=item_44, Axis=vec2pt_5.Vector)  # -> Geometry, Transform
rot3d_2 = Rotate3D(Geometry=item_38, Angle=neg_12, Center=item_45, Axis=vec2pt_6.Vector)  # -> Geometry, Transform
debrep = DeconstructBrep(Brep=item_36)  # -> flatten(Faces), flatten(Edges), Vertices
debrep_2 = DeconstructBrep(Brep=rot3d.Geometry)  # -> flatten(Faces), flatten(Edges), Vertices
debrep_3 = DeconstructBrep(Brep=rot3d_2.Geometry)  # -> flatten(Faces), flatten(Edges), Vertices
debrep_4 = DeconstructBrep(Brep=item_39)  # -> flatten(Faces), flatten(Edges), Vertices
item_48 = ListItem(List=debrep.Edges, Index=1, Wrap=True)
item_49 = ListItem(List=debrep.Faces, Index=0, Wrap=True)
item_50 = ListItem(List=debrep.Edges, Index=3, Wrap=True)
item_51 = ListItem(List=debrep_2.Faces, Index=0, Wrap=True)
item_52 = ListItem(List=debrep_2.Edges, Index=3, Wrap=True)
item_53 = ListItem(List=debrep_2.Edges, Index=1, Wrap=True)
item_54 = ListItem(List=debrep_3.Edges, Index=1, Wrap=True)
item_55 = ListItem(List=debrep_3.Faces, Index=0, Wrap=True)
item_56 = ListItem(List=debrep_3.Edges, Index=3, Wrap=True)
item_57 = ListItem(List=debrep_4.Edges, Index=3, Wrap=True)
item_58 = ListItem(List=debrep_4.Faces, Index=0, Wrap=True)
item_59 = ListItem(List=debrep_4.Edges, Index=1, Wrap=True)
offsets_13 = OffsetOnSrf(Curve=item_48, Distance=0.17, Surface=item_49)
offsets_14 = OffsetOnSrf(Curve=item_50, Distance=0.17, Surface=item_49)
offsets_15 = OffsetOnSrf(Curve=item_52, Distance=0.17, Surface=item_51)
offsets_16 = OffsetOnSrf(Curve=item_53, Distance=0.17, Surface=item_51)
offsets_17 = OffsetOnSrf(Curve=item_54, Distance=0.17, Surface=item_55)
offsets_18 = OffsetOnSrf(Curve=item_56, Distance=0.17, Surface=item_55)
offsets_19 = OffsetOnSrf(Curve=item_57, Distance=0.17, Surface=item_58)
offsets_20 = OffsetOnSrf(Curve=item_59, Distance=0.17, Surface=item_58)
divide_31 = DivideCurve(Curve=offsets_13, Count=25, Kinks=False)  # -> Points, Tangents, Parameters
pline_3 = PolyLine(Vertices=divide_31.Points, Closed=False)
disc_3 = Discontinuity(Curve=pline_3, Level=2)  # -> Points, Parameters
pt_22 = Point(divide_31.Points)
shatter_5 = Shatter(Curve=pline_3, Parameters=disc_3.Parameters)
rev_5 = ReverseList(List=pt_22)
line_3 = Line(shatter_5)
divide_32 = DivideCurve(Curve=offsets_14, Count=25, Kinks=False)  # -> Points, Tangents, Parameters
pt_23 = Point(divide_32.Points)
cluster = Cluster_2(V=divide_32.Points)
ln_13 = Line(StartPoint=rev_5, EndPoint=pt_23)
divide_33 = DivideCurve(Curve=offsets_15, Count=25, Kinks=False)  # -> Points, Tangents, Parameters
cluster_2 = Cluster_2(V=divide_33.Points)
divide_34 = DivideCurve(Curve=offsets_16, Count=25, Kinks=False)  # -> Points, Tangents, Parameters
pt_24 = Point(divide_34.Points)
cull_i_11 = CullIndex(List=pt_24, Indices=25, Wrap=True)
pt_25 = Point(cull_i_11)
cluster_3 = Cluster_2(V=divide_34.Points)
eval_2 = EvaluateLength(Curve=cluster_3, Length=Slider(1, range=0..1), Normalized=True)  # -> Point, Tangent, Parameter
divide_35 = DivideCurve(Curve=offsets_17, Count=25, Kinks=False)  # -> Points, Tangents, Parameters
cluster_4 = Cluster_2(V=divide_35.Points)
divide_36 = DivideCurve(Curve=offsets_18, Count=25, Kinks=False)  # -> Points, Tangents, Parameters
pt_26 = Point(divide_36.Points)
cull_i_12 = CullIndex(List=pt_26, Indices=25, Wrap=True)
pt_27 = Point(cull_i_12)
cluster_5 = Cluster_2(V=divide_36.Points)

# ---- group: Moving Deck
Z_22 = UnitZ(Factor=Slider(100, range=0..100000))
neg_14 = Negative(Value=Z_22)
pt_28 = Point([divide_33.Points, divide_34.Points, divide_35.Points, divide_36.Points])
loads_2 = LoadsKaramba(ForceVector=neg_14, Local=True, PosInd=pt_28, LCase=0, mode="Point")

pt_29 = Point([divide_33.Points, divide_34.Points, divide_35.Points, divide_36.Points])
supp = SupportKaramba(PosInd=pt_29, menu=[buttons(on, on, on, off, off, off)])

# ----
divide_37 = DivideCurve(Curve=offsets_19, Count=25, Kinks=False)  # -> Points, Tangents, Parameters
cluster_6 = Cluster_2(V=divide_37.Points)
divide_38 = DivideCurve(Curve=offsets_20, Count=25, Kinks=False)  # -> Points, Tangents, Parameters
cluster_7 = Cluster_2(V=divide_38.Points)

# ---- group: Static Deck
Z_23 = UnitZ(Factor=Slider(100, range=0..100000))
pt_30 = Point([divide_31.Points, divide_32.Points, divide_37.Points, divide_38.Points])
neg_15 = Negative(Value=Z_23)
loads_3 = LoadsKaramba(ForceVector=neg_15, Local=True, PosInd=pt_30, LCase=0, mode="Point")

pt_31 = Point([divide_31.Points, divide_32.Points, divide_37.Points, divide_38.Points])
supp_2 = SupportKaramba(PosInd=pt_31, menu=[buttons(on, on, on, off, off, off)])

# ----
divide_39 = DivideCurve(Curve=offsets_19, Count=1, Kinks=False)  # -> Points, Tangents, Parameters
divide_40 = DivideCurve(Curve=offsets_20, Count=1, Kinks=False)  # -> Points, Tangents, Parameters
divide_41 = DivideCurve(Curve=offsets_13, Count=1, Kinks=False)  # -> Points, Tangents, Parameters
divide_42 = DivideCurve(Curve=offsets_14, Count=1, Kinks=False)  # -> Points, Tangents, Parameters
item_60 = ListItem(List=divide_39.Points, Index=1, Wrap=True)
item_61 = ListItem(List=divide_40.Points, Index=0, Wrap=True)
cull_i_13 = CullIndex(List=divide_34.Points, Indices=0, Wrap=True)
cull_i_14 = CullIndex(List=divide_32.Points, Indices=0, Wrap=True)
cull_i_15 = CullIndex(List=divide_33.Points, Indices=0, Wrap=True)
pt_32 = Point(cull_i_15)
rev_6 = ReverseList(List=pt_32)
ln_14 = Line(StartPoint=rev_6, EndPoint=pt_25)
cull_i_16 = CullIndex(List=divide_35.Points, Indices=0, Wrap=True)
pt_33 = Point(cull_i_16)
rev_7 = ReverseList(List=pt_33)
ln_15 = Line(StartPoint=rev_7, EndPoint=pt_27)
cull_i_17 = CullIndex(List=divide_36.Points, Indices=0, Wrap=True)
cull_i_18 = CullIndex(List=divide_37.Points, Indices=0, Wrap=True)
pt_34 = Point(cull_i_18)
rev_8 = ReverseList(List=pt_34)
cull_i_19 = CullIndex(List=divide_38.Points, Indices=25, Wrap=True)
pt_35 = Point(cull_i_19)
ln_16 = Line(StartPoint=rev_8, EndPoint=pt_35)
item_62 = ListItem(List=divide_41.Points, Index=0, Wrap=True)
item_63 = ListItem(List=divide_42.Points, Index=1, Wrap=True)

# ---- group: Ground Supports
pt_36 = Point(flatten([item_62, item_63, item_60, item_61]))
supp_3 = SupportKaramba(PosInd=pt_36, menu=[buttons(off, off, off, on, on, on)])

# ----
ln_17 = Line(StartPoint=item_60, EndPoint=item_61)
line_4 = Line(ln_17)
ln_18 = Line(StartPoint=item_62, EndPoint=item_63)
line_5 = Line(ln_18)

# ---- group: KARAMBA: DECK LINES
crv_15 = Curve(flatten([line_3, cluster, cluster_2, cluster_3, cluster_4, cluster_5, cluster_6, cluster_7, line_5, line_4, ln_16, ln_15, ln_14, ln_13]))

# ----
eval_3 = EvaluateLength(Curve=graft(crv_15), Length=[0, 1], Normalized=True)  # -> flatten(Point), Tangent, Parameter
cullpt = CullDuplicates(Points=eval_3.Point, Tolerance=0, CullMode=3)  # -> Points, Indices, Valence
linetobeam_2 = LineToBeamKaramba(Line=crv_15, New=True, Remove=True, LimitDistance_m=0.005, BeamIdentifier="deck lines")  # -> Points, Element, Info
ln_19 = Line(StartPoint=divide_31.Points, EndPoint=divide_13.Points)
ln_20 = Line(StartPoint=cull_i_14, EndPoint=cull_i)
ln_21 = Line(StartPoint=cull_i_15, EndPoint=cull_i_2)
ln_22 = Line(StartPoint=cull_i_13, EndPoint=cull_i_3)
ln_23 = Line(StartPoint=cull_i_16, EndPoint=cull_i_4)
ln_24 = Line(StartPoint=cull_i_17, EndPoint=cull_i_5)
ln_25 = Line(StartPoint=cull_i_18, EndPoint=cull_i_6)
ln_26 = Line(StartPoint=divide_38.Points, EndPoint=divide_20.Points)

# ---- group: KARAMBA: SUSPENSION CABLE LINES
crv_16 = Curve(flatten([ln_19, ln_20, ln_21, ln_22, ln_23, ln_24, ln_25, ln_26]))

# ----
end = EndPoints(Curve=crv_16)  # -> Start, End
cp = ClosestPoint(Point=end.Start, Cloud=cullpt.Points)  # -> ClosestPoint, CPIndex, Distance
pipe_9 = Pipe(Curve=[ln_19, ln_20, ln_21, ln_22, ln_23, ln_24, ln_25, ln_26], Radius=0.05, Caps=0)
pipe_10 = Pipe(Curve=ln_19, Radius=0.05, Caps=0)
cluster_8 = Cluster(A=cull_i_14, B=cull_i, C=ln_20, C_2=ln_20, A_2=cull_i_14, B_2=cull_i, C_3=ln_20, A_3=cull_i_14, B_3=cull_i, C_4=ln_20)
eval_4 = EvaluateLength(Curve=ln_19, Length=Slider(0.25, range=0..100), Normalized=False)  # -> Point, Tangent, Parameter
eval_5 = EvaluateLength(Curve=ln_19, Length=Slider(0.2, range=0..100), Normalized=False)  # -> Point, Tangent, Parameter
eval_6 = EvaluateLength(Curve=ln_19, Length=Slider(0.25, range=0..100), Normalized=False)  # -> Point, Tangent, Parameter
eval_7 = EvaluateLength(Curve=ln_19, Length=Slider(0.4, range=0..100), Normalized=False)  # -> Point, Tangent, Parameter
vec2pt_7 = Vector2Pt(PointA=divide_31.Points, PointB=divide_13.Points, Unitize=False)  # -> Vector, Length
vec2pt_8 = Vector2Pt(PointA=divide_31.Points, PointB=divide_13.Points, Unitize=False)  # -> Vector, Length
vec2pt_9 = Vector2Pt(PointA=divide_31.Points, PointB=divide_13.Points, Unitize=False)  # -> Vector, Length
cluster_9 = Cluster(
    A=cull_i_13,
    B=cull_i_3,
    C=ln_22,
    C_2=ln_22,
    A_2=cull_i_13,
    B_2=cull_i_3,
    C_3=ln_22,
    A_3=cull_i_13,
    B_3=cull_i_3,
    C_4=ln_22)
cluster_10 = Cluster(
    A=cull_i_17,
    B=cull_i_5,
    C=ln_24,
    C_2=ln_24,
    A_2=cull_i_17,
    B_2=cull_i_5,
    C_3=ln_24,
    A_3=cull_i_17,
    B_3=cull_i_5,
    C_4=ln_24)
cluster_11 = Cluster(
    A=divide_38.Points,
    B=divide_20.Points,
    C=ln_26,
    C_2=ln_26,
    A_2=divide_38.Points,
    B_2=divide_20.Points,
    C_3=ln_26,
    A_3=divide_38.Points,
    B_3=divide_20.Points,
    C_4=ln_26)
circle_4 = CircleCNR(Center=eval_4.Point, Normal=vec2pt_7.Vector, Radius=0.12)  # -> graft(Circle)
circle_5 = CircleCNR(Center=eval_5.Point, Normal=Vector(0, 0, 1), Radius=0.12)  # -> graft(Circle)
amp = Amplitude(Vector=vec2pt_8.Vector, Amplitude=Slider(0.15, range=0..1))
circle_6 = CircleCNR(Center=eval_6.Point, Normal=vec2pt_8.Vector, Radius=0.07)
amp_2 = Amplitude(Vector=vec2pt_9.Vector, Amplitude=Slider(0.05, range=0..0.1))
circle_7 = CircleCNR(Center=eval_7.Point, Normal=vec2pt_9.Vector, Radius=0.12)
cluster_12 = Cluster(
    A=cull_i_16,
    B=cull_i_4,
    C=ln_23,
    C_2=ln_23,
    A_2=cull_i_16,
    B_2=cull_i_4,
    C_3=ln_23,
    A_3=cull_i_16,
    B_3=cull_i_4,
    C_4=ln_23)
cluster_13 = Cluster(
    A=cull_i_15,
    B=cull_i_2,
    C=ln_21,
    C_2=ln_21,
    A_2=cull_i_15,
    B_2=cull_i_2,
    C_3=ln_21,
    A_3=cull_i_15,
    B_3=cull_i_2,
    C_4=ln_21)
cluster_14 = Cluster(
    A=cull_i_18,
    B=cull_i_6,
    C=ln_25,
    C_2=ln_25,
    A_2=cull_i_18,
    B_2=cull_i_6,
    C_3=ln_25,
    A_3=cull_i_18,
    B_3=cull_i_6,
    C_4=ln_25)
extr_17 = Extrude(Base=circle_6, Direction=amp)
extr_18 = Extrude(Base=circle_7, Direction=amp_2)
loft_13 = Loft(
    Curves=[circle_5, circle_4],
    Options={Adjust=True, Closed=False, LoftEnds=0, LoftSimp=0, LoftType=3, Rebuild=10, Refit=0.01})
boundary_2 = BoundarySurfaces(Edges=circle_4)
brep_10 = Brep(cluster_8)
brep_11 = Brep(cluster_13)
brep_12 = Brep(cluster_9)
brep_13 = Brep(cluster_12)
brep_14 = Brep(cluster_10)
brep_15 = Brep(cluster_14)
brep_16 = Brep(cluster_11)
sph = Sphere(Base=eval_5.Point, Radius=0.12)
capex = CapHolesEx(Brep=extr_18)  # -> Brep, Caps, Solid
split_4 = SplitBrep(Brep=sph, Cutter=flatten(boundary_2))
brep_17 = Brep([extr_17, capex.Brep, loft_13, boundary_2])
item_64 = ListItem(List=split_4, Index=1, Wrap=True)
cap_3 = CapHoles(Brep=item_64)

# ---- group: Suspension Frame
pt_37 = Point([divide_13.Points, divide_14.Points, divide_15.Points, divide_16.Points, divide_17.Points, divide_18.Points, divide_19.Points, divide_20.Points])

# ---- group: 2
srf_20 = Surface(loft_12)

# ----
sdivide = DivideSurface(Surface=srf_20, UCount=80, VCount=10)  # -> Points, Normals, Parameters
flip_2 = FlipMatrix(Data=sdivide.Points)
intcrv = Interpolate(Vertices=flip_2, Degree=3, Periodic=False, KnotStyle=1)  # -> Curve, Length, Domain
ext = ExtendCurve(Curve=intcrv.Curve, Type=0, Start=l0, End=l0)
loft_14 = Loft(Curves=flatten(ext), Options={Adjust=False, Closed=False, LoftEnds=0, LoftSimp=1, LoftType=0, Rebuild=100, Refit=0.01})

end_2 = EndPoints(Curve=merge)  # -> Start, End
Z_24 = UnitZ(Factor=1)
vec2pt_10 = Vector2Pt(PointA=end_2.Start, PointB=end_2.End, Unitize=False)  # -> Vector, Length
pl = ConstructPlane(Origin=end_2.Start, XAxis=vec2pt_10.Vector, YAxis=Z_24)
sec = BrepPlane(Brep=loft_14, Plane=pl)  # -> flatten(Curves), Points

# ---- group: 2 (continued)
project_3 = Project(Curve=merge, Brep=loft_14, Direction=Vector(0, 0, 1))  # -> flatten(Curve)

# ----
shift = ShiftList(List=sec.Curves, Shift="-1", Wrap=toggle)
shift_2 = ShiftList(List=sec.Curves, Shift="1", Wrap=toggle)
crv_17 = Curve(shift_2)
crv_18 = Curve(shift)
divide_43 = DivideCurve(Curve=crv_18, Count=20, Kinks=False)  # -> Points, Tangents, Parameters
divide_44 = DivideCurve(Curve=crv_17, Count=20, Kinks=False)  # -> Points, Tangents, Parameters
dispatch = Dispatch(List=divide_43.Points, DispatchPattern=[True, False])  # -> ListA, ListB
dispatch_2 = Dispatch(List=divide_44.Points, DispatchPattern=[True, False])  # -> ListA, ListB
pline_4 = PolyLine(Vertices=dispatch.ListA, Closed=False)  # -> flatten(Polyline)
pline_5 = PolyLine(Vertices=dispatch_2.ListA, Closed=False)
weave = Weave(Pattern=[0, 1], Stream0=dispatch.ListA, Stream1=dispatch_2.ListA, NullGaps=False)
pline_6 = PolyLine(Vertices=weave, Closed=False)
panel = Panel(pline_6)
item_65 = ListItem(List=pline_4, Index=0, Wrap=True)
disc_4 = Discontinuity(Curve=pline_5, Level=2)  # -> Points, Parameters
disc_5 = Discontinuity(Curve=pline_6, Level=2)  # -> Points, Parameters
disc_6 = Discontinuity(Curve=item_65, Level=2)  # -> Points, Parameters
item_66 = ListItem(List=flatten(pline_6), Index=Slider(5, range=0..10), Wrap=True)
shatter_6 = Shatter(Curve=pline_5, Parameters=disc_4.Parameters)
cull_i_20 = CullIndex(List=disc_5.Points, Indices=[0, 1, 20, 21], Wrap=True)
pt_38 = Point(flatten(cull_i_20))

# ---- group: Pavilion Braced Grid
pt_39 = Point(flatten(disc_5.Points))
supp_4 = SupportKaramba(PosInd=pt_38, menu=[buttons(on, on, on, off, off, off)])

# ----
shatter_7 = Shatter(Curve=item_65, Parameters=disc_6.Parameters)
shatter_8 = Shatter(Curve=pline_6, Parameters=disc_5.Parameters)
crv_19 = Curve(shatter_7)
crv_20 = Curve(flatten([shatter_6, shatter_8, crv_19]))
eval_8 = EvaluateLength(Curve=graft(crv_20), Length=[0, 1], Normalized=True)  # -> flatten(Point), Tangent, Parameter
cullpt_2 = CullDuplicates(Points=eval_8.Point, Tolerance=0, CullMode=3)  # -> Points, Indices, Valence
cp_2 = ClosestPoint(Point=pt_37, Cloud=cullpt_2.Points)  # -> ClosestPoint, CPIndex, Distance
cp_3 = ClosestPoint(Point=end.End, Cloud=cullpt_2.Points)  # -> ClosestPoint, CPIndex, Distance

# ---- group: KARAMBA: PAVILION BRACED GRID LINES
crv_21 = Curve(flatten(crv_20))

# ----
ln_27 = Line(StartPoint=cp.ClosestPoint, EndPoint=cp_3.ClosestPoint)
linetobeam_3 = LineToBeamKaramba(Line=crv_21, New=True, Remove=True, LimitDistance_m=0.005, BeamIdentifier="grid lines")  # -> Points, Element, Info
linetobeam_4 = LineToBeamKaramba(Line=ln_27, New=True, Remove=True, LimitDistance_m=0.005, BeamIdentifier="cables")  # -> Points, Element, Info

# ---- group: Suspension Frame (continued)
supp_5 = SupportKaramba(PosInd=cp_2.ClosestPoint, menu=[buttons(on, on, off, off, off, off)])

# ----
modifyelem = ModifyElementKaramba(Beam=linetobeam_4.Element, Height_cm=graft("15"), Thickness_cm=graft("6"), Bending="0", mode="Beam")
assemble = AssembleModelKaramba(
    Elem=flatten([linetobeam_3.Element, modifyelem, linetobeam_2.Element, linetobeam.Element]),
    Support=flatten([supp_5, supp_2, supp_4, supp, supp_3]),
    Load=flatten([loads_3, loads_2, loads]),
    CrossSection=flatten([cross_sections_4, cross_sections, cross_sections_2]),
    Material=flatten(matselect),
    LimitDistance_m=0.005)  # -> Model, Info, Mass_kg, CenterOfGravity
analyzethi = AnalyzeThIKaramba(Model=assemble.Model)  # -> CalculatedModel, MaximumDisplacement_m, ResultingForceOfGravity_kN, ElasticEnergy_kNm
conparts = ConnectedPartsKaramba(Model=assemble.Model)
crv_22 = Curve([crv_15, crv_12, crv_16, crv_21])
modelview = ModelViewKaramba(Model=analyzethi.CalculatedModel, LoadCaseFactorsForLinearSuperposition=1, IndexIncrementOfVisibleLoadcase=0)  # -> Model, DeformedMesh, DeformedAxes, DeformedModel

# ---- group: Displacement %
len = Length(Curve=crv_22)
avr = Average(Input=len)
num = Number(analyzethi.MaximumDisplacement_m)
expression = Expression(x=avr, y=num, Expression="y/x*100")
displacement = Panel(expression)

# ----
emodes = EigenModesKaramba(Model=analyzethi.CalculatedModel, FromIndex=1, NumberOfModes=1)  # -> ModelWithEigenModesAsLoadCaseResults, Eigenvalues
panel_2 = Panel(conparts)
line_6 = Line(conparts)
panel_3 = Panel(analyzethi.MaximumDisplacement_m)
beamview = BeamViewKaramba(Model=modelview.Model)  # -> Model, MeshesOfRenderedBeams, DeformedBeamAxes, LegendColors, LegendTags
panel_4 = Panel(emodes.ModelWithEigenModesAsLoadCaseResults)
legend = Legend(Colour=beamview.LegendColors, Tags=beamview.LegendTags, LegendType=1)
mesh = Mesh(beamview.MeshesOfRenderedBeams)

# ==== cluster Cluster
C = ClusterInput()
C_2 = ClusterInput()
C_3 = ClusterInput()
C_4 = ClusterInput()
A = ClusterInput()
B = ClusterInput()
A_2 = ClusterInput()
B_2 = ClusterInput()
A_3 = ClusterInput()
B_3 = ClusterInput()
eval = EvaluateLength(Curve=C, Length=Slider(0.05, range=0..100), Normalized=False)  # -> Point, Tangent, Parameter
eval_2 = EvaluateLength(Curve=C_2, Length=Slider(0, range=0..100), Normalized=False)  # -> Point, Tangent, Parameter
eval_3 = EvaluateLength(Curve=C_3, Length=Slider(0.05, range=0..100), Normalized=False)  # -> Point, Tangent, Parameter
eval_4 = EvaluateLength(Curve=C_4, Length=Slider(0.2, range=0..100), Normalized=False)  # -> Point, Tangent, Parameter
vec2pt = Vector2Pt(PointA=A, PointB=B, Unitize=False)  # -> Vector, Length
vec2pt_2 = Vector2Pt(PointA=A_2, PointB=B_2, Unitize=False)  # -> Vector, Length
vec2pt_3 = Vector2Pt(PointA=A_3, PointB=B_3, Unitize=False)  # -> Vector, Length
circle = CircleCNR(Center=eval.Point, Normal=vec2pt.Vector, Radius=0.12)  # -> graft(Circle)
circle_2 = CircleCNR(Center=eval_2.Point, Normal=Vector(0, 0, 1), Radius=0.12)  # -> graft(Circle)
amp = Amplitude(Vector=vec2pt_2.Vector, Amplitude=Slider(0.15, range=0..1))
circle_3 = CircleCNR(Center=eval_3.Point, Normal=vec2pt_2.Vector, Radius=0.07)
amp_2 = Amplitude(Vector=vec2pt_3.Vector, Amplitude=Slider(0.05, range=0..0.1))
circle_4 = CircleCNR(Center=eval_4.Point, Normal=vec2pt_3.Vector, Radius=0.12)
extr = Extrude(Base=circle_3, Direction=amp)
extr_2 = Extrude(Base=circle_4, Direction=amp_2)
loft = Loft(
    Curves=[circle_2, circle],
    Options={Adjust=True, Closed=False, LoftEnds=0, LoftSimp=0, LoftType=3, Rebuild=10, Refit=0.01})
boundary = BoundarySurfaces(Edges=circle)
capex = CapHolesEx(Brep=extr_2)  # -> Brep, Caps, Solid
brep = Brep([extr, capex.Brep, loft, boundary])
brep_2 = ClusterOutput(brep)

# ==== cluster Cluster_2
V = ClusterInput()
pline = PolyLine(Vertices=V, Closed=False)
disc = Discontinuity(Curve=pline, Level=2)  # -> Points, Parameters
shatter = Shatter(Curve=pline, Parameters=disc.Parameters)
line = Line(shatter)
line_2 = ClusterOutput(line)
