# Grasshopper definition 008_AS_Comments.gh (Grasshopper 0.9.76)
# plug-ins: Karamba, Weaverbird

# ---- group: PAVILIONS
brep = Brep([<brep referenced from the Rhino model> x2])
Z = UnitZ(Factor=Slider(0.3, range=0..1))
pop3d = Populate3D(Region=brep, Count=100, Seed=1)
extr = Extrude(Base=brep, Direction=Z)
voronoi = Voronoi(Points=pop3d, BruteForceOverride=False)
graft = GraftTree(Tree=voronoi, IncludeEmptyLists=True, IncludeNullItems=True)
project = Project(Curve=graft, Brep=brep, Direction=Vector(0, 0, 1))
Z_2 = UnitZ(Factor=Slider(0.6, range=0..1))
extr_2 = Extrude(Base=project, Direction=Z_2)
brep_2 = Brep(extr_2)
mesh = MeshBrep(
    Brep=brep_2,
    Settings={GridMaxCount=0, GridMinCount=16, JaggedSeams=False, MaxEdgeLength=0, MinEdgeLength=0.0001, MinTolerance=0, Refine=True, RefineAngle=0, RelativeTolerance=0.65, SimplePlanes=True, Tolerance=0})
wbthicken = WeaverbirdsMeshThicken(MeshCurves=mesh, Distance=Slider(0.2, range=0..1), OffsetType=0)
mesh_2 = Mesh([extr, wbthicken])

# ----
series = Series(Start=Slider(21, range=0..100), Step=1, Count=Slider(11, range=0..100))
arc_dimensions = Slider(10, range=0..10)
cable_dimensions = Slider(3, range=0..10)
number_slider = Slider(7, range=0..10)
Z_3 = UnitZ(Factor=Slider(1, range=0..1000))
neg = Negative(Value=Z_3)

matselect = MaterialSelectionKaramba(NameOrListIndexOfMaterial="Steel", menu=[dropdown(1), dropdown(1)])

loads = LoadsKaramba(Vector=Vector(0, 0, -1), LCase=0, mode="Gravity")

# ---- group: PATHWAY
number_slider_2 = Slider(6, range=0..10)
crv = Curve(<curve referenced from the Rhino model>)
xy = XYPlane(Origin=Point(0, 0, 0))
offset_l = OffsetLoose(Curve=crv, Distance=expr("-x", Slider(10, range=0..100)), Plane=xy)
offset_l_2 = OffsetLoose(Curve=crv, Distance=Slider(10, range=0..100), Plane=xy)
divide = DivideCurve(Curve=offset_l_2, Count=number_slider_2, Kinks=False)  # -> Points, Tangents, Parameters
divide_2 = DivideCurve(Curve=offset_l, Count=number_slider_2, Kinks=False)  # -> Points, Tangents, Parameters
dispatch = Dispatch(List=divide_2.Points, DispatchPattern=[True, False])  # -> ListA, ListB
dispatch_2 = Dispatch(List=divide.Points, DispatchPattern=[True, False])  # -> ListA, ListB
number_slider_3 = Slider(5, range=0..10)
Z_4 = UnitZ(Factor=1)
neg_2 = Negative(Value=Z_4)

divide_3 = DivideCurve(Curve=crv, Count=number_slider_2, Kinks=False)  # -> Points, Tangents, Parameters
dispatch_3 = Dispatch(List=divide_3.Points, DispatchPattern=[True, False])  # -> ListA, ListB

# ---- group: ARC + CABLES
crv_2 = Curve(<curve referenced from the Rhino model>)
suspension_cables = Slider(11, range=0..100)
pln = Plane(crv_2)
divide_4 = DivideCurve(Curve=crv_2, Count=suspension_cables, Kinks=False)  # -> Points, Tangents, Parameters
xprod = CrossProduct(VectorA=pln, VectorB=divide_4.Tangents, Unitize=False)  # -> Vector, Length
lng = ListLength(List=xprod.Vector)
range = Range(Domain=Domain(0, 1), Steps=expr("X-1", lng))
graph = GraphMapper(
    range,
    x0=0,
    x1=1,
    y0=0,
    y1=1,
    container_name="Parabola",
    Ox=0.494840771,
    Oy=0.1557679176,
    Px=0.9669565558,
    Py=0.8449277878)
number_slider_4 = Slider(10, range=0..10)
multiplication = Multiplication(A=graph, B=Slider(18.9, range=0..100))
amp = Amplitude(Vector=xprod.Vector, Amplitude=multiplication)
move = Move(Geometry=divide_4.Points, Motion=amp)  # -> Geometry, Transform
panel = Panel(graph)
ln = Line(StartPoint=divide_4.Points, EndPoint=move.Geometry)
loft = Loft(Curves=ln, Options={Adjust=False, Closed=False, LoftEnds=0, LoftSimp=0, LoftType=0, Rebuild=10, Refit=0.01})
Y = UnitY(Factor=Slider(1, range=0..1))
crv_3 = Curve(crv_2)
divide_5 = DivideCurve(Curve=crv_3, Count=Slider(25, range=0..100), Kinks=False)  # -> Points, Tangents, Parameters
cull_i = CullIndex(List=divide_5.Points, Indices=series, Wrap=True)  # -> flatten(List)
Z_5 = UnitZ(Factor=Slider(1, range=0..100))
crv_4 = Curve(crv)
rev = ReverseList(List=cull_i)
entwine = Entwine(Branch00=cull_i, Branch01=rev, FlattenInputs=True)
number_slider_5 = Slider(0.3, range=0..1)

# ---- group: ARC + CABLES / ARC
extr_3 = Extrude(Base=loft, Direction=Y)

# ----
debrep = DeconstructBrep(Brep=loft)  # -> Faces, Edges, Vertices; disabled
arc = Curve(debrep.Edges)  # disabled
arc_points = Point(cull_i)

# ---- group: PROBLEM
supp = SupportKaramba(PosInd=flatten(arc_points), menu=[buttons(on, on, on, off, off, off)])  # -> flatten(Support)

# ---- group: PATHWAY (continued)
weave = Weave(Pattern=[0, 1], Stream0=dispatch_3.ListA, Stream1=dispatch.ListB, NullGaps=False)
weave_2 = Weave(Pattern=[0, 1], Stream0=dispatch_3.ListA, Stream1=dispatch_2.ListB, NullGaps=False)
intcrv = Interpolate(Vertices=reverse(weave), Degree=3, Periodic=False, KnotStyle=1)  # -> Curve, Length, Domain
intcrv_2 = Interpolate(Vertices=weave_2, Degree=3, Periodic=False, KnotStyle=1)  # -> Curve, Length, Domain
join = JoinCurves(Curves=[intcrv_2.Curve, intcrv.Curve], Preserve=False)
divide_6 = DivideCurve(Curve=intcrv_2.Curve, Count=Slider(500, range=0..1000), Kinks=False)  # -> Points, Tangents, Parameters
divide_7 = DivideCurve(Curve=intcrv.Curve, Count=Slider(500, range=0..1000), Kinks=False)  # -> Points, Tangents, Parameters
patch = Patch(Curves=join, Spans=20, Flexibility=1, Trim=True)
cluster = Cluster_2(C=intcrv_2.Curve, t=divide_6.Parameters, A=number_slider_3)
srf = Surface(cluster)
debrep_2 = DeconstructBrep(Brep=srf)  # -> Faces, Edges, Vertices
item = ListItem(List=debrep_2.Edges, Index=Slider(0, range=0..10), Wrap=True)
divide_8 = DivideCurve(Curve=join, Count=Slider(6, range=0..10), Kinks=False)  # -> Points, Tangents, Parameters
shatter = Shatter(Curve=join, Parameters=divide_8.Parameters)
item_2 = ListItem(List=shatter, Index=[Slider(1, range=0..10), Slider(4, range=0..10)], Wrap=True)
crv_5 = Curve(item_2)
patch_2 = Patch(Curves=crv_5, Spans=20, Flexibility=1, Trim=True)

# ---- group: ARC + CABLES (continued)
crv_6 = Curve(flatten([intcrv_2.Curve, intcrv.Curve]))
crv_7 = Curve(simplify(graft(crv_6)))
offset = Offset(Curve=crv_7, Distance=Slider(10, range=0..10), Plane=PlaneXY(0, 0, 0), Corners=1)  # -> simplify(Curve)
crv_8 = Curve(simplify([crv_7, offset]))
loft_2 = Loft(Curves=[offset, crv_7], Options={Adjust=False, Closed=False, LoftEnds=0, LoftSimp=0, LoftType=0, Rebuild=10, Refit=0.01})
divide_9 = DivideCurve(Curve=simplify(graft(crv_8)), Count=suspension_cables, Kinks=False)  # -> simplify(Points), Tangents, Parameters
path_mapper = PathMapper(divide_9.Points, source="{a;b}(i)", target="{a;i}(b)")
pull = PullPoint(Point=path_mapper, Geometry=crv_4, ClosestOnly=True)  # -> ClosestPoint, Distance
sort = SortList(Keys=pull.Distance, ValuesA=path_mapper)  # -> Keys, ValuesA
item_3 = ListItem(List=sort.ValuesA, Index=0, Wrap=True)
pshift = ShiftPaths(Data=item_3, Offset=-1)
ln_2 = Line(StartPoint=pshift, EndPoint=entwine)

# ---- group: PATHWAY
cluster_2 = Cluster(C=intcrv.Curve, t=divide_7.Parameters, A=expr("-x", number_slider_3))
srf_2 = Surface(cluster_2)

srf_3 = Surface([srf, srf_2])
debrep_3 = DeconstructBrep(Brep=srf_2)  # -> Faces, Edges, Vertices
item_4 = ListItem(List=debrep_3.Edges, Index=Slider(0, range=0..10), Wrap=True)
len = Length(Curve=item_4)
len_2 = Length(Curve=item_4)
multiplication_2 = Multiplication(A=len, B=Slider(0.366, range=0..1))
multiplication_3 = Multiplication(A=len_2, B=Slider(0.633, range=0..1))
eval = EvaluateLength(Curve=reparameterize(item_4), Length=multiplication_2, Normalized=invert(True))  # -> Point, Tangent, Parameter
eval_2 = EvaluateLength(Curve=reparameterize(item_4), Length=multiplication_3, Normalized=invert(True))  # -> Point, Tangent, Parameter
shatter_2 = Shatter(Curve=item_4, Parameters=[eval_2.Parameter, eval.Parameter])

# ----
debrep_4 = DeconstructBrep(Brep=srf_3)  # -> Faces, flatten(Edges), Vertices
divide_10 = DivideCurve(Curve=join, Count=Slider(26, range=0..100), Kinks=False)  # -> Points, Tangents, Parameters
number_slider_6 = Slider(2.5, range=0..2.5)
item_5 = ListItem(List=debrep_4.Edges, Index=Slider(2, range=0..10), Wrap=True)
item_6 = ListItem(List=debrep_4.Edges, Index=Slider(6, range=0..10), Wrap=True)
crv_9 = Curve(item_6)
crv_10 = Curve(item_5)
shatter_3 = Shatter(Curve=join, Parameters=divide_10.Parameters)
Z_6 = UnitZ(Factor=number_slider_6)
cull_i_2 = CullIndex(
    List=shatter_3,
    Indices=[Slider(9, range=0..100), Slider(8, range=0..100), Slider(10, range=0..100), Slider(17, range=0..100), Slider(16, range=0..100), Slider(15, range=0..100), Slider(22, range=0..26), Slider(23, range=0..26), Slider(21, range=0..26), Slider(2, range=0..26), Slider(3, range=0..26), Slider(4, range=0..26)],
    Wrap=True)
move_2 = Move(Geometry=crv_10, Motion=Z_6)  # -> Geometry, Transform
Z_7 = UnitZ(Factor=number_slider_6)
neg_3 = Negative(Value=Slider(1, range=0..1))
neg_4 = Negative(Value=Slider(1, range=0..1))
move_3 = Move(Geometry=crv_9, Motion=Z_7)  # -> Geometry, Transform
Z_8 = UnitZ(Factor=Slider(1.5, range=0..10))
offset_2 = Offset(Curve=move_2.Geometry, Distance=neg_4, Plane=PlaneXY(0, 0, 0), Corners=1)  # -> flatten(Curve)
offset_3 = Offset(Curve=move_3.Geometry, Distance=neg_3, Plane=PlaneXY(0, 0, 0), Corners=1)  # -> flatten(Curve)
move_4 = Move(Geometry=cull_i_2, Motion=Z_8)  # -> Geometry, Transform
divide_11 = DivideCurve(Curve=cull_i_2, Count=10, Kinks=False)  # -> Points, Tangents, Parameters
divide_12 = DivideCurve(Curve=move_4.Geometry, Count=10, Kinks=False)  # -> Points, Tangents, Parameters
loft_3 = Loft(
    Curves=[crv_10, offset_2],
    Options={Adjust=False, Closed=False, LoftEnds=0, LoftSimp=0, LoftType=0, Rebuild=10, Refit=0.01})
loft_4 = Loft(
    Curves=[crv_9, offset_3],
    Options={Adjust=False, Closed=False, LoftEnds=0, LoftSimp=0, LoftType=0, Rebuild=10, Refit=0.01})
ln_3 = Line(StartPoint=divide_11.Points, EndPoint=divide_12.Points)
sdivide = DivideSurface(Surface=loft_4, UCount=Slider(2, range=0..10), VCount=Slider(100, range=0..100))  # -> Points, Normals, Parameters
sdivide_2 = DivideSurface(Surface=loft_3, UCount=Slider(2, range=0..10), VCount=Slider(100, range=0..100))  # -> Points, Normals, Parameters
X = UnitX(Factor=Slider(0.1, range=0..1))
intcrv_3 = Interpolate(Vertices=sdivide.Points, Degree=3, Periodic=False, KnotStyle=1)  # -> Curve, Length, Domain
neg_5 = Negative(Value=X)
intcrv_4 = Interpolate(Vertices=sdivide_2.Points, Degree=3, Periodic=False, KnotStyle=1)  # -> Curve, Length, Domain
pipe = Pipe(Curve=[ln_3, move_4.Geometry, cull_i_2], Radius=Slider(0.07, range=0..1), Caps=0)
number_slider_7 = Slider(53, range=0..100)
offset_4 = Offset(Curve=intcrv_3.Curve, Distance=Slider(0.24, range=0..1), Plane=PlaneXY(0, 0, 0), Corners=1)
number_slider_8 = Slider(53, range=0..100)
offset_5 = Offset(Curve=intcrv_4.Curve, Distance=Slider(0.24, range=0..1), Plane=PlaneXY(0, 0, 0), Corners=1)
divide_13 = DivideCurve(Curve=intcrv_3.Curve, Count=number_slider_7, Kinks=False)  # -> Points, Tangents, Parameters
divide_14 = DivideCurve(Curve=offset_4, Count=number_slider_7, Kinks=False)  # -> Points, Tangents, Parameters
divide_15 = DivideCurve(Curve=intcrv_4.Curve, Count=number_slider_8, Kinks=False)  # -> Points, Tangents, Parameters
divide_16 = DivideCurve(Curve=offset_5, Count=number_slider_8, Kinks=False)  # -> Points, Tangents, Parameters
ln_4 = Line(StartPoint=divide_14.Points, EndPoint=divide_13.Points)
ln_5 = Line(StartPoint=divide_16.Points, EndPoint=divide_15.Points)
pipe_2 = Pipe(Curve=[ln_4, offset_4, intcrv_3.Curve], Radius=Slider(0.03, range=0..1), Caps=0)
pipe_3 = Pipe(Curve=[ln_5, offset_5, intcrv_4.Curve], Radius=Slider(0.07, range=0..1), Caps=0)

# ---- group: PATHWAY / DECK
extr_4 = Extrude(Base=[srf_3, patch], Direction=neg_2)

# ---- group: ARC + CABLES / CABLES
pipe_4 = Pipe(Curve=ln_2, Radius=number_slider_5, Caps=0)

# ----
debrep_5 = DeconstructBrep(Brep=srf_3)  # -> Faces, Edges, Vertices

# ----
# Karamba doesn't work with curves or polylines. You need to convert this to lines.
arc_2 = Curve(flatten(crv_3))
deck = Curve(flatten(debrep_5.Edges))

line = Line(flatten(ln_2))

# ---- group: windscreen
extr_5 = Extrude(Base=[loft_4, loft_3], Direction=neg_5)

# ----
deck_points = Point(pshift)
end = EndPoints(Curve=arc_2)  # -> Start, End

linetobeam = LineToBeamKaramba(
    Points=flatten(arc_points),
    Line=flatten(line),
    New=True,
    Remove=True,
    LimitDistance_m=0.005,
    BeamIdentifier="Suspension Cables")  # -> Points, Element, Info

pt = Point([end.Start, end.End])

linetobeam_2 = LineToBeamKaramba(Line=flatten(arc_2), New=True, Remove=True, LimitDistance_m=0.005, BeamIdentifier="Arc")  # -> Points, Element, Info

linetobeam_3 = LineToBeamKaramba(Line=flatten(deck), New=True, Remove=True, LimitDistance_m=0.005, BeamIdentifier="Deck")  # -> Points, Element, Info

cross_sections = CrossSectionsKaramba(
    ElementsIdentifiers="Arc",
    Height_cm=arc_dimensions,
    UpperFlangeWidth_cm=arc_dimensions,
    LowerFlangeWidth_cm=arc_dimensions,
    mode="Trapezoid")
cross_sections_2 = CrossSectionsKaramba(
    ElementsIdentifiers="Suspension Cables",
    Height_cm=cable_dimensions,
    UpperFlangeWidth_cm=cable_dimensions,
    LowerFlangeWidth_cm=cable_dimensions,
    mode="Trapezoid")
crv_11 = Curve([line, deck, arc_2])
cross_sections_3 = CrossSectionsKaramba(
    ElementsIdentifiers="Deck",
    Height_cm=number_slider,
    UpperFlangeWidth_cm=number_slider,
    LowerFlangeWidth_cm=number_slider,
    mode="Trapezoid")

# ---- group: Fixed Points
supp_2 = SupportKaramba(PosInd=flatten(pt), menu=[buttons(off, off, off, on, on, on)])

# ----
loads_2 = LoadsKaramba(ForceVector=neg, Local=True, PosInd=deck_points, LCase=0, mode="Point")  # -> flatten(Load)
supp_3 = SupportKaramba(PosInd=flatten(deck_points), menu=[buttons(on, on, on, off, off, off)])
len_3 = Length(Curve=crv_11)
panel_2 = Panel(len_3)

# ----
# USE THIS TO MAKE CABLES WORK
panel_3 = Panel("0")
modifyelem = ModifyElementKaramba(Beam=linetobeam.Element, Height_cm=graft("15"), Thickness_cm=graft("6"), Bending=panel_3, mode="Beam")

ma = MassAddition(Input=panel_2)  # -> Result, PartialResults
panel_4 = Panel(ma.Result)
assemble = AssembleModelKaramba(
    Elem=flatten([linetobeam_2.Element, modifyelem, linetobeam_3.Element]),
    Support=flatten([supp_2, supp_3, supp]),
    Load=flatten([loads, loads_2]),
    CrossSection=flatten([cross_sections_3, cross_sections_2, cross_sections]),
    Material=flatten(matselect),
    LimitDistance_m=0.005)  # -> flatten(Model), Info, Mass_kg, CenterOfGravity
division = Division(A=panel_4, B=Slider(38, range=0..100))
panel_5 = Panel(division)
analyzethi = AnalyzeThIKaramba(Model=assemble.Model)  # -> CalculatedModel, MaximumDisplacement_m, ResultingForceOfGravity_kN, ElasticEnergy_kNm
division_2 = Division(A=analyzethi.MaximumDisplacement_m, B=panel_5)
modelview = ModelViewKaramba(Model=analyzethi.CalculatedModel, LoadCaseFactorsForLinearSuperposition=1, IndexIncrementOfVisibleLoadcase=0)  # -> Model, DeformedMesh, DeformedAxes, DeformedModel
multiplication_4 = Multiplication(A=Slider(100, range=0..100), B=division_2)
beamview = BeamViewKaramba(Model=modelview.Model)  # -> Model, MeshesOfRenderedBeams, DeformedBeamAxes, LegendColors, LegendTags
panel_6 = Panel(multiplication_4)

# ==== cluster Cluster
C = ClusterInput()
t = ClusterInput()
hframe = HorizontalFrame(Curve=C, Parameter=t)
deplane = DeconstructPlane(Plane=hframe)  # -> Origin, XAxis, YAxis, ZAxis
A = ClusterInput()
amp = Amplitude(Vector=deplane.YAxis, Amplitude=A)
pt = Point(deplane.Origin)
move = Move(Geometry=deplane.Origin, Motion=amp)  # -> Geometry, Transform
ln = Line(StartPoint=pt, EndPoint=move.Geometry)
loft = Loft(Curves=ln, Options={Adjust=False, Closed=False, LoftEnds=0, LoftSimp=0, LoftType=0, Rebuild=10, Refit=0.01})
L = ClusterOutput(loft)

# ==== cluster Cluster_2
C = ClusterInput()
t = ClusterInput()
hframe = HorizontalFrame(Curve=C, Parameter=t)
deplane = DeconstructPlane(Plane=hframe)  # -> Origin, XAxis, YAxis, ZAxis
A = ClusterInput()
amp = Amplitude(Vector=deplane.YAxis, Amplitude=A)
rev = Reverse(Vector=amp)
pt = Point(deplane.Origin)
move = Move(Geometry=deplane.Origin, Motion=rev)  # -> Geometry, Transform
ln = Line(StartPoint=pt, EndPoint=move.Geometry)
loft = Loft(Curves=ln, Options={Adjust=False, Closed=False, LoftEnds=0, LoftSimp=0, LoftType=0, Rebuild=10, Refit=0.01})
L = ClusterOutput(loft)
