# Grasshopper definition 010_DH_Comments.gh (Grasshopper 0.9.76)
# plug-ins: Karamba, MeshEdit Components, Kangaroo Components

number_slider = Slider(-4.915, range=-50..50)
Z = UnitZ(Factor=-100)
supportlengths = Slider(26, range=0..100)
# BASE STRUCTURES
suppcircrad = Slider(8, range=0..10)
supportpoints = Slider(4, range=0..10)
curveoffset = Slider(50, range=0..100)
deckoffset = Slider(10, range=0..100)
balbasepiperad = Slider(0.2, range=0..1)
acrheight = Slider(10, range=0..100)
deckshatterpoints = Slider(3, range=0..10)
balheight = Slider(1.4, range=0..10)
pt = ConstructPoint(XCoordinate=0, YCoordinate=0, ZCoordinate=number_slider)
xy = XYPlane(Origin=pt)
pt_2 = Point(<point referenced from the Rhino model>)
pt_3 = Point(<point referenced from the Rhino model>)
ln = Line(StartPoint=pt_2, EndPoint=pt_3)
curvepoint = PointOnCurve(ln, parameter=0.5)
Z_2 = UnitZ(Factor=acrheight)
panel = Panel("""2
3""")
move = Move(Geometry=curvepoint, Motion=Z_2)  # -> Geometry, Transform
panel_2 = Panel("""1
0""")
panel_3 = Panel("""1
11""")
arc = Arc3Pt(PointA=pt_2, PointB=move.Geometry, PointC=pt_3)  # -> Arc, Plane, Radius
number_slider_2 = Slider(20, range=0..100)
Z_3 = UnitZ(Factor=1)
neg = Negative(Value=Z_3)
xy_2 = XYPlane(Origin=Point(0, 0, 0))
offset_l = OffsetLoose(Curve=arc.Arc, Distance=curveoffset, Plane=xy_2)
Z_4 = UnitZ(Factor=Slider(4, range=0..10))
Z_5 = UnitZ(Factor=1)
Z_6 = UnitZ(Factor=1)
Z_7 = UnitZ(Factor=Slider(-5, range=-10..1))
curvepoint_2 = PointOnCurve(offset_l, parameter=0.243)
curvepoint_3 = PointOnCurve(arc.Arc, parameter=0.763)
Z_8 = UnitZ(Factor=1)
Z_9 = UnitZ(Factor=1)
intcrv = Interpolate(Vertices=[pt_2, curvepoint_2, curvepoint_3, pt_3], Degree=3, Periodic=False, KnotStyle=1)  # -> Curve, Length, Domain
Z_10 = UnitZ(Factor=1)
Z_11 = UnitZ(Factor=1)
neg_2 = Negative(Value=Z_10)
divide = DivideCurve(Curve=intcrv.Curve, Count=deckshatterpoints, Kinks=False)  # -> Points, Tangents, Parameters
number_slider_3 = Slider(10, range=0..10)
Z_12 = UnitZ(Factor=100)
move_2 = Move(Geometry=intcrv.Curve, Motion=Z_11)  # -> Geometry, Transform
range = Range(Domain=Domain(0, 1), Steps=10)
graph = GraphMapper(
    range,
    x0=0,
    x1=1,
    y0=0,
    y1=1,
    container_name="Sine",
    Equation_px=[0.004662924446, 0.5004141927],
    Equation_py=[0.6465498209, 1])
number_slider_4 = Slider(0.8, range=0..1)
shatter = Shatter(Curve=intcrv.Curve, Parameters=divide.Parameters)  # -> graft(Segments)
Z_13 = UnitZ(Factor=100)
divide_2 = DivideCurve(Curve=intcrv.Curve, Count=10, Kinks=False)  # -> Points, Tangents, Parameters
subtraction = Subtraction(A=number_slider_3, B=1.5)
neg_3 = Negative(Value=number_slider_3)
xy_3 = XYPlane(Origin=Point(0, 0, 0))
number_slider_5 = Slider(0.5, range=0..1)
neg_4 = Negative(Value=subtraction)
neg_5 = Negative(Value=deckoffset)
xy_4 = XYPlane(Origin=Point(0, 0, 0))
item = ListItem(List=flatten(shatter), Index=1, Wrap=True)
subtraction_2 = Subtraction(A=number_slider_3, B=1)
xy_5 = XYPlane(Origin=Point(0, 0, 0))
panel_4 = Panel("""1
2
3""")
offset_l_2 = OffsetLoose(Curve=move_2.Geometry, Distance=[subtraction, neg_4], Plane=xy_3)
bang = ExplodeTree(Data=simplify(graft(offset_l_2)))  # -> Branch0, Branch1
divide_3 = DivideCurve(Curve=bang.Branch1, Count=number_slider_2, Kinks=False)  # -> Points, Tangents, Parameters
divide_4 = DivideCurve(Curve=bang.Branch0, Count=number_slider_2, Kinks=False)  # -> Points, Tangents, Parameters
shatter_2 = Shatter(Curve=graft(bang.Branch0), Parameters=simplify(divide_4.Parameters))
shatter_3 = Shatter(Curve=graft(bang.Branch1), Parameters=simplify(divide_3.Parameters))
trim = TrimTree(Tree=shatter_2, Depth=1)
trim_2 = TrimTree(Tree=shatter_3, Depth=1)
dispatch = Dispatch(List=trim, DispatchPattern=[True, False])  # -> ListA, ListB
dispatch_2 = Dispatch(List=trim_2, DispatchPattern=[True, False])  # -> ListA, ListB
crv = Curve(dispatch.ListA)
crv_2 = Curve(dispatch_2.ListB)
neg_6 = Negative(Value=subtraction_2)
len = Length(Curve=item)
Z_14 = UnitZ(Factor=1)
offset_l_3 = OffsetLoose(Curve=crv, Distance=expr("-x", number_slider_4), Plane=xy_4)
int = Integer(2)
offset_l_4 = OffsetLoose(Curve=move_2.Geometry, Distance=[subtraction_2, neg_6], Plane=xy_3)
offset_l_5 = OffsetLoose(Curve=crv_2, Distance=number_slider_4, Plane=xy_4)
offset_l_6 = OffsetLoose(Curve=shatter, Distance=[deckoffset, neg_5], Plane=xy_5)
multiplication = Multiplication(A=graph, B=Slider(10, range=0..100))
move_3 = Move(Geometry=offset_l_6, Motion=Z_14)  # -> Geometry, Transform
offset_l_7 = OffsetLoose(Curve=intcrv.Curve, Distance=[neg_3, number_slider_3])
Z_15 = UnitZ(Factor=1)
Z_16 = UnitZ(Factor=number_slider_5)
X = UnitX(Factor=multiplication)
Y = UnitY(Factor=multiplication)
Z_17 = UnitZ(Factor=number_slider_5)
move_4 = Move(Geometry=[crv_2, crv], Motion=Z_17)  # -> Geometry, Transform
move_5 = Move(Geometry=[crv_2, crv], Motion=Z_15)  # -> Geometry, Transform
Z_18 = UnitZ(Factor=1)
Z_19 = UnitZ(Factor=Slider(0.5, range=0..1))
move_6 = Move(Geometry=divide_2.Points, Motion=X)  # -> Geometry, Transform
move_7 = Move(Geometry=divide_2.Points, Motion=Y)  # -> Geometry, Transform
move_8 = Move(Geometry=offset_l_3, Motion=Z_19)  # -> graft(Geometry), Transform
bang_2 = ExplodeTree(Data=move_5.Geometry)  # -> graft(Branch0), graft(Branch1)
bang_3 = ExplodeTree(Data=move_4.Geometry)  # -> graft(Branch0), graft(Branch1)
move_9 = Move(Geometry=offset_l_5, Motion=Z_16)  # -> graft(Geometry), Transform
number_slider_6 = Slider(71, range=0..100)
divide_5 = DivideCurve(Curve=offset_l_4, Count=number_slider_6, Kinks=False)  # -> Points, Tangents, Parameters
line = LineSDL(Start=divide_5.Points, Direction=Z_18, Length=Slider(1.2, range=0..10))  # -> simplify(Line)
crv_3 = Curve(graft(offset_l_3))
crv_4 = Curve(graft(crv))
intcrv_2 = Interpolate(Vertices=move_7.Geometry, Degree=3, Periodic=False, KnotStyle=1)  # -> Curve, Length, Domain
intcrv_3 = Interpolate(Vertices=move_6.Geometry, Degree=3, Periodic=False, KnotStyle=1)  # -> Curve, Length, Domain
crv_5 = Curve(graft(crv_2))
crv_6 = Curve(graft(offset_l_5))
loft = Loft(Curves=offset_l_6, Options={Adjust=False, Closed=False, LoftEnds=0, LoftSimp=0, LoftType=0, Rebuild=10, Refit=0.01})
range_2 = Range(Domain=Domain(0, 1), Steps=10)
loft_2 = Loft(Curves=offset_l_7, Options={Adjust=True, Closed=False, LoftEnds=0, LoftSimp=0, LoftType=0, Rebuild=10, Refit=0.01})

# ---- group: BallustradePoles
number_slider_7 = Slider(0.05, range=0..0.1)
number_slider_8 = Slider(0.04, range=0..0.1)
pframes = PerpFrames(Curve=line, Count=10, Align=True)  # -> Frames, Parameters
dom = ConstructDomain(DomainStart=expr("-X", number_slider_8), DomainEnd=number_slider_8)
dom_2 = ConstructDomain(DomainStart=expr("-X", number_slider_7), DomainEnd=number_slider_7)
prot = RotatePlane(Plane=pframes.Frames, Angle=degrees(Slider(110, range=0..360)))
rectangle = Rectangle(Plane=prot, XSize=dom, YSize=dom_2, Radius=0)  # -> Rectangle, Length

# ----
number_slider_9 = Slider(50, range=0..100)  # disabled
number_slider_10 = Slider(100, range=0..1000)  # disabled
loft_3 = Loft(Curves=[crv_3, crv_4], Options={Adjust=False, Closed=False, LoftEnds=0, LoftSimp=0, LoftType=0, Rebuild=10, Refit=0.01})

loft_4 = Loft(
    Curves=[bang_2.Branch0, bang_3.Branch0],
    Options={Adjust=False, Closed=False, LoftEnds=0, LoftSimp=0, LoftType=0, Rebuild=10, Refit=0.01})
loft_5 = Loft(
    Curves=[move_8.Geometry, crv_3],
    Options={Adjust=False, Closed=False, LoftEnds=0, LoftSimp=0, LoftType=0, Rebuild=10, Refit=0.01})
loft_6 = Loft(
    Curves=[bang_3.Branch0, move_8.Geometry],
    Options={Adjust=False, Closed=False, LoftEnds=0, LoftSimp=0, LoftType=0, Rebuild=10, Refit=0.01})

loft_7 = Loft(
    Curves=[bang_2.Branch1, bang_3.Branch1],
    Options={Adjust=False, Closed=False, LoftEnds=0, LoftSimp=0, LoftType=0, Rebuild=10, Refit=0.01})
loft_8 = Loft(
    Curves=[move_9.Geometry, bang_3.Branch1],
    Options={Adjust=False, Closed=False, LoftEnds=0, LoftSimp=0, LoftType=0, Rebuild=10, Refit=0.01})
loft_9 = Loft(
    Curves=[move_9.Geometry, crv_6],
    Options={Adjust=False, Closed=False, LoftEnds=0, LoftSimp=0, LoftType=0, Rebuild=10, Refit=0.01})

loft_10 = Loft(Curves=[crv_6, crv_5], Options={Adjust=False, Closed=False, LoftEnds=0, LoftSimp=0, LoftType=0, Rebuild=10, Refit=0.01})
filter = StreamFilter(Gate=Toggle(True), Stream0=loft, Stream1=loft_2)
number_slider_11 = Slider(6, range=0..10)
mesh_uv = MeshSurface(
    Surface=[loft_7, loft_8, loft_10, loft_9],
    UCount=expr("x/2", number_slider_11),
    VCount=number_slider_11,
    Overhang=True,
    Equalize=False)
mesh_uv_2 = MeshSurface(
    Surface=[loft_5, loft_6, loft_4, loft_3],
    UCount=expr("x/2", number_slider_11),
    VCount=number_slider_11,
    Overhang=True,
    Equalize=False)  # -> simplify(Mesh)
mjoin = MeshJoin(Meshes=mesh_uv)
medges = MeshEdges(Mesh=mesh_uv_2)  # -> NakedEdges, InteriorEdges, NonManifoldEdges
mjoin_2 = MeshJoin(Meshes=mesh_uv_2)
number_slider_12 = Slider(0.08, range=0..1)
unifynormals = MeshUnifyNormals(Mesh=mjoin)
unifynormals_2 = MeshUnifyNormals(Mesh=mjoin_2)
end = EndPoints(Curve=line)  # -> simplify(Start), simplify(End)
weldvertices = MeshWeldVertices(Mesh=unifynormals, Tolerance=0.01)  # -> RuntimeMessage, Mesh
weldvertices_2 = MeshWeldVertices(Mesh=unifynormals_2, Tolerance=0.01)  # -> RuntimeMessage, Mesh
number_slider_13 = Slider(0.08, range=0..1)
loads = LoadsKaramba(Vector=Vector(0, 0, -1), LCase=0, mode="Gravity")  # disabled
flip = MeshFlip(Mesh=weldvertices_2.Mesh)
intcrv_4 = Interpolate(Vertices=end.End, Degree=3, Periodic=False, KnotStyle=1)  # -> Curve, Length, Domain
intcrv_5 = Interpolate(Vertices=end.Start, Degree=3, Periodic=False, KnotStyle=1)  # -> Curve, Length, Domain
pframes_2 = PerpFrames(Curve=intcrv_4.Curve, Count=number_slider_6, Align=True)  # -> Frames, Parameters
pframes_3 = PerpFrames(Curve=intcrv_5.Curve, Count=number_slider_6, Align=True)  # -> Frames, Parameters

# ---- group: BallustradeHorizontals
divide_6 = DivideCurve(Curve=line, Count=6, Kinks=False)  # -> simplify(Points), Tangents, Parameters
item_2 = ListItem(List=divide_6.Points, Index=0, Wrap=True)
item_3 = ListItem(List=divide_6.Points, Index=1, Wrap=True)
item_4 = ListItem(List=divide_6.Points, Index=2, Wrap=True)
item_5 = ListItem(List=divide_6.Points, Index=3, Wrap=True)
item_6 = ListItem(List=divide_6.Points, Index=4, Wrap=True)
item_7 = ListItem(List=divide_6.Points, Index=5, Wrap=True)
trim_3 = TrimTree(Tree=item_7, Depth=1)
trim_4 = TrimTree(Tree=item_2, Depth=1)
trim_5 = TrimTree(Tree=item_3, Depth=1)
trim_6 = TrimTree(Tree=item_4, Depth=1)
trim_7 = TrimTree(Tree=item_5, Depth=1)
trim_8 = TrimTree(Tree=item_6, Depth=1)
pline = PolyLine(Vertices=trim_4, Closed=False)
pline_2 = PolyLine(Vertices=trim_5, Closed=False)
pline_3 = PolyLine(Vertices=trim_6, Closed=False)
pline_4 = PolyLine(Vertices=trim_7, Closed=False)
pline_5 = PolyLine(Vertices=trim_8, Closed=False)
pline_6 = PolyLine(Vertices=trim_3, Closed=False)
pipe = Pipe(Curve=[pline, pline_2, pline_3, pline_4, pline_5, pline_6], Radius=Slider(0.02, range=0..0.1), Caps=0)

# ---- group: BallustradeBase
number_slider_14 = Slider(0.02, range=0..0.1)
number_slider_15 = Slider(0.4, range=0..1)
dom_3 = ConstructDomain(DomainStart=expr("-X", number_slider_14), DomainEnd=number_slider_14)
dom_4 = ConstructDomain(DomainStart=expr("-X", number_slider_15), DomainEnd=number_slider_15)
bang_4 = ExplodeTree(Data=pframes_3.Frames)  # -> Branch0, Branch1
prot_2 = RotatePlane(Plane=[bang_4.Branch0, bang_4.Branch1], Angle=degrees(Slider(274, range=0..360)))
rectangle_2 = Rectangle(Plane=prot_2, XSize=dom_3, YSize=dom_4, Radius=0)  # -> Rectangle, Length
loft_11 = Loft(
    Curves=rectangle_2.Rectangle,
    Options={Adjust=False, Closed=False, LoftEnds=0, LoftSimp=0, LoftType=0, Rebuild=10, Refit=0.01})

# ---- group: BallustradeHandrail
number_slider_16 = Slider(0.05, range=0..0.1)
number_slider_17 = Slider(0.2, range=0..1)
bang_5 = ExplodeTree(Data=pframes_2.Frames)  # -> Branch0, Branch1
dom_5 = ConstructDomain(DomainStart=expr("-X", number_slider_16), DomainEnd=number_slider_16)
dom_6 = ConstructDomain(DomainStart=expr("-X", number_slider_17), DomainEnd=number_slider_17)
prot_3 = RotatePlane(Plane=[bang_5.Branch0, bang_5.Branch1], Angle=degrees(Slider(280, range=0..360)))
rectangle_3 = Rectangle(Plane=prot_3, XSize=dom_5, YSize=dom_6, Radius=0)  # -> Rectangle, Length
loft_12 = Loft(
    Curves=rectangle_3.Rectangle,
    Options={Adjust=False, Closed=False, LoftEnds=0, LoftSimp=0, LoftType=0, Rebuild=10, Refit=0.01})

# ----
timer = Timer(TimerInterval=20, Target=kangaroo)
Z_20 = UnitZ(Factor=1)
move_10 = Move(Geometry=offset_l_7, Motion=Z_20)  # -> Geometry, Transform
pipe_2 = Pipe(Curve=move_10.Geometry, Radius=Slider(0.1, range=0..1), Caps=0)
pt_4 = Point([Point(-4.417301835, 503.837761, -0.1393173368), Point(-2.283104996, 504.6133776, -1.563511044), Point(-1.997870205, 505.3134703, -1.72370682), Point(-3.918630649, 504.620454, -0.3517689476), Point(-3.471529435, 505.3390096, -0.5224090987), Point(-1.666624098, 505.9641251, -1.863436768)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])
loft_13 = Loft(
    Curves=rectangle.Rectangle,
    Options={Adjust=False, Closed=False, LoftEnds=0, LoftSimp=0, LoftType=0, Rebuild=10, Refit=0.01})
number_slider_18 = Slider(50, range=0..1000)
number_slider_19 = Slider(50, range=0..1000)
number_slider_20 = Slider(50, range=0..1000)
Z_21 = UnitZ(Factor=Slider(110, range=0..600))
cross_sections = CrossSectionsKaramba(
    ElementsIdentifiers="ptension",
    Height_cm=Slider(200, range=0..200),
    UpperFlangeWidth_cm=number_slider_19,
    LowerFlangeWidth_cm=number_slider_19,
    mode="Trapezoid")  # disabled
cross_sections_2 = CrossSectionsKaramba(
    ElementsIdentifiers="brace",
    Height_cm=Slider(100, range=0..100),
    UpperFlangeWidth_cm=number_slider_20,
    LowerFlangeWidth_cm=number_slider_20,
    UpperFlangeThickness_cm=0.4,
    LowerFlangeThickness_cm=0.4,
    SidewallsThickness_cm=0.4,
    FilletRadius_cm=0.6,
    mode="Box")
cross_sections_3 = CrossSectionsKaramba(
    ElementsIdentifiers="spine",
    Height_cm=Slider(100, range=0..200),
    UpperFlangeWidth_cm=number_slider_18,
    LowerFlangeWidth_cm=number_slider_18,
    UpperFlangeThickness_cm=0.4,
    LowerFlangeThickness_cm=0.4,
    SidewallsThickness_cm=0.4,
    FilletRadius_cm=0.6,
    mode="Box")
panel_5 = Panel("Ground Supports")
panel_6 = Panel("Structural Nodes")
Z_22 = UnitZ(Factor=Slider(1, range=0..1))
matselect = MaterialSelectionKaramba(menu=[dropdown(1), dropdown(1)])
loads_2 = LoadsKaramba(Vector=Vector(0, 0, -1), LCase=0, mode="Gravity")
md_slider = MDSlider(
    slider_value=Point(0.1624428354, 1, 0.5),
    SliderMode=0,
    x_domain=Domain(0, 1),
    y_domain=Domain(0, 1),
    z_domain=Domain(0, 1))
number_slider_21 = Slider(5, range=0..10)
number_slider_22 = Slider(5, range=0..10)
number_slider_23 = Slider(0.3, range=0..1)
number_slider_24 = Slider(5, range=0..10)
number_slider_25 = Slider(5, range=0..10)
number_slider_26 = Slider(5, range=0..100)
division = Division(A=number_slider_26, B=2)
number_slider_27 = Slider(0.1, range=0..0.1)
number_slider_28 = Slider(5, range=0..10)
number_slider_29 = Slider(0.1, range=0..1)
Z_23 = UnitZ(Factor=Slider(4, range=0..10))
number_slider_30 = Slider(0.3, range=0..1)
Z_24 = UnitZ(Factor=1)
number_slider_31 = Slider(0.1, range=0..0.1)
number_slider_32 = Slider(8, range=0..10)
number_slider_33 = Slider(11, range=0..100)
number_slider_34 = Slider(0.2, range=0..1)
number_slider_35 = Slider(16, range=0..100)  # disabled
number_slider_36 = Slider(0.1, range=0..0.1)  # disabled
number_slider_37 = Slider(0.02, range=0..1)  # disabled
Z_25 = UnitZ(Factor=Slider(3, range=-5..5))
number_slider_38 = Slider(4, range=0..10)
number_slider_39 = Slider(55, range=0..100)
number_slider_40 = Slider(0.2, range=0..1)

mesh = Mesh(<mesh referenced from the Rhino model>)  # disabled
mesh_2 = Mesh(<mesh referenced from the Rhino model>)  # disabled
number_slider_41 = Slider(0.01, range=0..10)  # disabled
number_slider_42 = Slider(0.01, range=0..10)  # disabled
number_slider_43 = Slider(0.51, range=0..10)  # disabled
number_slider_44 = Slider(1.61, range=0..10)  # disabled
number_slider_45 = Slider(1.61, range=0..10)  # disabled
number_slider_46 = Slider(1.61, range=0..10)  # disabled
number_slider_47 = Slider(11, range=0..100)  # disabled
cross_sections_4 = CrossSectionsKaramba(
    Height_cm=number_slider_10,
    UpperFlangeWidth_cm=number_slider_9,
    LowerFlangeWidth_cm=number_slider_9,
    UpperFlangeThickness_cm=0.4,
    LowerFlangeThickness_cm=0.4,
    SidewallsThickness_cm=0.4,
    FilletRadius_cm=0.6,
    mode="Box")  # disabled
panel_7 = Panel("Ground Supports")  # disabled
panel_8 = Panel("Structural Nodes")  # disabled
number_slider_48 = Slider(100, range=0..1000)  # disabled
matselect_2 = MaterialSelectionKaramba(menu=[dropdown(1), dropdown(1)])  # disabled
Z_26 = UnitZ(Factor=number_slider_48)  # disabled
neg_7 = Negative(Value=Z_26)  # disabled

tri = Triangulate(Mesh=mesh_2)  # -> Mesh, Count; disabled
tri_2 = Triangulate(Mesh=mesh)  # -> Mesh, Count; disabled

medges_2 = MeshEdges(Mesh=tri_2.Mesh)  # -> NakedEdges, InteriorEdges, NonManifoldEdges; disabled
medges_3 = MeshEdges(Mesh=tri.Mesh)  # -> NakedEdges, InteriorEdges, NonManifoldEdges; disabled
line_2 = Line([medges_3.NakedEdges, medges_3.InteriorEdges])  # disabled
line_3 = Line([medges_2.NakedEdges, medges_2.InteriorEdges])  # disabled
disc = Discontinuity(Curve=line_2, Level=1)  # -> Points, Parameters; disabled
disc_2 = Discontinuity(Curve=line_3, Level=1)  # -> Points, Parameters; disabled

item_8 = ListItem(List=flatten(filter), Index=0, Wrap=True)
Z_27 = UnitZ(Factor=Slider(-2, range=-5..1))
Z_28 = UnitZ(Factor=100)
range_3 = Range(Domain=Domain(0, 1), Steps=10)
timer_2 = Timer(TimerInterval=20, Target=kangaroo_3)  # disabled

Z_29 = UnitZ(Factor=Slider(-5, range=-5..1))
Z_30 = UnitZ(Factor=100)
range_4 = Range(Domain=Domain(0, 1), Steps=10)
timer_3 = Timer(TimerInterval=20, Target=kangaroo_2)  # disabled

# ---- group: RotationExtrusion
Z_31 = UnitZ(Factor=Slider(45, range=0..100))
item_9 = ListItem(List=flatten(filter), Index=1, Wrap=True)

# ----
sdivide = DivideSurface(Surface=reparameterize(item_9), UCount=2, VCount=100)  # -> Points, Normals, Parameters
intcrv_6 = Interpolate(Vertices=sdivide.Points, Degree=3, Periodic=False, KnotStyle=1)  # -> flatten(Curve), Length, Domain
item_10 = ListItem(List=intcrv_6.Curve, Index=1, Wrap=True)
ext = ExtendCurve(Curve=item_10, Type=0, Start=5, End=5)
extr = Extrude(Base=ext, Direction=Z)
mesh_3 = MeshBrep(
    Brep=extr,
    Settings={GridMaxCount=0, GridMinCount=16, JaggedSeams=False, MaxEdgeLength=0, MinEdgeLength=0.0001, MinTolerance=0, Refine=True, RefineAngle=0, RelativeTolerance=0.65, SimplePlanes=True, Tolerance=0})
project = Project(Geometry=ext, Plane=PlaneXY(0, 0, 0))  # -> Geometry, Transform
cull_i = CullIndex(List=intcrv_6.Curve, Indices=1, Wrap=True)
item_11 = ListItem(List=reverse(cull_i), Index=0, Wrap=True)
item_12 = ListItem(List=cull_i, Index=0, Wrap=True)
crv_7 = Curve(reverse(cull_i))
crv_8 = Curve(item_10)

number_slider_49 = Slider(100, range=0..100)  # disabled

Z_32 = UnitZ(Factor=1)
move_11 = Move(Geometry=offset_l_7, Motion=Z_32)  # -> Geometry, Transform
bang_6 = ExplodeTree(Data=graft(move_11.Geometry))  # -> Branch0, Branch1
number_slider_50 = Slider(30, range=0..100)
division_2 = Division(A=deckoffset, B=Slider(1, range=0..10))
crv_9 = Curve(shatter)
tweencrv = TweenCurve(CurveA=bang_6.Branch0, CurveB=bang_6.Branch1, Factor=0.5, BlendType=0)
neg_8 = Negative(Value=division_2)
join = JoinCurves(Curves=flatten(crv_9), Preserve=False)
xy_6 = XYPlane(Origin=Point(0, 0, 0))
divide_7 = DivideCurve(Curve=[bang_6.Branch0, bang_6.Branch1], Count=number_slider_50, Kinks=False)  # -> Points, Tangents, Parameters
range_5 = Range(Domain=Domain(0, 1), Steps=10)
range_6 = Range(Domain=Domain(0, 1), Steps=number_slider_50)
offset_l_8 = OffsetLoose(Curve=join, Distance=[division_2, neg_8], Plane=xy_6)
Z_33 = UnitZ(Factor=1)
number_slider_51 = Slider(10, range=0..10)
graph_2 = GraphMapper(range_5, x0=0, x1=1, y0=0, y1=1, container_name="Sine", Equation_px=[0, 0.1695645154], Equation_py=[0.3953623176, 1])
graph_3 = GraphMapper(
    range_6,
    x0=0,
    x1=1,
    y0=0,
    y1=1,
    container_name="Sine",
    Equation_px=[0, 0.2651515007],
    Equation_py=[0.1463769078, 0.4072464705])
move_12 = Move(Geometry=offset_l_8, Motion=Z_33)  # -> Geometry, Transform
divide_8 = DivideCurve(Curve=tweencrv, Count=number_slider_50, Kinks=False)  # -> Points, Tangents, Parameters
Z_34 = UnitZ(Factor=1)
bang_7 = ExplodeTree(Data=divide_7.Points)  # -> Branch0, Branch1
divide_9 = DivideCurve(Curve=move_12.Geometry, Count=number_slider_51, Kinks=False)  # -> Points, Tangents, Parameters
divide_10 = DivideCurve(Curve=join, Count=number_slider_51, Kinks=False)  # -> Points, Tangents, Parameters
Z_35 = UnitZ(Factor=1)
multiplication_2 = Multiplication(A=graph_2, B=Slider(14, range=0..100))
# ORIGINAL CANOPY (OBSOLETE)
multiplication_3 = Multiplication(A=graph_3, B=Slider(26, range=0..100))
amp = Amplitude(Vector=Z_34, Amplitude=multiplication_3)
move_13 = Move(Geometry=divide_8.Points, Motion=amp)  # -> Geometry, Transform
amp_2 = Amplitude(Vector=Z_35, Amplitude=multiplication_2)
move_14 = Move(Geometry=divide_10.Points, Motion=amp_2)  # -> Geometry, Transform
bang_8 = ExplodeTree(Data=simplify(divide_9.Points))  # -> Branch0, Branch1
arc_2 = Arc3Pt(PointA=bang_7.Branch0, PointB=move_13.Geometry, PointC=bang_7.Branch1)  # -> Arc, Plane, Radius
arc_3 = Arc3Pt(PointA=bang_8.Branch0, PointB=move_14.Geometry, PointC=bang_8.Branch1)  # -> Arc, Plane, Radius
reb = RebuildCurve(Curve=arc_2.Arc, Count=10, Tangents=False)
reb_2 = RebuildCurve(Curve=arc_3.Arc, Count=10, Tangents=False)
filter_2 = StreamFilter(Gate=Toggle(False), Stream0=reb, Stream1=reb_2)
loft_14 = Loft(Curves=filter_2, Options={Adjust=False, Closed=False, LoftEnds=0, LoftSimp=0, LoftType=0, Rebuild=10, Refit=0.01})  # -> flatten(Loft)
number_slider_52 = Slider(60, range=0..100)
curvepoint_4 = PointOnCurve(join, parameter=0.5)
number_slider_53 = Slider(292, range=0..1000)
dom_7 = ConstructDomain(DomainStart=expr("-x", number_slider_53), DomainEnd=number_slider_53)
planesrf = PlaneSurface(Plane=curvepoint_4, XSize=dom_7, YSize=dom_7)
m_rhombitrihexagonal = RhombitrihexagonalTiling(S=planesrf, O=0, U=number_slider_52, V=number_slider_52, F=False, T=0.366025, C=Toggle(True))  # -> out, M; inputs S: Surface
# ---------- m_rhombitrihexagonal: VB ----------
    Component.Params.Input(0).Name = "Surface"
    Component.Params.Input(0).Description = "The base surface to mesh"
    Component.Params.Input(1).Name = "Polygon Types"
    Component.Params.Input(1).Description = "0=All, 1=Quad&Tri, 2=Quad Only"
    Component.Params.Input(2).Name = "U Count"
    Component.Params.Input(2).Description = "The number of quads in the U direction"
    Component.Params.Input(3).Name = "V Count"
    Component.Params.Input(3).Description = "The number of quads in the V direction"
    Component.Params.Input(4).Name = "Flip"
    Component.Params.Input(4).Description = "Flips the pattern sequence"
    Component.Params.Input(5).Name = "Evaluate"
    Component.Params.Input(5).Description = "A unitized value which symmetrically shifts the location of internal vertices within each new quad"
    Component.Params.Input(6).Name = "Close Edges"
    Component.Params.Input(6).Description = "If true, additional faces will be added, matching the original surface edge"

    Component.Params.Output(1).Name = "Mesh"
    Component.Params.Output(1).Description = "If successful, the resulting mesh"

    If s IsNot Nothing Then
      Dim i,j,k,x,q As Integer
      Dim ta As Double
      Dim wu,wv As New list(Of Integer)
      Dim bu, bv As Boolean
      Dim cu, cv,au,av,tv As Integer
      Dim arrPts As New list(Of point3d)
      Dim arrFaces As New list(Of MeshFace)
      Dim mo As New mesh
      Dim mv As New list(Of point3d)
      Dim mf As New list(Of meshface)
      Dim uva(,) As Integer
      Dim uvb(,) As Integer
      Dim uvc(,) As Integer
      Dim uvd(,) As Integer

      U += 1
      V += 1
      bu = s.IsClosed(0)
      bv = s.IsClosed(1)

      S.SetDomain(0, New interval(0, 1))
      S.SetDomain(1, New interval(0, 1))

      If (bu And (u Mod 2)) Then
        wu = appendprepend(U)
        cu = u - 1
        au = 1
      Else
        wu = series(U)
        cu = u
        au = 0
      end if

      If (bv And (v Mod 2)) Then
        wv = appendprepend(V)
        cv = v - 1
        av = 1
      Else
        wv = series(V)
        cV = v
        av = 0
      End If

      If F Then tv = 1 Else tv = 0

      ReDim uva(cu, cv)
      ReDim uvb(cu, cv - 1)
      ReDim uvc(cu - 1, cv - 1)
      ReDim uvd(cu - 1, cv - 1)

      ta = 0.5 / (math.cos(((30 / 180) * math.pi)) * 1 + 1.5)

      For i = 0 To cu - 1 Step 1
        q = 0
        For j = ((i + tv) Mod 2) To cv - 1 Step 2
          mv.add(S.PointAt(i * (1 / (U - 1)), j * (1 / (V - 1))))
          uva(i, q) = k
          uva(i, q + 1) = k
          k += 1
          q += 2
        Next
      Next

      For i = 0 To cu - 1 Step 1
        For j = 0 To v - 2 Step 1
          Dim pt(1) As point3d

          pt(0) = S.PointAt(i * (1 / (U - 1)), (j + ta) * (1 / (V - 1)))
          pt(1) = S.PointAt(i * (1 / (U - 1)), (j + 1 - ta) * (1 / (V - 1)))

          mv.add(evalP(pt((i + j + tv) Mod 2), pt((i + j + 1 + tv) Mod 2), t))
          uvb(i, j) = k
          k += 1
        Next
      Next

      For i = 0 To u - 2 Step 1
        For j = 0 To v - 2 Step 1
          Dim pta(1),ptb(1) As point3d

          pta(0) = S.PointAt(i * (1 / (U - 1)), (j + ta) * (1 / (V - 1)))
          pta(1) = S.PointAt((i + 1) * (1 / (U - 1)), (j + ta) * (1 / (V - 1)))
          ptb(0) = S.PointAt(i * (1 / (U - 1)), (j + 1 - ta) * (1 / (V - 1)))
          ptb(1) = S.PointAt((i + 1) * (1 / (U - 1)), (j + 1 - ta) * (1 / (V - 1)))

          mv.add(evalP(pta((i + j + 1 + tv) Mod 2), pta((i + j + tv) Mod 2), t))
          mv.add(evalP(ptb((i + j + tv) Mod 2), ptb((i + j + 1 + tv) Mod 2), t))
          uvc(i, j) = k
          uvd(i, j) = k + 1
          k += 2
        Next
      Next

      For i = 0 To u - 2 Step 1
        For j = 0 To v - 2 Step 1
          mf.add(New MeshFace(uvb(wu(i), j), uvc(i, j), uvb(wu(i + 1), j), uvd(i, j)))
          If (i + j + tv) Mod 2 Then
            If ((j < (v - 2)) And (i < (u - 2))) Then mf.add(New meshface(uvc(i, j + 1), uvd(i, j), uvd(i + 1, j), uvc(i + 1, j + 1)))
          End If
        Next
      Next

      If (O <> 2) Then
        For i = 0 To u - 2 Step 1
          For j = 0 To v - 2 Step 1
            If (i + j + 1 + tv) Mod 2 Then
              If i < (u - 2) Then
                mf.add(New meshface(uvb(wu(i + 1), j), uvc(i, j), uvc(i + 1, j)))
              End If
            Else
              If i < (u - 2) Then
                mf.add(New meshface(uvd(i, j), uvb(wu(i + 1), j), uvd(i + 1, j)))
              End If
            End If
          Next
        Next
      End If

      If ((O <> 1) And (O <> 2)) Then
        For i = 0 To u - 2 Step 1
          For j = 0 To v - 2 Step 1
            If (i + j + 1 + tv) Mod 2 Then
              If j < (v - 2) Then
                mf.add(New meshface(uvd(i, j), uva(wu(i + 1), wv(j + 1)), uvc(i, j + 1)))
              End If
              mf.add(New meshface(uvd(i, j), uvb(wu(i + 1), j), uva(wu(i + 1), wv(j + 1))))
              mf.add(New meshface(uvc(i, j), uvb(wu(i), j), uva(i, wv(j))))
            Else
              If j < (v - 2) Then
                mf.add(New meshface(uvd(i, j), uvc(i, j + 1), uva(i, wv(j + 1))))
              End If
              mf.add(New meshface(uvb(wu(i), j), uvd(i, j), uva(i, wv(j + 1))))
              mf.add(New meshface(uvb(wu(i + 1), j), uvc(i, j), uva(wu(i + 1), wv(j))))
            End If
          Next
        Next
      End If

      k = mv.count()
      If c Then
        Dim tk(3) As Integer

        If ((bu = False) Or ((u + 1) Mod 2)) Then
          If f Then x = 1 Else x = 0

          For j = x To v - 2 Step  2
            mv.add(S.PointAt(0, (j + 1 - ta) * (1 / (V - 1))))
            mf.add(New meshface(uvb(0, wv(j)), uvd(0, wv(j)), k))
            K += 1
            If j < v - 2 Then
              mv.add(S.PointAt(0, (j + 1 + ta) * (1 / (V - 1))))
              mf.add(New meshface(uvd(0, wv(j)), uvc(0, wv(j + 1)), k, k - 1))
              mf.add(New meshface(uvc(0, wv(j + 1)), uvb(0, wv(j + 1)), k))
              K += 1
            End If
          Next
          tk(1) = k - 1

          If ((f And (u Mod 2)) Or ((f = False) And ((u + 1) Mod 2))) Then x = 1 Else x = 0

          For j = x To v - 2 Step  2
            mv.add(S.PointAt(1, (j + 1 - ta) * (1 / (V - 1))))
            mf.add(New meshface(uvd(wu(u - 2), wv(j)), uvb(wu(u - 1), wv(j)), k))
            K += 1
            If j < v - 2 Then
              mv.add(S.PointAt(1, (j + 1 + ta) * (1 / (V - 1))))
              mf.add(New meshface(uvc(wu(u - 2), wv(j + 1)), uvd(wu(u - 2), wv(j)), k - 1, k))
              mf.add(New meshface(uvc(wu(u - 2), wv(j + 1)), k, uvb(wu(u - 1), wv(j + 1))))
              K += 1
            End If
          Next
          tk(3) = k - 1
        ElseIf u Mod 2 Then
          If f Then x = 1 Else x = 0
          For j = x To v - 2 Step  2
            mf.add(New meshface(uvd(wu(u - 2), wv(j)), uvb(wu(0), wv(j)), uvd(wu(0), wv(j))))
            If j < v - 2 Then
              mf.add(New meshface(uvd(wu(u - 2), wv(j)), uvd(wu(0), wv(j)), uvc(wu(0), wv(j + 1)), uvc(wu(u - 2), wv(j + 1))))
              mf.add(New meshface(uvc(wu(0), wv(j + 1)), uvb(wu(0), wv(j + 1)), uvc(wu(u - 2), wv(j + 1))))
            End If
          Next
        End If

        If ((bv = False) Or ((v + 1) Mod 2)) Then
          If f Then x = 1 Else x = 0

          For i = x To u - 2 Step  2
            mv.add(s.PointAt(i * (1 / (U - 1)) + (1 / (U - 1)) * (1 - t), 0))
            mf.add(New meshface(uva(wu(i), 0), k, uvc(wu(i), 0)))
            K += 1
            If i < u - 2 Then
              mv.add(s.PointAt((i + 2) * (1 / (U - 1)) - (1 / (U - 1)) * (1 - t), 0))
              mf.add(New meshface(uvc(wu(i + 1), 0), uvc(wu(i), 0), k - 1, k))
              mf.add(New meshface(uva(wu(i + 2), 0), uvc(wu(i + 1), 0), k))
              K += 1
            End If
          Next
          tk(0) = k - 1

          If ((f And (v Mod 2)) Or ((f = False) And ((v + 1) Mod 2))) Then x = 1 Else x = 0

          For i = x To u - 2 Step  2
            mv.add(s.PointAt(i * (1 / (U - 1)) + (1 / (U - 1)) * (1 - t), 1))
            mf.add(New meshface(uva(wu(i), wv(v - 1)), uvd(wu(i), wv(v - 2)), k))
            K += 1
            If i < u - 2 Then
              mv.add(s.PointAt((i + 2) * (1 / (U - 1)) - (1 / (U - 1)) * (1 - t), 1))
              mf.add(New meshface(uvd(wu(i), wv(v - 2)), uvd(wu(i + 1), wv(v - 2)), k, k - 1))
              mf.add(New meshface(uvd(wu(i + 1), wv(v - 2)), uva(wu(i + 2), wv(v - 1)), k))
              K += 1
            End If
          Next
          tk(2) = k - 1
        ElseIf v Mod 2 Then
          If f Then x = 1 Else x = 0
          For i = x To u - 2 Step  2
            mf.add(New meshface(uvc(wu(i), wv(0)), uva(wu(i), wv(0)), uvd(wu(i), wv(v - 2))))
            If i < u - 2 Then
              mf.add(New meshface(uvc(wu(i), wv(0)), uvd(wu(i), wv(v - 2)), uvd(wu(i + 1), wv(v - 2)), uvc(wu(i + 1), wv(0))))
              mf.add(New meshface(uvd(wu(i + 1), wv(v - 2)), uva(wu(i + 2), wv(0)), uvc(wu(i + 1), wv(0))))
            End If
          Next
        End If

        If f Then
          If (bv And (v Mod 2)) Then
            mv.add(S.PointAt(0, (1 / (V - 1)) * ta))
            If bu = False Then
              mf.add(New meshface(k, uvc(0, 0), uvd(0, wv(v - 2)), tk(1)))
              mf.add(New meshface(k, uvc(0, 0), uvb(0, 0)))
            End If
            mf.add(New meshface(uvc(0, 0), uvd(0, wv(v - 2)), uva(1, 0)))
            k += 1
          ElseIf  (bu And (u Mod 2)) Then
            mv.add(S.PointAt((1 / (U - 1)) * t, 0))
            mf.add(New meshface(k, uvc(0, 0), uva(1, 0)))
            mf.add(New meshface(k, uvc(0, 0), uvc(wu(u - 2), wv(0)), tk(0)))
            mf.add(New meshface(uvc(0, 0), uvc(wu(u - 2), wv(0)), uvb(0, 0)))
            k += 1
          Else
            mv.add(S.PointAt(0, (1 / (V - 1)) * ta))
            mv.add(s.PointAt(0, 0))
            mv.add(S.PointAt((1 / (U - 1)) * t, 0))
            mf.add(New meshface(k, uvc(0, 0), uvb(0, 0)))
            mf.add(New meshface(k, k + 1, k + 2, uvc(0, 0)))
            mf.add(New meshface(k + 2, uva(wu(1), 0), uvc(0, 0)))
            k += 3
          End If
        End If

        If (((f = False) And ((u + v) Mod 2)) Or (f And ((u + v + 1) Mod 2))) Then
          If (bv And (v Mod 2)) Then
          ElseIf  (bu And (u Mod 2)) Then
          Else
            mv.add(s.PointAt(1, 1))
            mf.add(New meshface(k, tk(2), uvd(wu(u - 2), wv(v - 2)), tk(3)))
            k += 1
          End If
        End If

        If ((f And (v Mod 2)) Or ((f = False) And ((v + 1) Mod 2))) Then
          If (bv And (v Mod 2)) Then
            If (((u + 1) Mod 2) And bu ) Then
              mv.add(S.PointAt(1, (1 / (V - 1)) * ta))
              mf.add(New meshface(uvc(wu(0), wv(v - 1)), k, tk(1), uvd(0, wv(v - 2))))
              mf.add(New meshface(k, uvc(wu(0), wv(v - 1)), uvb(wu(0), wv(v - 1))))
              k += 1
            End If
          ElseIf  (bu And (u Mod 2)) Then
            mv.add(s.PointAt((1 / (U - 1)) * t, 1))
            mf.add(New meshface(uva(wu(1), wv(v - 1)), k, uvd(0, wv(v - 2))))
            mf.add(New meshface(tk(2), k, uvd(0, wv(v - 2)), uvd(wu(u - 2), wv(v - 2))))
            k += 1
          Else
            mv.add(s.PointAt((1 / (U - 1)) * t, 1))
            mv.add(s.PointAt(0, 1))
            mf.add(New meshface(uva(1, wv(v - 1)), k, uvd(0, wv(v - 2))))
            mf.add(New meshface(k + 1, tk(1), uvd(0, wv(v - 2)), k))
            k += 2
          End If
        End If

        If ((f And (u Mod 2)) Or ((f = False) And ((u + 1) Mod 2))) Then
          If (bv And (bu = False) And (v Mod 2)) Then
            mv.add(S.PointAt(1, (1 / (V - 1)) * ta))
            mf.add(New meshface(uvc(wu(u - 2), 0), k, uvb(wu(u - 1), 0)))
            mf.add(New meshface(uvc(wu(u - 2), 0), k, tk(3), uvd(wu(u - 2), wv(v - 2))))
            k += 1
          ElseIf  (bu And (u Mod 2)) Then
          Else
            mv.add(S.PointAt(1, (1 / (V - 1)) * ta))
            mv.add(s.PointAt(1, 0))
            mf.add(New meshface(uvc(wu(u - 2), 0), k, uvb(wu(u - 1), 0)))
            If (bv And (v Mod 2)) Then
              mf.add(New meshface(k, uvc(wu(u - 2), 0), uvd(wu(u - 2), wv(v - 2)), tk(3)))
            ElseIf ((v + 1) Mod 2) Then
              mf.add(New meshface(tk(0), k + 1, k, uvc(wu(u - 2), 0)))
            Else
              mf.add(New meshface(tk(0), k + 1, k, uvc(wu(u - 2), 0)))
            End If
            k += 2
          End If
        End If

        If (f And bu And bv And (u Mod 2) And (v Mod 2)) Then
          mf.add(New meshface(uvc(wu(u - 2), 0), uvc(wu(0), wv(0)), uvb(0, 0)))
          mf.add(New meshface(uvc(wu(0), wv(0)), uvc(wu(u - 2), 0), uvd(wu(u - 2), wv(v - 2)), uvd(0, wv(v - 2))))
        End If
      End If

      mo.Vertices.AddVertices(mv.toarray())
      mo.Faces.AddFaces(mf.toarray())
      mo.FaceNormals.ComputeFaceNormals()
      mo.Normals.ComputeNormals()
      
      M = mo
    End If
# ---------- m_rhombitrihexagonal: VB additional code ----------
  Private Function appendprepend(ByVal i As Integer)
    Dim srsEnum As IEnumerable(Of Integer) = Enumerable.Range(0, i - 1)
    Dim arrVal As New list(Of Integer)
    arrVal = srsEnum.tolist()
    arrVal.add(0)
    Return arrVal
  End Function

  Private Function series(ByVal i As Integer)
    Dim srsEnum As IEnumerable(Of Integer) = Enumerable.Range(0, i)
    Dim arrVal As New list(Of Integer)
    arrVal = srsEnum.tolist()
    Return arrVal
  End Function

  Private Function evalP(ByVal op As point3d, ByVal tp As Point3d, ByVal t As Double)
    Return New point3d(op + (tp - op) * t)
  End Function
# ---------- end m_rhombitrihexagonal ----------
medges_4 = MeshEdges(Mesh=m_rhombitrihexagonal.M)  # -> NakedEdges, InteriorEdges, NonManifoldEdges
move_15 = Move(Geometry=[medges_4.NakedEdges, medges_4.InteriorEdges], Motion=Vector(0, 0, 10))  # -> Geometry, Transform

# ---- group: Center Line
crv_10 = Curve(tweencrv)

# ----
divide_11 = DivideCurve(Curve=crv_10, Count=Slider(12, range=0..100), Kinks=False)  # -> Points, Tangents, Parameters
item_13 = ListItem(List=divide_11.Points, Index=panel_3, Wrap=True)
line_4 = LineSDL(Start=item_13, Direction=neg, Length=Slider(26, range=0..100))
end_2 = EndPoints(Curve=line_4)  # -> Start, End
circle = CircleCNR(Center=end_2.End, Normal=Vector(0, 0, 1), Radius=Slider(5, range=0..10))
crv_11 = Curve(circle)
bang_9 = ExplodeTree(Data=simplify(graft(crv_11)))  # -> Branch0, Branch1
area = Area(Geometry=crv_11)  # -> Area, Centroid
divide_12 = DivideCurve(Curve=crv_10, Count=supportpoints, Kinks=False)  # -> Points, Tangents, Parameters
item_14 = ListItem(List=circle, Index=Slider(1, range=0..1), Wrap=True)
line_5 = LineSDL(Start=divide_12.Points, Direction=neg_2, Length=supportlengths)
extr_2 = Extrude(Base=item_14, Direction=Z_13)
end_3 = EndPoints(Curve=line_5)  # -> Start, End
area_2 = Area(Geometry=item_14)  # -> Area, Centroid
item_15 = ListItem(List=end_3.End, Index=panel_4, Wrap=True)
item_16 = ListItem(List=end_3.End, Index=2, Wrap=True)
circle_2 = CircleCNR(Center=item_15, Normal=Vector(0, 0, 1), Radius=suppcircrad)
item_17 = ListItem(List=circle_2, Index=2, Wrap=True)
extr_3 = Extrude(Base=item_17, Direction=Z_12)
circle_3 = Circle(flatten([circle_2, item_14]))
project_2 = Project(Geometry=circle_3, Plane=area_2.Centroid)  # -> Geometry, Transform
darc = DeconstructArc(Arc=project_2.Geometry)  # -> BasePlane, Radius, Angle

# ---- group: RotationExtrusion (continued)
circle_4 = CircleCNR(Center=item_16, Normal=Vector(0, 0, 1), Radius=expr("x/2-1.5", len))
extr_4 = Extrude(Base=circle_4, Direction=Z_31)
split = SplitBrep(Brep=item_9, Cutter=extr_4)  # -> simplify(graft(Result))
bang_10 = ExplodeTree(Data=split)  # -> Branch0, Branch1, Branch2
srf = Surface(bang_10.Branch2)
srf_2 = Surface(bang_10.Branch1)

# ----
join_2 = BrepJoin(Breps=flatten(srf_2))  # -> Breps, Closed
edges = BrepEdges(Brep=join_2.Breps)  # -> Naked, Interior, NonManifold
join_3 = JoinCurves(Curves=edges.Naked, Preserve=False)
disc_3 = Discontinuity(Curve=join_3, Level=1)  # -> Points, Parameters
srf_3 = Surface(bang_10.Branch0)
shatter_4 = Shatter(Curve=join_3, Parameters=disc_3.Parameters)

join_4 = BrepJoin(Breps=flatten(srf_2))  # -> Breps, Closed
edges_2 = BrepEdges(Brep=join_4.Breps)  # -> Naked, Interior, NonManifold
join_5 = JoinCurves(Curves=edges_2.Naked, Preserve=False)
disc_4 = Discontinuity(Curve=join_5, Level=1)  # -> Points, Parameters

join_6 = BrepJoin(Breps=flatten(srf))  # -> Breps, Closed
edges_3 = BrepEdges(Brep=join_6.Breps)  # -> Naked, Interior, NonManifold
join_7 = JoinCurves(Curves=edges_3.Naked, Preserve=False)
shatter_5 = Shatter(Curve=join_5, Parameters=disc_4.Parameters)
disc_5 = Discontinuity(Curve=join_7, Level=1)  # -> Points, Parameters
shatter_6 = Shatter(Curve=join_7, Parameters=disc_5.Parameters)
item_18 = ListItem(List=shatter_6, Index=[0, 2], Wrap=True)
eval = EvaluateLength(Curve=item_18, Length=0, Normalized=True)  # -> Point, Tangent, Parameter
eval_2 = EvaluateLength(Curve=item_18, Length=0.5, Normalized=True)  # -> Point, Tangent, Parameter
eval_3 = EvaluateLength(Curve=item_18, Length=1, Normalized=True)  # -> Point, Tangent, Parameter
item_19 = ListItem(List=shatter_6, Index=[1, 3], Wrap=True)
move_16 = Move(Geometry=eval_2.Point, Motion=Z_7)  # -> Geometry, Transform
arc_4 = Arc3Pt(PointA=eval.Point, PointB=move_16.Geometry, PointC=eval_3.Point)  # -> Arc, Plane, Radius
dispatch_3 = Dispatch(List=item_19, DispatchPattern=[True, False])  # -> ListA, ListB
dispatch_4 = Dispatch(List=arc_4.Arc, DispatchPattern=[True, False])  # -> ListA, ListB
edgesrf = EdgeSurface(CurveA=dispatch_4.ListA, CurveB=dispatch_3.ListA, CurveC=dispatch_4.ListB, CurveD=dispatch_3.ListB)
split_2 = SplitBrep(Brep=edgesrf, Cutter=extr_3)
item_20 = ListItem(List=split_2, Index=Slider(1, range=0..1), Wrap=True)
split_3 = SplitBrep(Brep=item_20, Cutter=extr_2)
item_21 = ListItem(List=split_3, Index=Slider(1, range=0..1), Wrap=True)
mesh_4 = MeshBrep(
    Brep=item_21,
    Settings={GridMaxCount=0, GridMinCount=16, JaggedSeams=False, MaxEdgeLength=0, MinEdgeLength=0.0001, MinTolerance=0, Refine=True, RefineAngle=0, RelativeTolerance=0.65, SimplePlanes=True, Tolerance=0})
medges_5 = MeshEdges(Mesh=mesh_4)  # -> NakedEdges, InteriorEdges, NonManifoldEdges
join_8 = JoinCurves(Curves=medges_5.NakedEdges, Preserve=False)
item_22 = ListItem(List=reverse(join_8), Index=[Slider(0, range=0..100), Slider(1, range=0..1)], Wrap=True)
project_3 = Project(Geometry=item_22, Plane=area_2.Centroid)  # -> Geometry, Transform
tweencrv_2 = TweenCurve(CurveA=graft(item_22), CurveB=graft(project_3.Geometry), Factor=range_2, BlendType=0)
shift = ShiftList(List=tweencrv_2, Shift=-1, Wrap=False)  # -> graft(List)
shift_2 = ShiftList(List=tweencrv_2, Shift=1, Wrap=False)  # -> graft(List)
loft_15 = Loft(
    Curves=[shift, shift_2],
    Options={Adjust=False, Closed=False, LoftEnds=0, LoftSimp=0, LoftType=0, Rebuild=10, Refit=0.01})
debrep = DeconstructBrep(Brep=loft_15)  # -> flatten(Faces), Edges, Vertices
smesh = SimpleMesh(Brep=debrep.Faces)
mjoin_3 = MeshJoin(Meshes=flatten([smesh, mesh_4]))
weldvertices_3 = MeshWeldVertices(Mesh=mjoin_3, Tolerance=0.01)  # -> RuntimeMessage, Mesh
unifynormals_3 = MeshUnifyNormals(Mesh=weldvertices_3.Mesh)
demesh = DeconstructMesh(Mesh=unifynormals_3)  # -> Vertices, Faces, Colours, Normals
nv = NakedVertices(Mesh=unifynormals_3)  # -> ClothedIndex, NakedIndex, ClothedPts, NakedPts
item_23 = ListItem(List=demesh.Vertices, Index=nv.NakedIndex, Wrap=True)
item_24 = ListItem(List=demesh.Vertices, Index=nv.ClothedIndex, Wrap=True)
medges_6 = MeshEdges(Mesh=unifynormals_3)  # -> NakedEdges, InteriorEdges, NonManifoldEdges
panel_9 = Panel(nv.ClothedIndex)
crv_12 = Curve([medges_6.NakedEdges, medges_6.InteriorEdges])
springs = SpringsFromLine(Connection=crv_12, Stiffness=Slider(1, range=0..1), Damping=10, RestLength=0, UpperCutoff=0, LowerCutoff=0, Plasticity=0)
kangaroo = KangarooPhysics(ForceObjects=flatten(springs), AnchorPoints=item_23, Settings=null, Geometry=item_24, SimulationReset=Toggle(False))  # -> Out, Iterations, ParticlesOut, GeometryOut, KE

# ---- group: CuttingCylinder
brep = Brep(extr_4)

# ----
nv_2 = NakedVertices(Mesh=unifynormals_3)  # -> ClothedIndex, NakedIndex, ClothedPts, NakedPts
pt_5 = Point(item_23)
merge = Merge(Data1=pt_4, Data2=pt_5)
merge_2 = Merge(Data1=nv.ClothedIndex, Data2=nv.NakedIndex)
sort = SortList(Keys=merge_2, ValuesA=merge)  # -> Keys, ValuesA

# ---- group: Balustrades
split_4 = SplitBrep(Brep=loft_11, Cutter=brep)
split_5 = SplitBrep(Brep=pipe, Cutter=brep)
split_6 = SplitBrep(Brep=pipe_2, Cutter=brep)
split_7 = SplitBrep(Brep=loft_12, Cutter=brep)

# ----
conmesh = ConstructMesh(Vertices=sort.ValuesA, Faces=demesh.Faces)
gate = StreamGate(Stream=conmesh, Gate=Toggle(True))  # -> Target0, Target1
panel_10 = Panel(sort.ValuesA)

split_8 = SplitBrep(Brep=loft_14, Cutter=extr_4)
bang_11 = ExplodeTree(Data=simplify(graft(split_8)))  # -> Branch0, Branch1, Branch2
srf_4 = Surface(bang_11.Branch0)
debrep_2 = DeconstructBrep(Brep=split_8)  # -> Faces, simplify(Edges), Vertices
srf_5 = Surface(bang_11.Branch1)
bang_12 = ExplodeTree(Data=debrep_2.Edges)  # -> Branch0, Branch1, Branch2
srf_6 = Surface(bang_11.Branch2)
dispatch_5 = Dispatch(List=bang_12.Branch1, DispatchPattern=[True, True, False, False])  # -> ListA, ListB
dispatch_6 = Dispatch(List=bang_12.Branch0, DispatchPattern=[True, True, False, False])  # -> ListA, ListB
dispatch_7 = Dispatch(List=bang_12.Branch2, DispatchPattern=[False, True, True, False])  # -> ListA, ListB
project_4 = Project(Curve=flatten(move_15.Geometry), Brep=graft(split_8), Direction=Vector(0, 0, 1))  # -> simplify(Curve)
trim_9 = TrimTree(Tree=project_4, Depth=1)
offset = Offset(Surface=split_8, Distance=expr("-x", Slider(0.2, range=0..1)), Retrim=True)

edges_4 = BrepEdges(Brep=split_8)  # -> Naked, Interior, NonManifold
len_2 = Length(Curve=edges_4.Naked)  # -> flatten(Length)
smaller = SmallerThan(FirstNumber=len_2, SecondNumber=Slider(35, range=0..100))  # -> SmallerThan, OrEqualTo
cull = CullPattern(List=flatten(edges_4.Naked), CullPattern=smaller.SmallerThan)

# ---- group: DeckExtrusion
bang_13 = ExplodeTree(Data=simplify(graft(shatter_5)))  # -> Branch0, Branch1, Branch2, Branch3
bang_14 = ExplodeTree(Data=simplify(graft(shatter_6)))  # -> Branch0, Branch1, Branch2, Branch3
srf_7 = Surface(srf_3)
edgesrf_2 = EdgeSurface(CurveA=bang_13.Branch0, CurveB=bang_13.Branch1, CurveC=bang_13.Branch2, CurveD=bang_13.Branch3)
edgesrf_3 = EdgeSurface(CurveA=bang_14.Branch0, CurveB=bang_14.Branch1, CurveC=bang_14.Branch2, CurveD=bang_14.Branch3)

# ----
crv_13 = Curve(tweencrv)
bcx = BrepCurve(Brep=brep, Curve=crv_13)  # -> Curves, Points
crv_cp = CurveClosestPoint(Point=bcx.Points, Curve=crv_13)  # -> Point, Parameter, Distance
shatter_7 = Shatter(Curve=crv_13, Parameters=crv_cp.Parameter)
Z_36 = UnitZ(Factor=Slider(1, range=0..1))
move_17 = Move(Geometry=edgesrf_2, Motion=Z_36)  # -> Geometry, Transform
Z_37 = UnitZ(Factor=Slider(1, range=0..1))
move_18 = Move(Geometry=edgesrf_3, Motion=Z_37)  # -> Geometry, Transform
item_25 = ListItem(List=shatter_7, Index=Slider(1, range=0..10), Wrap=True)
edges_5 = BrepEdges(Brep=move_17.Geometry)  # -> Naked, Interior, NonManifold
edges_6 = BrepEdges(Brep=move_18.Geometry)  # -> Naked, Interior, NonManifold
number_slider_54 = Slider(3, range=0..10)
curvepoint_5 = PointOnCurve(item_25, parameter=0.8)
curvepoint_6 = PointOnCurve(item_25, parameter=0.2)
len_3 = Length(Curve=edges_5.Naked)
len_4 = Length(Curve=edges_6.Naked)
# GARDEN BEDS (OBSOLETE)
number_slider_55 = Slider(1, range=0..1)
larger = LargerThan(FirstNumber=len_3, SecondNumber=Slider(40, range=0..100))  # -> LargerThan, OrEqualTo
larger_2 = LargerThan(FirstNumber=len_4, SecondNumber=Slider(40, range=0..100))  # -> LargerThan, OrEqualTo
crv_cp_2 = CurveClosestPoint(Point=[curvepoint_5, curvepoint_6], Curve=item_25)  # -> Point, Parameter, Distance
shatter_8 = Shatter(Curve=item_25, Parameters=crv_cp_2.Parameter)
cull_2 = CullPattern(List=edges_5.Naked, CullPattern=larger.LargerThan)
cull_3 = CullPattern(List=edges_6.Naked, CullPattern=larger_2.LargerThan)
item_26 = ListItem(List=shatter_8, Index=number_slider_55, Wrap=True)
number_slider_56 = Slider(20, range=0..100)
range_7 = Range(Domain=Domain(0, 1), Steps=number_slider_56)
number_slider_57 = Slider(20, range=0..100)
range_8 = Range(Domain=Domain(0, 1), Steps=number_slider_57)
number_slider_58 = Slider(20, range=0..100)
range_9 = Range(Domain=Domain(0, 1), Steps=number_slider_58)
item_27 = ListItem(List=cull_2, Index=1, Wrap=True)
item_28 = ListItem(List=cull_3, Index=1, Wrap=True)
graph_4 = GraphMapper(range_7, x0=0, x1=1, y0=0, y1=1, container_name="Sine", Equation_px=[0, 0.5012773275], Equation_py=[0, 1])
graph_5 = GraphMapper(range_8, x0=0, x1=1, y0=0, y1=1, container_name="Sine", Equation_px=[0, 0.5012773275], Equation_py=[0, 1])
graph_6 = GraphMapper(range_9, x0=0, x1=1, y0=0, y1=1, container_name="Sine", Equation_px=[0, 0.5012773275], Equation_py=[0, 1])
number_slider_59 = Slider(90, range=0..100)
divide_13 = DivideCurve(Curve=item_26, Count=number_slider_56, Kinks=False)  # -> Points, Tangents, Parameters
divide_14 = DivideCurve(Curve=item_27, Count=number_slider_57, Kinks=False)  # -> Points, Tangents, Parameters
divide_15 = DivideCurve(Curve=item_28, Count=number_slider_58, Kinks=False)  # -> Points, Tangents, Parameters
line_6 = LineSDL(Start=divide_13.Points, Direction=Vector(0, 0, 1), Length=1)
line_7 = LineSDL(Start=divide_14.Points, Direction=Vector(0, 0, 1), Length=1)
line_8 = LineSDL(Start=divide_15.Points, Direction=Vector(0, 0, 1), Length=1)
vrot = Rotate(Vector=divide_14.Tangents, Axis=line_7, Angle=expr("-x", degrees(Slider(90, range=0..100))))
vrot_2 = Rotate(Vector=divide_15.Tangents, Axis=line_8, Angle=expr("-x", degrees(number_slider_59)))
vrot_3 = Rotate(Vector=divide_13.Tangents, Axis=line_6, Angle=expr("-x", degrees(number_slider_59)))
vrot_4 = Rotate(Vector=divide_13.Tangents, Axis=line_6, Angle=degrees(number_slider_59))
multiplication_4 = Multiplication(A=graph_4, B=Slider(5, range=0..10))
amp_3 = Amplitude(Vector=vrot_4, Amplitude=multiplication_4)
multiplication_5 = Multiplication(A=graph_5, B=Slider(10, range=0..10))
amp_4 = Amplitude(Vector=vrot, Amplitude=multiplication_5)
move_19 = Move(Geometry=divide_14.Points, Motion=amp_4)  # -> Geometry, Transform
multiplication_6 = Multiplication(A=graph_6, B=Slider(10, range=0..10))
amp_5 = Amplitude(Vector=vrot_2, Amplitude=multiplication_6)
move_20 = Move(Geometry=divide_15.Points, Motion=amp_5)  # -> Geometry, Transform
move_21 = Move(Geometry=divide_13.Points, Motion=amp_3)  # -> Geometry, Transform
amp_6 = Amplitude(Vector=vrot_3, Amplitude=multiplication_4)
move_22 = Move(Geometry=divide_13.Points, Motion=amp_6)  # -> Geometry, Transform
intcrv_7 = Interpolate(Vertices=move_21.Geometry, Degree=3, Periodic=False, KnotStyle=1)  # -> Curve, Length, Domain
intcrv_8 = Interpolate(Vertices=move_19.Geometry, Degree=3, Periodic=False, KnotStyle=1)  # -> Curve, Length, Domain
intcrv_9 = Interpolate(Vertices=move_20.Geometry, Degree=3, Periodic=False, KnotStyle=1)  # -> Curve, Length, Domain
xy_7 = XYPlane(Origin=Point(0, 0, 0))
offset_l_9 = OffsetLoose(Curve=intcrv_7.Curve, Distance=expr("-x", Slider(1, range=0..1)), Plane=xy_7)
xy_8 = XYPlane(Origin=Point(0, 0, 0))
offset_l_10 = OffsetLoose(Curve=intcrv_8.Curve, Distance=expr("-x", Slider(1, range=0..1)), Plane=xy_8)
xy_9 = XYPlane(Origin=Point(0, 0, 0))
offset_l_11 = OffsetLoose(Curve=intcrv_9.Curve, Distance=expr("-x", Slider(1, range=0..1)), Plane=xy_9)
intcrv_10 = Interpolate(Vertices=move_22.Geometry, Degree=3, Periodic=False, KnotStyle=1)  # -> Curve, Length, Domain
project_5 = Project(Curve=[intcrv_7.Curve, offset_l_9], Brep=srf_7, Direction=Vector(0, 0, 1))
project_6 = Project(Curve=[intcrv_8.Curve, offset_l_10], Brep=edgesrf_2, Direction=Vector(0, 0, 1))
project_7 = Project(Curve=[intcrv_9.Curve, offset_l_11], Brep=edgesrf_3, Direction=Vector(0, 0, 1))
xy_10 = XYPlane(Origin=Point(0, 0, 0))
offset_l_12 = OffsetLoose(Curve=intcrv_10.Curve, Distance=expr("-x", Slider(1, range=0..1)), Plane=xy_10)
Z_38 = UnitZ(Factor=Slider(1, range=0..1))
move_23 = Move(Geometry=project_5, Motion=Z_38)  # -> Geometry, Transform
Z_39 = UnitZ(Factor=Slider(1, range=0..1))
move_24 = Move(Geometry=project_6, Motion=Z_39)  # -> Geometry, Transform
Z_40 = UnitZ(Factor=Slider(1, range=0..1))
move_25 = Move(Geometry=project_7, Motion=Z_40)  # -> Geometry, Transform
project_8 = Project(Curve=[intcrv_10.Curve, offset_l_12], Brep=srf_7, Direction=Vector(0, 0, 1))
loft_16 = Loft(
    Curves=flatten(move_23.Geometry),
    Options={Adjust=False, Closed=False, LoftEnds=0, LoftSimp=0, LoftType=0, Rebuild=10, Refit=0.01})
loft_17 = Loft(
    Curves=flatten(move_24.Geometry),
    Options={Adjust=False, Closed=False, LoftEnds=0, LoftSimp=0, LoftType=0, Rebuild=10, Refit=0.01})
loft_18 = Loft(
    Curves=flatten(move_25.Geometry),
    Options={Adjust=False, Closed=False, LoftEnds=0, LoftSimp=0, LoftType=0, Rebuild=10, Refit=0.01})
Z_41 = UnitZ(Factor=Slider(1, range=0..1))
move_26 = Move(Geometry=project_8, Motion=Z_41)  # -> Geometry, Transform
Z_42 = UnitZ(Factor=1)
extr_5 = Extrude(Base=loft_16, Direction=Z_42)
Z_43 = UnitZ(Factor=1)
extr_6 = Extrude(Base=loft_17, Direction=Z_43)
Z_44 = UnitZ(Factor=1)
extr_7 = Extrude(Base=loft_18, Direction=Z_44)
loft_19 = Loft(
    Curves=flatten(move_26.Geometry),
    Options={Adjust=False, Closed=False, LoftEnds=0, LoftSimp=0, LoftType=0, Rebuild=10, Refit=0.01})
Z_45 = UnitZ(Factor=1)
extr_8 = Extrude(Base=loft_19, Direction=Z_45)

# ---- group: DeckExtrusion / Deck
Z_46 = UnitZ(Factor=1)
extr_9 = Extrude(Base=flatten([edgesrf_2, edgesrf_3, srf_7]), Direction=Z_46)

# ---- group: Canopy
number_slider_60 = Slider(0.1, range=0..1)
number_slider_61 = Slider(1, range=0..10)
pipe_3 = Pipe(Curve=[dispatch_6.ListA, dispatch_5.ListA, dispatch_7.ListA], Radius=Slider(0.1, range=0..0.1), Caps=0)

# ----
move_27 = Move(Geometry=srf_7, Motion=Z_22)  # -> Geometry, Transform
edges_7 = BrepEdges(Brep=edgesrf_2)  # -> Naked, Interior, NonManifold
edges_8 = BrepEdges(Brep=edgesrf_2)  # -> Naked, Interior, NonManifold
item_29 = ListItem(List=edges_7.Naked, Index=Slider(1, range=0..10), Wrap=True)
item_30 = ListItem(List=edges_8.Naked, Index=Slider(3, range=0..10), Wrap=True)
edges_9 = BrepEdges(Brep=edgesrf_3)  # -> Naked, Interior, NonManifold
edges_10 = BrepEdges(Brep=edgesrf_3)  # -> Naked, Interior, NonManifold

edges_11 = BrepEdges(Brep=srf_7)  # -> Naked, Interior, NonManifold
len_5 = Length(Curve=edges_11.Naked)
larger_3 = LargerThan(FirstNumber=len_5, SecondNumber=Slider(30, range=0..100))  # -> LargerThan, OrEqualTo
cull_4 = CullPattern(List=edges_11.Naked, CullPattern=larger_3.LargerThan)
bang_15 = ExplodeTree(Data=simplify(graft(cull_4)))  # -> Branch0, Branch1

item_31 = ListItem(List=edges_9.Naked, Index=Slider(3, range=0..10), Wrap=True)

edges_12 = BrepEdges(Brep=move_27.Geometry)  # -> Naked, Interior, NonManifold
len_6 = Length(Curve=edges_12.Naked)
larger_4 = LargerThan(FirstNumber=len_6, SecondNumber=Slider(30, range=0..100))  # -> LargerThan, OrEqualTo
cull_5 = CullPattern(List=edges_12.Naked, CullPattern=larger_4.LargerThan)
bang_16 = ExplodeTree(Data=simplify(graft(cull_5)))  # -> Branch0, Branch1

item_32 = ListItem(List=edges_10.Naked, Index=Slider(1, range=0..10), Wrap=True)
item_33 = ListItem(List=cull_2, Index=1, Wrap=True)
item_34 = ListItem(List=cull_3, Index=1, Wrap=True)

number_slider_62 = Slider(20, range=0..100)
range_10 = Range(Domain=Domain(0, 1), Steps=number_slider_62)
divide_16 = DivideCurve(Curve=bang_16.Branch1, Count=number_slider_62, Kinks=False)  # -> Points, Tangents, Parameters
graph_7 = GraphMapper(range_10, x0=0, x1=1, y0=0, y1=1, container_name="Sine", Equation_px=[0, 0.4951313436], Equation_py=[1, 0.4908394217])
multiplication_7 = Multiplication(A=graph_7, B=Slider(8, range=0..10))
Z_47 = UnitZ(Factor=1)
amp_7 = Amplitude(Vector=Z_47, Amplitude=multiplication_7)
move_28 = Move(Geometry=divide_16.Points, Motion=amp_7)  # -> Geometry, Transform
intcrv_11 = Interpolate(Vertices=move_28.Geometry, Degree=3, Periodic=False, KnotStyle=1)  # -> Curve, Length, Domain
loft_20 = Loft(
    Curves=flatten([bang_16.Branch1, intcrv_11.Curve]),
    Options={Adjust=False, Closed=False, LoftEnds=0, LoftSimp=0, LoftType=0, Rebuild=10, Refit=0.01})

number_slider_63 = Slider(20, range=0..100)
range_11 = Range(Domain=Domain(0, 1), Steps=number_slider_63)
divide_17 = DivideCurve(Curve=bang_16.Branch0, Count=number_slider_63, Kinks=False)  # -> Points, Tangents, Parameters
graph_8 = GraphMapper(range_11, x0=0, x1=1, y0=0, y1=1, container_name="Sine", Equation_px=[0, 0.5000813603], Equation_py=[0.4971481562, 1])
multiplication_8 = Multiplication(A=graph_8, B=Slider(8, range=0..10))
Z_48 = UnitZ(Factor=1)
amp_8 = Amplitude(Vector=Z_48, Amplitude=multiplication_8)
move_29 = Move(Geometry=divide_17.Points, Motion=amp_8)  # -> Geometry, Transform
intcrv_12 = Interpolate(Vertices=move_29.Geometry, Degree=3, Periodic=False, KnotStyle=1)  # -> Curve, Length, Domain
loft_21 = Loft(
    Curves=flatten([bang_16.Branch0, intcrv_12.Curve]),
    Options={Adjust=False, Closed=False, LoftEnds=0, LoftSimp=0, LoftType=0, Rebuild=10, Refit=0.01})

cluster = Cluster_2(
    start_and_end_curve=[bang_15.Branch0, intcrv_12.Curve],
    tween_curve_a=bang_15.Branch0,
    tween_curve_b=intcrv_12.Curve,
    S=loft_21)
cluster_2 = Cluster_2(
    start_and_end_curve=[bang_15.Branch1, intcrv_11.Curve],
    tween_curve_a=bang_15.Branch1,
    tween_curve_b=intcrv_11.Curve,
    S=loft_20)
flip_2 = Flip(Surface=loft_21)  # -> Surface, Result
edges_13 = BrepEdges(Brep=loft_20)  # -> Naked, Interior, NonManifold
edges_14 = BrepEdges(Brep=loft_21)  # -> Naked, Interior, NonManifold
flip_3 = Flip(Surface=loft_20)  # -> Surface, Result
cluster_3 = Cluster(G=flip_3.Surface, A=number_slider_23)
cluster_4 = Cluster(G=flip_3.Surface, A=number_slider_23)
divide_18 = DivideDomain²(Domain=cluster, UCount=Slider(1, range=0..10), VCount=Slider(12, range=0..100))
subsrf = Isotrim(Surface=cluster, Domain=divide_18)
divide_19 = DivideDomain²(Domain=cluster_2, UCount=Slider(1, range=0..10), VCount=Slider(12, range=0..100))
subsrf_2 = Isotrim(Surface=cluster_2, Domain=divide_19)
item_35 = ListItem(List=edges_14.Naked, Index=number_slider_25, Wrap=True)
item_36 = ListItem(List=edges_13.Naked, Index=number_slider_25, Wrap=True)
edges_15 = BrepEdges(Brep=loft_20)  # -> Naked, Interior, NonManifold
edges_16 = BrepEdges(Brep=loft_21)  # -> Naked, Interior, NonManifold
item_37 = ListItem(List=edges_16.Naked, Index=number_slider_28, Wrap=True)
item_38 = ListItem(List=edges_15.Naked, Index=number_slider_28, Wrap=True)
flip_4 = FlipCurve(Curve=item_37)  # -> Curve, Flag
loft_22 = Loft(
    Curves=flatten([flip_4.Curve, item_38]),
    Options={Adjust=False, Closed=False, LoftEnds=0, LoftSimp=0, LoftType=0, Rebuild=10, Refit=0.01})
edges_17 = BrepEdges(Brep=loft_22)  # -> Naked, Interior, NonManifold
join_9 = JoinCurves(Curves=edges_17.Naked, Preserve=False)
len_7 = Length(Curve=edges_17.Naked)
smaller_2 = SmallerThan(FirstNumber=len_7, SecondNumber=25)  # -> SmallerThan, OrEqualTo
dispatch_8 = Dispatch(List=edges_17.Naked, DispatchPattern=smaller_2.SmallerThan)  # -> ListA, ListB
bang_17 = ExplodeTree(Data=simplify(dispatch_8.ListB))  # -> Branch0, Branch1
divide_20 = DivideCurve(Curve=dispatch_8.ListA, Count=number_slider_32, Kinks=False)  # -> Points, Tangents, Parameters
divide_21 = DivideCurve(Curve=dispatch_8.ListB, Count=number_slider_33, Kinks=False)  # -> Points, Tangents, Parameters
srf_8 = Surface(move_17.Geometry)
srf_9 = Surface(move_18.Geometry)
srf_10 = Surface(move_27.Geometry)
edges_18 = BrepEdges(Brep=srf_10)  # -> Naked, Interior, NonManifold
edges_19 = BrepEdges(Brep=srf_9)  # -> Naked, Interior, NonManifold
edges_20 = BrepEdges(Brep=srf_8)  # -> Naked, Interior, NonManifold
bang_18 = ExplodeTree(Data=graft(edges_20.Naked))  # -> Branch0, Branch1, Branch2, Branch3
flip_5 = FlipCurve(Curve=bang_18.Branch3)  # -> Curve, Flag
loft_23 = Loft(
    Curves=flatten([flip_5.Curve, bang_18.Branch1]),
    Options={Adjust=False, Closed=False, LoftEnds=0, LoftSimp=0, LoftType=0, Rebuild=10, Refit=0.01})
bang_19 = ExplodeTree(Data=graft(edges_18.Naked))  # -> Branch0, Branch1, Branch2, Branch3
len_8 = Length(Curve=edges_19.Naked)
edges_21 = BrepEdges(Brep=loft_23)  # -> Naked, Interior, NonManifold
flip_6 = FlipCurve(Curve=edges_21.Naked)  # -> Curve, Flag
len_9 = Length(Curve=flip_6.Curve)
smaller_3 = SmallerThan(FirstNumber=len_9, SecondNumber=25)  # -> SmallerThan, OrEqualTo
smaller_4 = SmallerThan(FirstNumber=len_8, SecondNumber=25)  # -> SmallerThan, OrEqualTo
flip_7 = FlipCurve(Curve=bang_19.Branch2)  # -> Curve, Flag
dispatch_9 = Dispatch(List=flip_6.Curve, DispatchPattern=smaller_3.SmallerThan)  # -> ListA, ListB
loft_24 = Loft(
    Curves=flatten([flip_7.Curve, bang_19.Branch3]),
    Options={Adjust=False, Closed=False, LoftEnds=0, LoftSimp=0, LoftType=0, Rebuild=10, Refit=0.01})
dispatch_10 = Dispatch(List=edges_19.Naked, DispatchPattern=smaller_4.SmallerThan)  # -> ListA, ListB
edges_22 = BrepEdges(Brep=loft_24)  # -> Naked, Interior, NonManifold
len_10 = Length(Curve=edges_22.Naked)
smaller_5 = SmallerThan(FirstNumber=len_10, SecondNumber=25)  # -> SmallerThan, OrEqualTo
dispatch_11 = Dispatch(List=edges_22.Naked, DispatchPattern=smaller_5.SmallerThan)  # -> ListA, ListB
divide_22 = DivideCurve(Curve=dispatch_10.ListA, Count=number_slider_32, Kinks=False)  # -> Points, Tangents, Parameters
divide_23 = DivideCurve(Curve=dispatch_10.ListB, Count=number_slider_33, Kinks=False)  # -> simplify(Points), Tangents, Parameters
shift_3 = ShiftList(List=divide_21.Points, Shift=2, Wrap=invert(True))  # -> simplify(List)
divide_24 = DivideCurve(Curve=dispatch_11.ListA, Count=number_slider_32, Kinks=False)  # -> Points, Tangents, Parameters
divide_25 = DivideCurve(Curve=dispatch_9.ListB, Count=number_slider_33, Kinks=False)  # -> simplify(Points), Tangents, Parameters
divide_26 = DivideCurve(Curve=dispatch_9.ListA, Count=number_slider_32, Kinks=False)  # -> Points, Tangents, Parameters
divide_27 = DivideCurve(Curve=dispatch_11.ListB, Count=number_slider_33, Kinks=False)  # -> simplify(Points), Tangents, Parameters
ln_2 = Line(StartPoint=shift_3, EndPoint=divide_27.Points)

mesh_5 = Mesh(gate.Target1)
crv_14 = Curve(circle_2)  # disabled
bang_20 = ExplodeTree(Data=simplify(graft(crv_14)))  # -> Branch0, Branch1, Branch2; disabled
# KARAMBA
edges_23 = BrepEdges(Brep=[srf_7, edgesrf_3, edgesrf_2])  # -> Naked, Interior, NonManifold; disabled
bang_21 = ExplodeTree(Data=edges_23.Naked)  # -> Branch0, Branch1, Branch2; disabled
bang_22 = ExplodeTree(Data=edges_23.Naked)  # -> Branch0, Branch1, Branch2; disabled
bang_23 = ExplodeTree(Data=edges_23.Naked)  # -> Branch0, Branch1, Branch2; disabled
crv_15 = Curve(bang_20.Branch1)  # disabled
crv_16 = Curve(bang_20.Branch0)  # disabled
len_11 = Length(Curve=bang_21.Branch2)  # disabled
len_12 = Length(Curve=bang_22.Branch1)  # disabled
len_13 = Length(Curve=bang_23.Branch0)  # disabled
larger_5 = LargerThan(FirstNumber=len_11, SecondNumber=25)  # -> LargerThan, OrEqualTo; disabled
larger_6 = LargerThan(FirstNumber=len_12, SecondNumber=25)  # -> LargerThan, OrEqualTo; disabled
larger_7 = LargerThan(FirstNumber=len_13, SecondNumber=25)  # -> LargerThan, OrEqualTo; disabled
panel_11 = Panel(len_11)  # disabled
cull_6 = CullPattern(List=bang_21.Branch2, CullPattern=larger_5.LargerThan)  # disabled
cull_7 = CullPattern(List=bang_22.Branch1, CullPattern=larger_6.LargerThan)  # disabled
cull_8 = CullPattern(List=bang_23.Branch0, CullPattern=larger_7.LargerThan)  # disabled
bang_24 = ExplodeTree(Data=graft(cull_7))  # -> Branch0, Branch1; disabled
crv_cp_3 = CurveClosestPoint(Point=flatten(disc_2.Points), Curve=graft(cull_6))  # -> Point, Parameter, Distance; disabled
crv_cp_4 = CurveClosestPoint(Point=flatten(disc_2.Points), Curve=graft(crv_16))  # -> Point, Parameter, Distance; disabled
crv_cp_5 = CurveClosestPoint(Point=flatten(disc.Points), Curve=graft(cull_8))  # -> Point, Parameter, Distance; disabled
crv_cp_6 = CurveClosestPoint(Point=flatten(disc.Points), Curve=graft(crv_15))  # -> Point, Parameter, Distance; disabled
flip_8 = FlipCurve(Curve=bang_24.Branch0)  # -> Curve, Flag; disabled
smaller_6 = SmallerThan(FirstNumber=crv_cp_3.Distance, SecondNumber=number_slider_41)  # -> SmallerThan, OrEqualTo; disabled
smaller_7 = SmallerThan(FirstNumber=crv_cp_4.Distance, SecondNumber=number_slider_42)  # -> SmallerThan, OrEqualTo; disabled
smaller_8 = SmallerThan(FirstNumber=crv_cp_5.Distance, SecondNumber=number_slider_44)  # -> SmallerThan, OrEqualTo; disabled
smaller_9 = SmallerThan(FirstNumber=crv_cp_6.Distance, SecondNumber=number_slider_46)  # -> SmallerThan, OrEqualTo; disabled
tweencrv_3 = TweenCurve(CurveA=flip_8.Curve, CurveB=bang_24.Branch1, Factor=0.5, BlendType=0)  # disabled
cull_9 = CullPattern(List=crv_cp_3.Point, CullPattern=smaller_6.SmallerThan)  # disabled
cull_10 = CullPattern(List=crv_cp_4.Point, CullPattern=smaller_7.SmallerThan)  # disabled
cull_11 = CullPattern(List=crv_cp_5.Point, CullPattern=smaller_8.SmallerThan)  # disabled
cull_12 = CullPattern(List=crv_cp_6.Point, CullPattern=smaller_9.SmallerThan)  # disabled
duppt = RemoveDuplicatePts(Points=cull_9, Tolerance=0.01)  # disabled
duppt_2 = RemoveDuplicatePts(Points=cull_11, Tolerance=0.01)  # disabled
duppt_3 = RemoveDuplicatePts(Points=cull_12, Tolerance=0.01)  # disabled
duppt_4 = RemoveDuplicatePts(Points=cull_10, Tolerance=0.01)  # disabled
bang_25 = ExplodeTree(Data=duppt)  # -> _1100, _1110; disabled
bang_26 = ExplodeTree(Data=duppt_2)  # -> _0000, _0010; disabled
ln_3 = Line(StartPoint=bang_25._1100, EndPoint=bang_25._1110)  # disabled
ln_4 = Line(StartPoint=bang_26._0000, EndPoint=bang_26._0010)  # disabled

mesh_6 = Mesh(mesh_5)
mmx = MeshMesh(MeshA=mesh_6, MeshB=mesh_3, UseMeshMeshFast=True)
tri_3 = Triangulate(Mesh=mesh_5)  # -> Mesh, Count; disabled
pcx = CurvePlane(Curve=mmx, Plane=xy)  # -> Points, simplify(ParamsC), ParamsP
shatter_9 = Shatter(Curve=simplify(graft(mmx)), Parameters=pcx.ParamsC)
movetoplane = MoveToPlane(Geometry=bang_20.Branch2, Plane=area.Centroid, Above=True, Below=True)  # -> Geometry, Transform
eval_4 = EvaluateLength(Curve=shatter_9, Length=0.5, Normalized=True)  # -> Point, Tangent, Parameter
item_39 = ListItem(List=movetoplane.Geometry, Index=1, Wrap=True)
plcoord = PlaneCoordinates(Point=eval_4.Point, System=xy)  # -> XCoordinate, YCoordinate, ZCoordinate
expression = Expression(x=plcoord.ZCoordinate, y=number_slider, Expression="x>y")
dispatch_12 = Dispatch(List=shatter_9, DispatchPattern=expression)  # -> ListA, ListB
crv_17 = Curve(dispatch_12.ListA)
pframe = PerpFrame(Curve=reparameterize(crv_17), Parameter=1)
pframe_2 = PerpFrame(Curve=reparameterize(crv_17), Parameter=0)
align = AlignPlane(Plane=pframe, Direction=Z_5)  # -> Plane, Angle
align_2 = AlignPlane(Plane=pframe_2, Direction=Z_6)  # -> Plane, Angle
deplane = DeconstructPlane(Plane=align.Plane)  # -> Origin, XAxis, YAxis, ZAxis
deplane_2 = DeconstructPlane(Plane=align_2.Plane)  # -> Origin, XAxis, YAxis, ZAxis
pl = ConstructPlane(Origin=deplane.Origin, XAxis=deplane.YAxis, YAxis=Z_8)
pl_2 = ConstructPlane(Origin=deplane_2.Origin, XAxis=deplane_2.YAxis, YAxis=Z_9)
pcx_2 = CurvePlane(Curve=ext, Plane=pl_2)  # -> Points, ParamsC, ParamsP
pcx_3 = CurvePlane(Curve=ext, Plane=pl)  # -> Points, ParamsC, ParamsP
dom_8 = ConstructDomain(DomainStart=pcx_2.ParamsC, DomainEnd=pcx_3.ParamsC)  # -> simplify(Domain)
sort_2 = SortList(Keys=flatten([pcx_2.ParamsC, pcx_3.ParamsC]))  # -> Keys, ValuesA
shatter_10 = Shatter(Curve=ext, Parameters=sort_2.Keys)
subcrv = SubCurve(BaseCurve=ext, Domain=dom_8)
len_14 = Length(Curve=subcrv)
expression_2 = Expression(x=len_14, Expression="x/7")
expression_3 = Expression(x=expression_2, y=int, Expression="floor(x/y)*y")
eval_5 = EvaluateLength(Curve=graft(dispatch_12.ListB), Length=[0, 1], Normalized=True)  # -> Point, Tangent, Parameter
dispatch_13 = Dispatch(List=shatter_10, DispatchPattern=[True, False])  # -> ListA, ListB
pdecon = Deconstruct(Point=eval_5.Point)  # -> XComponent, YComponent, ZComponent
flip_9 = FlipCurve(Curve=crv_17, Guide=project.Geometry)  # -> Curve, Flag
crv_18 = Curve(dispatch_13.ListA)
sort_3 = SortList(Keys=pdecon.ZComponent, ValuesA=eval_5.Point)  # -> Keys, ValuesA
divide_28 = DivideCurve(Curve=flip_9.Curve, Count=expression_3, Kinks=False)  # -> Points, Tangents, Parameters
divide_29 = DivideCurve(Curve=subcrv, Count=expression_3, Kinks=False)  # -> Points, Tangents, Parameters
pt_6 = Point(divide_29.Points)
pt_7 = Point(divide_28.Points)
crv_cp_7 = CurveClosestPoint(Point=divide_29.Points, Curve=item_12)  # -> Point, Parameter, Distance
crv_cp_8 = CurveClosestPoint(Point=divide_29.Points, Curve=item_11)  # -> Point, Parameter, Distance
item_40 = ListItem(List=sort_3.ValuesA, Index=0, Wrap=True)  # -> flatten(Item)
dispatch_14 = Dispatch(List=divide_29.Points, DispatchPattern=[True, False])  # -> ListA, ListB
dispatch_15 = Dispatch(List=divide_28.Points, DispatchPattern=[True, False])  # -> ListA, ListB
dispatch_16 = Dispatch(List=pt_7, DispatchPattern=[True, False])  # -> ListA, ListB
dispatch_17 = Dispatch(List=pt_6, DispatchPattern=[True, False])  # -> ListA, ListB
dispatch_18 = Dispatch(List=crv_cp_7.Point, DispatchPattern=[True, False])  # -> ListA, ListB
pt_8 = Point(item_40)
dispatch_19 = Dispatch(List=crv_cp_8.Point, DispatchPattern=[True, False])  # -> ListA, ListB
cp = ClosestPoint(Point=pt_8, Cloud=darc.BasePlane)  # -> ClosestPoint, CPIndex, Distance
cset = CreateSet(List=cp.CPIndex)  # -> Set, Map
weave = Weave(Pattern=[0, 1], Stream0=dispatch_14.ListA, Stream1=dispatch_15.ListB, NullGaps=False)
sort_4 = SortList(Keys=cset.Set, ValuesA=cset.Set)  # -> Keys, ValuesA
weave_2 = Weave(Pattern=[0, 1], Stream0=dispatch_16.ListA, Stream1=dispatch_19.ListB, NullGaps=False)
weave_3 = Weave(Pattern=[0, 1], Stream0=dispatch_17.ListA, Stream1=dispatch_18.ListB, NullGaps=False)
weave_4 = Weave(Pattern=[0, 1], Stream0=dispatch_17.ListA, Stream1=dispatch_19.ListB, NullGaps=False)
weave_5 = Weave(Pattern=[0, 1], Stream0=dispatch_16.ListA, Stream1=dispatch_18.ListB, NullGaps=False)
pline_7 = PolyLine(Vertices=divide_29.Points, Closed=False)
pline_8 = PolyLine(Vertices=divide_28.Points, Closed=False)

pline_9 = PolyLine(Vertices=sort_3.ValuesA, Closed=False)
explode = Explode(Curve=pline_7, Recursive=True)  # -> Segments, Vertices
explode_2 = Explode(Curve=pline_8, Recursive=True)  # -> Segments, Vertices

sec = MeshPlane(Mesh=mesh_6, Plane=xy)
sort_5 = SortList(Keys=cp.CPIndex, ValuesB=cp.CPIndex, ValuesA=pt_8)  # -> Keys, ValuesB, ValuesA
item_41 = ListItem(List=project_2.Geometry, Index=sort_4.ValuesA, Wrap=True)  # -> graft(Item)
pline_10 = PolyLine(Vertices=crv_cp_7.Point, Closed=False)
pline_11 = PolyLine(Vertices=crv_cp_8.Point, Closed=False)
pline_12 = PolyLine(Vertices=weave, Closed=False)
pline_13 = PolyLine(Vertices=weave_3, Closed=False)
pline_14 = PolyLine(Vertices=weave_5, Closed=False)
pline_15 = PolyLine(Vertices=weave_2, Closed=False)
pline_16 = PolyLine(Vertices=weave_4, Closed=False)
mindex = MemberIndex(Set=sort_5.ValuesB, Member=sort_4.ValuesA)  # -> Index, Count
ln_5 = Line(StartPoint=divide_29.Points, EndPoint=divide_28.Points)
panel_12 = Panel(dispatch_13.ListA)
explode_3 = Explode(Curve=pline_12, Recursive=True)  # -> Segments, Vertices
item_42 = ListItem(List=sort_5.ValuesA, Index=mindex.Index, Wrap=True)  # -> simplify(Item)
ln_6 = Line(StartPoint=divide_28.Points, EndPoint=crv_cp_8.Point)
ln_7 = Line(StartPoint=divide_28.Points, EndPoint=crv_cp_7.Point)
ln_8 = Line(StartPoint=divide_29.Points, EndPoint=crv_cp_8.Point)
ln_9 = Line(StartPoint=divide_29.Points, EndPoint=crv_cp_7.Point)
crv_cp_9 = CurveClosestPoint(Point=item_42, Curve=simplify(item_41))  # -> Point, Parameter, Distance
shatter_11 = Shatter(Curve=item_41, Parameters=crv_cp_9.Parameter)
crv_19 = Curve(flatten([explode_2.Segments, pline_9, explode.Segments]))
pframes_4 = PerpFrames(Curve=shatter_11, Count=6, Align=True)  # -> Frames, Parameters
explode_4 = Explode(Curve=flatten([pline_13, pline_14, pline_16, pline_15, pline_10, pline_11, ln_9, ln_8, ln_7, ln_6]), Recursive=True)  # -> Segments, Vertices
flatten = FlattenTree(Tree=[ln_5, explode_3.Segments, explode_4.Segments], Path="{0}")
remove_ends = RemoveEnds(L=pframes_4.Frames)  # -> simplify(L_2)
trim_10 = TrimTree(Tree=remove_ends, Depth=1)
planesrf_2 = PlaneSurface(Plane=trim_10, XSize=Domain(-50, 2), YSize=Domain(-100, 100))
bcx_2 = BrepCurve(Brep=planesrf_2, Curve=graft(sec))  # -> Curves, simplify(Points)
trim_11 = TrimTree(Tree=bcx_2.Points, Depth=1)
dispatch_20 = Dispatch(List=remove_ends, DispatchPattern=[True, False])  # -> ListA, ListB
unflatten = UnflattenTree(Tree=trim_11, Guide=remove_ends)
lng = ListLength(List=flatten(unflatten))
series = Series(Start=0, Step=1, Count=lng)
dispatch_21 = Dispatch(List=unflatten, DispatchPattern=[True, False])  # -> ListA, ListB
unflatten_2 = UnflattenTree(Tree=series, Guide=unflatten)  # -> simplify(Tree)
weave_6 = Weave(Pattern=[0, 1], Stream0=dispatch_20.ListA, Stream1=dispatch_21.ListB, NullGaps=False)
eval_6 = EvaluateLength(Curve=graft(flatten), Length=[0, 1], Normalized=True)  # -> flatten(Point), Tangent, Parameter
path_mapper = PathMapper(unflatten_2, source="{A;B}", target="{B}")
path_mapper_2 = PathMapper(unflatten, source="{A;B}", target="{B}")
pline_17 = PolyLine(Vertices=remove_ends, Closed=False)
ln_10 = Line(StartPoint=remove_ends, EndPoint=unflatten)
pline_18 = PolyLine(Vertices=weave_6, Closed=False)
pline_19 = PolyLine(Vertices=unflatten, Closed=False)
eval_7 = EvaluateLength(Curve=pline_18, Length=[0, 1], Normalized=True)  # -> Point, Tangent, Parameter
crv_cp_10 = CurveClosestPoint(Point=path_mapper_2, Curve=graft(crv_7))  # -> Point, Parameter, Distance
eval_8 = EvaluateLength(Curve=pline_19, Length=[0, 1], Normalized=True)  # -> Point, Tangent, Parameter
flatten_2 = FlattenTree(Tree=path_mapper, Path="{0}")
flatten_3 = FlattenTree(Tree=crv_cp_10.Point, Path="{0}")
cp_2 = ClosestPoint(Point=eval_8.Point, Cloud=eval_6.Point)  # -> ClosestPoint, CPIndex, Distance
sort_6 = SortList(Keys=flatten_2, ValuesA=flatten_3)  # -> Keys, ValuesA
cp_3 = ClosestPoint(Point=eval_7.Point, Cloud=eval_6.Point)  # -> ClosestPoint, CPIndex, Distance
ln_11 = Line(StartPoint=path_mapper_2, EndPoint=crv_cp_10.Point)
unflatten_3 = UnflattenTree(Tree=sort_6.ValuesA, Guide=unflatten)  # -> simplify(Tree)
dispatch_22 = Dispatch(List=unflatten, DispatchPattern=[True, False])  # -> ListA, ListB
dispatch_23 = Dispatch(List=unflatten_3, DispatchPattern=[True, False])  # -> ListA, ListB
ln_12 = Line(StartPoint=eval_7.Point, EndPoint=cp_3.ClosestPoint)
ln_13 = Line(StartPoint=eval_7.Point, EndPoint=cp_2.ClosestPoint)
ln_14 = Line(StartPoint=eval_8.Point, EndPoint=cp_2.ClosestPoint)
crv_cp_11 = CurveClosestPoint(Point=unflatten_3, Curve=crv_8)  # -> Point, Parameter, Distance
pline_20 = PolyLine(Vertices=unflatten_3, Closed=False)
weave_7 = Weave(Pattern=[0, 1], Stream0=dispatch_23.ListA, Stream1=dispatch_22.ListB, NullGaps=False)
cullpt = CullDuplicates(Points=flatten(crv_cp_11.Point), Tolerance=2, CullMode=3)  # -> Points, Indices, Valence
eval_9 = EvaluateLength(Curve=graft(pline_20), Length=[0, 1], Normalized=True)  # -> flatten(Point), Tangent, Parameter
pline_21 = PolyLine(Vertices=weave_7, Closed=False)
crv_cp_12 = CurveClosestPoint(Point=cullpt.Points, Curve=crv_8)  # -> Point, Parameter, Distance
eval_10 = EvaluateLength(Curve=graft(pline_21), Length=[0, 1], Normalized=True)  # -> Point, Tangent, Parameter
cp_4 = ClosestPoint(Point=eval_9.Point, Cloud=eval_6.Point)  # -> ClosestPoint, CPIndex, Distance
cp_5 = ClosestPoint(Point=crv_cp_11.Point, Cloud=crv_cp_12.Point)  # -> ClosestPoint, CPIndex, Distance
cp_6 = ClosestPoint(Point=eval_10.Point, Cloud=flatten(cp_2.ClosestPoint))  # -> ClosestPoint, CPIndex, Distance
ln_15 = Line(StartPoint=eval_9.Point, EndPoint=cp_4.ClosestPoint)
dispatch_24 = Dispatch(List=unflatten_3, DispatchPattern=[True, False])  # -> ListA, ListB
dispatch_25 = Dispatch(List=cp_5.ClosestPoint, DispatchPattern=[True, False])  # -> ListA, ListB
ln_16 = Line(StartPoint=eval_10.Point, EndPoint=cp_6.ClosestPoint)
eval_11 = EvaluateLength(Curve=ln_5, Length=0, Normalized=True)  # -> flatten(Point), Tangent, Parameter
weave_8 = Weave(Pattern=[0, 1], Stream0=dispatch_24.ListA, Stream1=dispatch_25.ListB, NullGaps=False)
pline_22 = PolyLine(Vertices=weave_8, Closed=False)
ln_17 = Line(StartPoint=unflatten_3, EndPoint=cp_5.ClosestPoint)
eval_12 = EvaluateLength(Curve=graft(pline_22), Length=[0, 1], Normalized=True)  # -> Point, Tangent, Parameter
panel_13 = Panel(unflatten_3)
cp_7 = ClosestPoint(Point=eval_12.Point, Cloud=eval_11.Point)  # -> ClosestPoint, CPIndex, Distance
ln_18 = Line(StartPoint=eval_12.Point, EndPoint=cp_7.ClosestPoint)
explode_5 = Explode(
    Curve=flatten([pline_17, ln_10, ln_14, ln_13, ln_12, pline_19, pline_18, ln_15, pline_20, ln_11, pline_21, ln_17, ln_18, pline_22, ln_16]),
    Recursive=True)  # -> Segments, Vertices
panel_14 = Panel(ln_10)
lng_2 = ListLength(List=explode_2.Vertices)  # -> simplify(Length)
panel_15 = Panel(lng_2)
eval_13 = EvaluateLength(Curve=graft(mmx), Length=[0, 1], Normalized=True)  # -> Point, Tangent, Parameter
item_43 = ListItem(List=simplify(explode_2.Vertices), Index=expr("floor(x/2)", lng_2), Wrap=False)  # -> Item, Item1
end_4 = EndPoints(Curve=pline_7)  # -> Start, End
pt_9 = Point(flatten([pframes_4.Frames, item_40, eval_13.Point]))
flatten_4 = FlattenTree(Tree=[flatten, explode_5.Segments], Path="{0}")
ln_19 = Line(StartPoint=end_4.Start, EndPoint=item_43.Item)
ln_20 = Line(StartPoint=end_4.End, EndPoint=item_43.Item1)
cullpt_2 = CullDuplicates(Points=pt_9, Tolerance=0, CullMode=3)  # -> Points, Indices, Valence
loads_3 = LoadsKaramba(ForceVector=Z_21, Local=True, PosInd=flatten([item_43.Item, item_43.Item1]), LCase=0, mode="Point")  # -> flatten(Load)
dupln = RemoveDuplicateLines(Lines=flatten_4, Tolerance=0.01)
crv_20 = Curve(flatten(dupln))
flatten_5 = FlattenTree(Tree=[ln_19, ln_20], Path="{0}")
dupln_2 = RemoveDuplicateLines(Lines=flatten_5, Tolerance=0.01)
linetobeam = LineToBeamKaramba(Line=flatten(dupln), New=True, Remove=True, LimitDistance_m=0.005, BeamIdentifier="brace")  # -> Points, Element, Info
linetobeam_2 = LineToBeamKaramba(Line=flatten(dupln_2), New=True, Remove=True, LimitDistance_m=0.005, BeamIdentifier="ptension")  # -> Points, Element, Info
supp = SupportKaramba(PosInd=flatten(cullpt_2.Points), menu=[buttons(on, on, on, off, off, off)])
modifyelem = ModifyElementKaramba(Beam=linetobeam_2.Element, Height_cm=graft("15"), Thickness_cm=graft("6"), Bending="0", mode="Beam")
item_44 = ListItem(List=flatten(shatter_4), Index=1, Wrap=True)
edges_24 = BrepEdges(Brep=srf_3)  # -> Naked, Interior, NonManifold
item_45 = ListItem(List=edges_24.Naked, Index=panel_2, Wrap=True)
item_46 = ListItem(List=edges_24.Naked, Index=panel, Wrap=True)
eval_14 = EvaluateLength(Curve=item_45, Length=0, Normalized=True)  # -> Point, Tangent, Parameter
eval_15 = EvaluateLength(Curve=item_45, Length=0.5, Normalized=True)  # -> Point, Tangent, Parameter
eval_16 = EvaluateLength(Curve=item_45, Length=1, Normalized=True)  # -> Point, Tangent, Parameter
move_30 = Move(Geometry=eval_15.Point, Motion=Z_29)  # -> Geometry, Transform
item_47 = ListItem(List=circle_2, Index=1, Wrap=True)
arc_5 = Arc3Pt(PointA=eval_14.Point, PointB=move_30.Geometry, PointC=eval_16.Point)  # -> Arc, Plane, Radius
dispatch_26 = Dispatch(List=item_46, DispatchPattern=[True, False])  # -> ListA, ListB
dispatch_27 = Dispatch(List=arc_5.Arc, DispatchPattern=[True, False])  # -> ListA, ListB
edgesrf_4 = EdgeSurface(CurveA=dispatch_27.ListA, CurveB=dispatch_26.ListA, CurveC=dispatch_27.ListB, CurveD=dispatch_26.ListB)
extr_10 = Extrude(Base=item_47, Direction=Z_30)
split_9 = SplitBrep(Brep=edgesrf_4, Cutter=extr_10)
item_48 = ListItem(List=split_9, Index=0, Wrap=True)
mesh_7 = MeshBrep(
    Brep=item_48,
    Settings={GridMaxCount=0, GridMinCount=16, JaggedSeams=False, MaxEdgeLength=0, MinEdgeLength=0.0001, MinTolerance=0, Refine=True, RefineAngle=0, RelativeTolerance=0.65, SimplePlanes=True, Tolerance=0})
medges_7 = MeshEdges(Mesh=mesh_7)  # -> NakedEdges, InteriorEdges, NonManifoldEdges
join_10 = JoinCurves(Curves=medges_7.NakedEdges, Preserve=False)
item_49 = ListItem(List=reverse(join_10), Index=0, Wrap=True)
explode_6 = Explode(Curve=item_49, Recursive=True)  # -> Segments, Vertices
project_9 = Project(Geometry=explode_6.Segments, Plane=PlaneXY(0, 0, 0))  # -> Geometry, Transform
graft = GraftTree(Tree=explode_6.Segments, IncludeEmptyLists=True, IncludeNullItems=True)
graft_2 = GraftTree(Tree=project_9.Geometry, IncludeEmptyLists=True, IncludeNullItems=True)
loft_25 = Loft(
    Curves=[graft, graft_2],
    Options={Adjust=False, Closed=False, LoftEnds=0, LoftSimp=0, LoftType=0, Rebuild=10, Refit=0.01})

area_3 = Area(Geometry=item_47)  # -> Area, Centroid

project_10 = Project(Geometry=item_49, Plane=area_3.Centroid)  # -> Geometry, Transform
tweencrv_4 = TweenCurve(CurveA=item_49, CurveB=project_10.Geometry, Factor=range_4, BlendType=0)
shift_4 = ShiftList(List=tweencrv_4, Shift=-1, Wrap=False)  # -> graft(List)
shift_5 = ShiftList(List=tweencrv_4, Shift=1, Wrap=False)  # -> graft(List)
loft_26 = Loft(
    Curves=[shift_4, shift_5],
    Options={Adjust=False, Closed=False, LoftEnds=0, LoftSimp=0, LoftType=0, Rebuild=10, Refit=0.01})
debrep_3 = DeconstructBrep(Brep=loft_26)  # -> flatten(Faces), Edges, Vertices
smesh_2 = SimpleMesh(Brep=debrep_3.Faces)
mjoin_4 = MeshJoin(Meshes=flatten([smesh_2, mesh_7]))
weldvertices_4 = MeshWeldVertices(Mesh=mjoin_4, Tolerance=0.01)  # -> RuntimeMessage, Mesh
unifynormals_4 = MeshUnifyNormals(Mesh=weldvertices_4.Mesh)
nv_3 = NakedVertices(Mesh=unifynormals_4)  # -> ClothedIndex, NakedIndex, ClothedPts, NakedPts
demesh_2 = DeconstructMesh(Mesh=unifynormals_4)  # -> Vertices, Faces, Colours, Normals
item_50 = ListItem(List=demesh_2.Vertices, Index=nv_3.NakedIndex, Wrap=True)
item_51 = ListItem(List=demesh_2.Vertices, Index=nv_3.ClothedIndex, Wrap=True)
medges_8 = MeshEdges(Mesh=unifynormals_4)  # -> NakedEdges, InteriorEdges, NonManifoldEdges
panel_16 = Panel(nv_3.ClothedIndex)
crv_21 = Curve([medges_8.NakedEdges, medges_8.InteriorEdges])
springs_2 = SpringsFromLine(Connection=crv_21, Stiffness=Slider(1, range=0..1), Damping=10, RestLength=0, UpperCutoff=0, LowerCutoff=0, Plasticity=0)
kangaroo_2 = KangarooPhysics(ForceObjects=flatten(springs_2), AnchorPoints=item_50, Settings=null, Geometry=item_51, SimulationReset=Toggle(False))  # -> Out, Iterations, ParticlesOut, GeometryOut, KE
pt_10 = Point(kangaroo_2.GeometryOut)
pt_11 = Point(item_50)
merge_3 = Merge(Data1=pt_10, Data2=pt_11)
merge_4 = Merge(Data1=nv_3.ClothedIndex, Data2=nv_3.NakedIndex)
sort_7 = SortList(Keys=merge_4, ValuesA=merge_3)  # -> Keys, ValuesA
conmesh_2 = ConstructMesh(Vertices=sort_7.ValuesA, Faces=demesh_2.Faces)
panel_17 = Panel(sort_7.ValuesA)

medges_9 = MeshEdges(Mesh=tri_3.Mesh)  # -> NakedEdges, InteriorEdges, NonManifoldEdges; disabled
line_9 = Line([medges_9.NakedEdges, medges_9.InteriorEdges])  # disabled
crv_22 = Curve([item_39, bang_9.Branch1])  # disabled
disc_6 = Discontinuity(Curve=line_9, Level=1)  # -> Points, Parameters; disabled
crv_cp_13 = CurveClosestPoint(Point=flatten(disc_6.Points), Curve=graft(cull_7))  # -> Point, Parameter, Distance; disabled
crv_cp_14 = CurveClosestPoint(Point=flatten(disc_6.Points), Curve=graft(crv_22))  # -> Point, Parameter, Distance; disabled
smaller_10 = SmallerThan(FirstNumber=crv_cp_13.Distance, SecondNumber=number_slider_43)  # -> SmallerThan, OrEqualTo; disabled
smaller_11 = SmallerThan(FirstNumber=crv_cp_14.Distance, SecondNumber=number_slider_45)  # -> SmallerThan, OrEqualTo; disabled
cull_13 = CullPattern(List=crv_cp_13.Point, CullPattern=smaller_10.SmallerThan)  # disabled
cull_14 = CullPattern(List=crv_cp_14.Point, CullPattern=smaller_11.SmallerThan)  # disabled
dispatch_28 = Dispatch(List=disc_6.Points, DispatchPattern=smaller_11.SmallerThan)  # -> ListA, ListB; disabled
duppt_5 = RemoveDuplicatePts(Points=cull_13, Tolerance=0.01)  # disabled
duppt_6 = RemoveDuplicatePts(Points=cull_14, Tolerance=0.01)  # disabled
pt_12 = Point(dispatch_28.ListB)  # disabled
bang_27 = ExplodeTree(Data=duppt_5)  # -> _1000, _1010; disabled
item_52 = ListItem(List=duppt_5, Index=-1, Wrap=True)  # disabled
supp_2 = SupportKaramba(PosInd=flatten([duppt_6, item_52]), menu=[buttons(on, on, on, off, off, off)])  # disabled
supp_3 = SupportKaramba(PosInd=flatten(pt_12), menu=[buttons(on, on, off, on, on, off)])  # disabled
loads_4 = LoadsKaramba(ForceVector=neg_7, Local=True, PosInd=flatten(duppt_5), LCase=0, mode="Point")  # disabled

ln_21 = Line(StartPoint=bang_27._1000, EndPoint=bang_27._1010)  # disabled

# ---- group: Beam Lines
line_10 = Line(flatten(line_9))  # disabled

# ----
linetobeam_3 = LineToBeamKaramba(Line=flatten([line_9, ln_21]), New=True, Remove=True, LimitDistance_m=0.005)  # -> Points, Element, Info; disabled
assemble = AssembleModelKaramba(
    Elem=flatten(linetobeam_3.Element),
    Support=flatten([supp_2, supp_3]),
    Load=flatten([loads, loads_4]),
    CrossSection=flatten(cross_sections_4),
    Material=flatten(matselect_2),
    LimitDistance_m=0.005)  # -> Model, Info, Mass_kg, CenterOfGravity; disabled
analyzethi = AnalyzeThIKaramba(Model=assemble.Model)  # -> CalculatedModel, MaximumDisplacement_m, ResultingForceOfGravity_kN, ElasticEnergy_kNm; disabled
modelview = ModelViewKaramba(Model=analyzethi.CalculatedModel, LoadCaseFactorsForLinearSuperposition=1, IndexIncrementOfVisibleLoadcase=0)  # -> Model, DeformedMesh, DeformedAxes, DeformedModel; disabled
beamview = BeamViewKaramba(Model=modelview.Model)  # -> Model, MeshesOfRenderedBeams, DeformedBeamAxes, LegendColors, LegendTags; disabled

len_15 = Length(Curve=line_10)  # disabled
ma = MassAddition(Input=len_15)  # -> Result, PartialResults; disabled
combined_beam_length = Panel(ma.Result)  # disabled
lng_3 = ListLength(List=len_15)  # disabled
division_3 = Division(A=combined_beam_length, B=lng_3)  # disabled
maximum_displacement = Panel(analyzethi.MaximumDisplacement_m)  # disabled
avg_beam_length = Panel(division_3)  # disabled
division_4 = Division(A=maximum_displacement, B=avg_beam_length)  # disabled
multiplication_9 = Multiplication(A=number_slider_49, B=division_4)  # disabled
total_displacement = Panel(multiplication_9)  # disabled

bnd = Bounds(Numbers=len_15)  # disabled
supp_4 = SupportKaramba(PosInd=flatten(pt_12), menu=[buttons(on, on, off, on, on, off)])  # disabled

item_53 = ListItem(List=shatter_5, Index=[1, 3], Wrap=True)
item_54 = ListItem(List=flatten(shatter_5), Index=[0, 2], Wrap=True)
eval_17 = EvaluateLength(Curve=item_54, Length=0, Normalized=True)  # -> Point, Tangent, Parameter
eval_18 = EvaluateLength(Curve=item_54, Length=0.5, Normalized=True)  # -> Point, Tangent, Parameter
eval_19 = EvaluateLength(Curve=item_54, Length=1, Normalized=True)  # -> Point, Tangent, Parameter
move_31 = Move(Geometry=eval_18.Point, Motion=Z_27)  # -> Geometry, Transform
item_55 = ListItem(List=circle_2, Index=0, Wrap=True)
arc_6 = Arc3Pt(PointA=eval_17.Point, PointB=move_31.Geometry, PointC=eval_19.Point)  # -> Arc, Plane, Radius
dispatch_29 = Dispatch(List=item_53, DispatchPattern=[True, False])  # -> ListA, ListB
dispatch_30 = Dispatch(List=arc_6.Arc, DispatchPattern=[True, False])  # -> ListA, ListB
edgesrf_5 = EdgeSurface(CurveA=dispatch_30.ListA, CurveB=dispatch_29.ListA, CurveC=dispatch_30.ListB, CurveD=dispatch_29.ListB)
extr_11 = Extrude(Base=item_55, Direction=Z_28)
split_10 = SplitBrep(Brep=edgesrf_5, Cutter=extr_11)
item_56 = ListItem(List=split_10, Index=Slider(0, range=0..1), Wrap=True)
mesh_8 = MeshBrep(
    Brep=item_56,
    Settings={GridMaxCount=0, GridMinCount=16, JaggedSeams=False, MaxEdgeLength=0, MinEdgeLength=0.0001, MinTolerance=0, Refine=True, RefineAngle=0, RelativeTolerance=0.65, SimplePlanes=True, Tolerance=0})
medges_10 = MeshEdges(Mesh=mesh_8)  # -> NakedEdges, InteriorEdges, NonManifoldEdges
join_11 = JoinCurves(Curves=medges_10.NakedEdges, Preserve=False)
item_57 = ListItem(List=reverse(join_11), Index=0, Wrap=True)
explode_7 = Explode(Curve=item_57, Recursive=True)  # -> Segments, Vertices
project_11 = Project(Geometry=explode_7.Segments, Plane=PlaneXY(0, 0, 0))  # -> Geometry, Transform
graft_3 = GraftTree(Tree=explode_7.Segments, IncludeEmptyLists=True, IncludeNullItems=True)
graft_4 = GraftTree(Tree=project_11.Geometry, IncludeEmptyLists=True, IncludeNullItems=True)
loft_27 = Loft(
    Curves=[graft_3, graft_4],
    Options={Adjust=False, Closed=False, LoftEnds=0, LoftSimp=0, LoftType=0, Rebuild=10, Refit=0.01})

area_4 = Area(Geometry=item_55)  # -> Area, Centroid

project_12 = Project(Geometry=item_57, Plane=area_4.Centroid)  # -> Geometry, Transform
tweencrv_5 = TweenCurve(CurveA=item_57, CurveB=project_12.Geometry, Factor=range_3, BlendType=0)
shift_6 = ShiftList(List=tweencrv_5, Shift=-1, Wrap=False)  # -> graft(List)
shift_7 = ShiftList(List=tweencrv_5, Shift=1, Wrap=False)  # -> graft(List)
loft_28 = Loft(
    Curves=[shift_6, shift_7],
    Options={Adjust=False, Closed=False, LoftEnds=0, LoftSimp=0, LoftType=0, Rebuild=10, Refit=0.01})
debrep_4 = DeconstructBrep(Brep=loft_28)  # -> flatten(Faces), Edges, Vertices
smesh_3 = SimpleMesh(Brep=debrep_4.Faces)
mjoin_5 = MeshJoin(Meshes=flatten([smesh_3, mesh_8]))
weldvertices_5 = MeshWeldVertices(Mesh=mjoin_5, Tolerance=0.01)  # -> RuntimeMessage, Mesh
unifynormals_5 = MeshUnifyNormals(Mesh=weldvertices_5.Mesh)
nv_4 = NakedVertices(Mesh=unifynormals_5)  # -> ClothedIndex, NakedIndex, ClothedPts, NakedPts
demesh_3 = DeconstructMesh(Mesh=unifynormals_5)  # -> Vertices, Faces, Colours, Normals
item_58 = ListItem(List=demesh_3.Vertices, Index=nv_4.NakedIndex, Wrap=True)
item_59 = ListItem(List=demesh_3.Vertices, Index=nv_4.ClothedIndex, Wrap=True)
medges_11 = MeshEdges(Mesh=unifynormals_5)  # -> NakedEdges, InteriorEdges, NonManifoldEdges
panel_18 = Panel(nv_4.ClothedIndex)
crv_23 = Curve([medges_11.NakedEdges, medges_11.InteriorEdges])
springs_3 = SpringsFromLine(Connection=crv_23, Stiffness=Slider(1, range=0..1), Damping=10, RestLength=0, UpperCutoff=0, LowerCutoff=0, Plasticity=0)
kangaroo_3 = KangarooPhysics(ForceObjects=flatten(springs_3), AnchorPoints=item_58, Settings=null, Geometry=item_59, SimulationReset=Toggle(True))  # -> Out, Iterations, ParticlesOut, GeometryOut, KE
pt_13 = Point(kangaroo_3.GeometryOut)
pt_14 = Point(item_58)
merge_5 = Merge(Data1=pt_13, Data2=pt_14)
merge_6 = Merge(Data1=nv_4.ClothedIndex, Data2=nv_4.NakedIndex)
sort_8 = SortList(Keys=merge_6, ValuesA=merge_5)  # -> Keys, ValuesA
conmesh_3 = ConstructMesh(Vertices=sort_8.ValuesA, Faces=demesh_3.Faces)
panel_19 = Panel(sort_8.ValuesA)

pline_23 = PolyLine(Vertices=cp_5.ClosestPoint, Closed=False)

eval_20 = EvaluateLength(Curve=graft(pline_23), Length=[0, 1], Normalized=True)  # -> Point, Tangent, Parameter
cp_8 = ClosestPoint(Point=eval_20.Point, Cloud=eval_11.Point)  # -> ClosestPoint, CPIndex, Distance

ln_22 = Line(StartPoint=eval_20.Point, EndPoint=cp_8.ClosestPoint)

explode_8 = Explode(Curve=flatten([pline_23, ln_22]), Recursive=True)  # -> Segments, Vertices
flatten_6 = FlattenTree(Tree=[crv_19, explode_8.Segments], Path="{0}")
dupln_3 = RemoveDuplicateLines(Lines=flatten_6, Tolerance=0.01)
linetobeam_4 = LineToBeamKaramba(Line=flatten(dupln_3), New=True, Remove=True, LimitDistance_m=0.005, BeamIdentifier="spine")  # -> Points, Element, Info
assemble_2 = AssembleModelKaramba(
    Elem=flatten([linetobeam.Element, linetobeam_4.Element, modifyelem]),
    Support=flatten(supp),
    Load=flatten([loads_2, loads_3]),
    CrossSection=flatten([cross_sections_2, cross_sections_3, cross_sections]),
    Material=flatten(matselect),
    LimitDistance_m=0.005)  # -> Model, Info, Mass_kg, CenterOfGravity
analyzethi_2 = AnalyzeThIKaramba(Model=assemble_2.Model)  # -> CalculatedModel, MaximumDisplacement_m, ResultingForceOfGravity_kN, ElasticEnergy_kNm

len_16 = Length(Curve=crv_20)
ma_2 = MassAddition(Input=len_16)  # -> Result, PartialResults
combined_beam_length_2 = Panel(ma_2.Result)
lng_4 = ListLength(List=len_16)
division_5 = Division(A=combined_beam_length_2, B=lng_4)
maximum_displacement_2 = Panel(analyzethi_2.MaximumDisplacement_m)
avg_beam_length_2 = Panel(division_5)
division_6 = Division(A=maximum_displacement_2, B=avg_beam_length_2)
multiplication_10 = Multiplication(A=Slider(100, range=0..100), B=division_6)
total_displacement_2 = Panel(multiplication_10)

bnd_2 = Bounds(Numbers=len_16)
modelview_2 = ModelViewKaramba(Model=analyzethi_2.CalculatedModel, LoadCaseFactorsForLinearSuperposition=1, IndexIncrementOfVisibleLoadcase=0)  # -> Model, DeformedMesh, DeformedAxes, DeformedModel
beamview_2 = BeamViewKaramba(Model=modelview_2.Model)  # -> Model, MeshesOfRenderedBeams, DeformedBeamAxes, LegendColors, LegendTags
legend = Legend(Colour=beamview_2.LegendColors, Tags=beamview_2.LegendTags, LegendType=1)

number_slider_64 = Slider(20, range=0..100)
project_13 = Project(Curve=intcrv_8.Curve, Brep=edgesrf_2, Direction=Vector(0, 0, 1))
range_12 = Range(Domain=Domain(0, 1), Steps=number_slider_64)
graph_9 = GraphMapper(range_12, x0=0, x1=1, y0=0, y1=1, container_name="Sine", Equation_px=[0, 0.5000813603], Equation_py=[0.4971481562, 1])
Z_49 = UnitZ(Factor=1)

graph_10 = GraphMapper(
    range_12,
    x0=0,
    x1=1,
    y0=0,
    y1=1,
    container_name="Bezier",
    cpx=[0, 0.4040562809, 0.7478275299, 1],
    cpy=[0.5115940571, 0.8753626943, 1, 0.1927534342])

item_60 = ListItem(List=cull_2, Index=0, Wrap=True)
number_slider_65 = Slider(20, range=0..100)
range_13 = Range(Domain=Domain(0, 1), Steps=number_slider_65)
divide_30 = DivideCurve(Curve=item_33, Count=number_slider_65, Kinks=False)  # -> Points, Tangents, Parameters
graph_11 = GraphMapper(range_13, x0=0, x1=1, y0=0, y1=1, container_name="Sine", Equation_px=[0, 0.4951313436], Equation_py=[1, 0.4908394217])
Z_50 = UnitZ(Factor=1)

divide_31 = DivideCurve(Curve=item_60, Count=number_slider_64, Kinks=False)  # -> Points, Tangents, Parameters
multiplication_11 = Multiplication(A=graph_10, B=Slider(8, range=0..10))
amp_9 = Amplitude(Vector=Z_49, Amplitude=multiplication_11)
move_32 = Move(Geometry=divide_31.Points, Motion=amp_9)  # -> Geometry, Transform
intcrv_13 = Interpolate(Vertices=move_32.Geometry, Degree=3, Periodic=False, KnotStyle=1)  # -> Curve, Length, Domain
loft_29 = Loft(
    Curves=flatten([intcrv_13.Curve, item_60]),
    Options={Adjust=False, Closed=False, LoftEnds=0, LoftSimp=0, LoftType=0, Rebuild=10, Refit=0.01})

graph_12 = GraphMapper(
    range_13,
    x0=0,
    x1=1,
    y0=0,
    y1=1,
    container_name="Bezier",
    cpx=[0, 0.4040562809, 0.4226038754, 1],
    cpy=[0.1565224528, 0.8753626943, 1, 0.9866669178])

multiplication_12 = Multiplication(A=graph_12, B=Slider(8, range=0..10))
amp_10 = Amplitude(Vector=Z_50, Amplitude=multiplication_12)
move_33 = Move(Geometry=divide_30.Points, Motion=amp_10)  # -> Geometry, Transform
intcrv_14 = Interpolate(Vertices=move_33.Geometry, Degree=3, Periodic=False, KnotStyle=1)  # -> Curve, Length, Domain
loft_30 = Loft(
    Curves=flatten([item_33, intcrv_14.Curve]),
    Options={Adjust=False, Closed=False, LoftEnds=0, LoftSimp=0, LoftType=0, Rebuild=10, Refit=0.01})

flip_10 = Flip(Surface=loft_29)  # -> Surface, Result
cluster_5 = Cluster_2(start_and_end_curve=[item_29, intcrv_13.Curve], tween_curve_a=item_29, tween_curve_b=intcrv_13.Curve, S=flip_10.Surface)
edges_25 = BrepEdges(Brep=loft_30)  # -> Naked, Interior, NonManifold
edges_26 = BrepEdges(Brep=loft_29)  # -> Naked, Interior, NonManifold
cluster_6 = Cluster(G=loft_29, A=Slider(0.3, range=0..1))
evalsrf = EvaluateSurface(Surface=reparameterize(loft_30), Point=md_slider)  # -> Point, Normal, Frame
srf_cp = SurfaceClosestPoint(Point=evalsrf.Point, Surface=loft_29)  # -> Point, UVPoint, Distance
cluster_7 = Cluster(G=loft_30, A=Slider(0.3, range=0..1))
flip_11 = Flip(Surface=loft_30)  # -> Surface, Result
cluster_8 = Cluster_2(start_and_end_curve=[item_30, intcrv_14.Curve], tween_curve_a=item_30, tween_curve_b=intcrv_14.Curve, S=flip_11.Surface)
item_61 = ListItem(List=edges_26.Naked, Index=number_slider_21, Wrap=True)
item_62 = ListItem(List=edges_25.Naked, Index=number_slider_21, Wrap=True)
extr_12 = Extrude(Base=loft_29, Direction=cluster_6)
extr_13 = Extrude(Base=loft_30, Direction=cluster_7)
evalsrf_2 = EvaluateSurface(Surface=loft_29, Point=srf_cp.UVPoint)  # -> Point, Normal, Frame
flip_12 = FlipCurve(Curve=item_61)  # -> Curve, Flag
tweencrv_6 = TweenCurve(CurveA=item_30, CurveB=intcrv_14.Curve, Factor=0.5, BlendType=0)
amp_11 = Amplitude(Vector=evalsrf_2.Normal, Amplitude=Slider(2.5, range=0..10))
move_34 = Move(Geometry=tweencrv_6, Motion=expr("-x", amp_11))  # -> Geometry, Transform
loft_31 = Loft(
    Curves=flatten([flip_12.Curve, item_62]),
    Options={Adjust=False, Closed=False, LoftEnds=0, LoftSimp=0, LoftType=0, Rebuild=10, Refit=0.01})
loft_32 = Loft(
    Curves=flatten([item_30, move_34.Geometry, intcrv_14.Curve]),
    Options={Adjust=False, Closed=False, LoftEnds=0, LoftSimp=0, LoftType=0, Rebuild=10, Refit=0.01})
amp_12 = Amplitude(Vector=evalsrf_2.Normal, Amplitude=Slider(0.2, range=0..1))
divide_32 = DivideDomain²(Domain=cluster_5, UCount=Slider(1, range=0..10), VCount=Slider(12, range=0..100))
subsrf_3 = Isotrim(Surface=cluster_5, Domain=divide_32)
divide_33 = DivideDomain²(Domain=loft_32, UCount=Slider(1, range=0..10), VCount=Slider(12, range=0..100))
subsrf_4 = Isotrim(Surface=loft_32, Domain=divide_33)
edges_27 = BrepEdges(Brep=loft_31)  # -> Naked, Interior, NonManifold
join_12 = JoinCurves(Curves=edges_27.Naked, Preserve=False)
len_17 = Length(Curve=edges_27.Naked)
smaller_12 = SmallerThan(FirstNumber=len_17, SecondNumber=25)  # -> SmallerThan, OrEqualTo
dispatch_31 = Dispatch(List=edges_27.Naked, DispatchPattern=smaller_12.SmallerThan)  # -> ListA, ListB
bang_28 = ExplodeTree(Data=simplify(dispatch_31.ListB))  # -> Branch0, Branch1
divide_34 = DivideCurve(Curve=dispatch_31.ListA, Count=number_slider_32, Kinks=False)  # -> Points, Tangents, Parameters
divide_35 = DivideCurve(Curve=dispatch_31.ListB, Count=number_slider_33, Kinks=False)  # -> Points, Tangents, Parameters

bang_29 = ExplodeTree(Data=simplify(graft(dispatch_31.ListB)))  # -> Branch0, Branch1
flip_13 = FlipCurve(Curve=bang_29.Branch0)  # -> Curve, Flag
bang_30 = ExplodeTree(Data=simplify(divide_35.Points))  # -> Branch0, Branch1
rev = ReverseList(List=bang_30.Branch0)  # -> graft(List)
tweencrv_7 = TweenCurve(CurveA=flip_13.Curve, CurveB=bang_29.Branch1, Factor=0.5, BlendType=0)
number_slider_66 = Slider(2, range=-10..11)
graft_5 = GraftTree(Tree=bang_30.Branch1, IncludeEmptyLists=True, IncludeNullItems=True)
Z_51 = UnitZ(Factor=number_slider_66)
move_35 = Move(Geometry=tweencrv_7, Motion=expr("-x", Z_51))  # -> Geometry, Transform
pshift = ShiftPaths(Data=graft_5, Offset=1)  # -> graft(Data)
divide_36 = DivideCurve(Curve=move_35.Geometry, Count=number_slider_33, Kinks=False)  # -> graft(Points), Tangents, Parameters
path_mapper_3 = PathMapper(divide_36.Points, source="{A;B;C}", target="{B;C}")
path_mapper_4 = PathMapper(pshift, source="{A;B}", target="{B;A}")
arc_7 = Arc3Pt(PointA=rev, PointB=path_mapper_3, PointC=path_mapper_4)  # -> Arc, Plane, Radius

bang_31 = ExplodeTree(Data=simplify(graft(dispatch_8.ListB)))  # -> Branch0, Branch1
flip_14 = FlipCurve(Curve=bang_31.Branch0)  # -> Curve, Flag
bang_32 = ExplodeTree(Data=simplify(divide_21.Points))  # -> Branch0, Branch1
rev_2 = ReverseList(List=bang_32.Branch0)  # -> graft(List)
tweencrv_8 = TweenCurve(CurveA=flip_14.Curve, CurveB=bang_31.Branch1, Factor=0.5, BlendType=0)
graft_6 = GraftTree(Tree=bang_32.Branch1, IncludeEmptyLists=True, IncludeNullItems=True)
Z_52 = UnitZ(Factor=number_slider_66)
move_36 = Move(Geometry=tweencrv_8, Motion=expr("-x", Z_52))  # -> Geometry, Transform
pshift_2 = ShiftPaths(Data=graft_6, Offset=1)  # -> graft(Data)
divide_37 = DivideCurve(Curve=move_36.Geometry, Count=number_slider_33, Kinks=False)  # -> graft(Points), Tangents, Parameters
path_mapper_5 = PathMapper(divide_37.Points, source="{A;B;C}", target="{B;C}")
path_mapper_6 = PathMapper(pshift_2, source="{A;B}", target="{B;A}")
arc_8 = Arc3Pt(PointA=rev_2, PointB=path_mapper_5, PointC=path_mapper_6)  # -> Arc, Plane, Radius

bang_33 = ExplodeTree(Data=arc_7.Arc)  # -> Branch0, Branch1, Branch2, Branch3, Branch4, Branch5, Branch6, Branch7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
bang_34 = ExplodeTree(Data=arc_8.Arc)  # -> Branch0, Branch1, Branch2, Branch3, Branch4, Branch5, Branch6, Branch7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
loft_33 = Loft(
    Curves=flatten([bang_33.Branch10, bang_33.Branch11]),
    Options={Adjust=False, Closed=False, LoftEnds=0, LoftSimp=0, LoftType=0, Rebuild=10, Refit=0.01})
loft_34 = Loft(
    Curves=flatten([bang_33.Branch0, bang_33.Branch1]),
    Options={Adjust=False, Closed=False, LoftEnds=0, LoftSimp=0, LoftType=0, Rebuild=10, Refit=0.01})
loft_35 = Loft(
    Curves=flatten([bang_33.Branch2, bang_33.Branch3]),
    Options={Adjust=False, Closed=False, LoftEnds=0, LoftSimp=0, LoftType=0, Rebuild=10, Refit=0.01})
loft_36 = Loft(
    Curves=flatten([bang_33.Branch4, bang_33.Branch5]),
    Options={Adjust=False, Closed=False, LoftEnds=0, LoftSimp=0, LoftType=0, Rebuild=10, Refit=0.01})
loft_37 = Loft(
    Curves=flatten([bang_33.Branch6, bang_33.Branch7]),
    Options={Adjust=False, Closed=False, LoftEnds=0, LoftSimp=0, LoftType=0, Rebuild=10, Refit=0.01})
loft_38 = Loft(
    Curves=flatten([bang_33.Branch8, bang_33.Branch9]),
    Options={Adjust=False, Closed=False, LoftEnds=0, LoftSimp=0, LoftType=0, Rebuild=10, Refit=0.01})
loft_39 = Loft(
    Curves=flatten([bang_34.Branch1, bang_34.Branch2]),
    Options={Adjust=False, Closed=False, LoftEnds=0, LoftSimp=0, LoftType=0, Rebuild=10, Refit=0.01})
loft_40 = Loft(
    Curves=flatten([bang_34.Branch3, bang_34.Branch4]),
    Options={Adjust=False, Closed=False, LoftEnds=0, LoftSimp=0, LoftType=0, Rebuild=10, Refit=0.01})
loft_41 = Loft(
    Curves=flatten([bang_34.Branch5, bang_34.Branch6]),
    Options={Adjust=False, Closed=False, LoftEnds=0, LoftSimp=0, LoftType=0, Rebuild=10, Refit=0.01})
loft_42 = Loft(
    Curves=flatten([bang_34.Branch7, bang_34.Branch8]),
    Options={Adjust=False, Closed=False, LoftEnds=0, LoftSimp=0, LoftType=0, Rebuild=10, Refit=0.01})
loft_43 = Loft(
    Curves=flatten([bang_34.Branch9, bang_34.Branch10]),
    Options={Adjust=False, Closed=False, LoftEnds=0, LoftSimp=0, LoftType=0, Rebuild=10, Refit=0.01})
flip_15 = Flip(Surface=[loft_39, loft_40, loft_41, loft_42, loft_43])  # -> Surface, Result
edges_28 = BrepEdges(Brep=[loft_34, loft_35, loft_36, loft_37, loft_38, loft_33])  # -> Naked, Interior, NonManifold
edges_29 = BrepEdges(Brep=flip_15.Surface)  # -> Naked, Interior, NonManifold
cull_15 = CullPattern(List=edges_28.Naked, CullPattern=[True, False])
shift_8 = ShiftList(List=divide_35.Points, Shift=2, Wrap=invert(True))  # -> simplify(List)
cull_16 = CullPattern(List=edges_29.Naked, CullPattern=[True, False])
ln_23 = Line(StartPoint=shift_8, EndPoint=divide_25.Points)

number_slider_67 = Slider(20, range=0..100)
item_63 = ListItem(List=cull_3, Index=0, Wrap=True)
range_14 = Range(Domain=Domain(0, 1), Steps=number_slider_67)
divide_38 = DivideCurve(Curve=item_63, Count=number_slider_67, Kinks=False)  # -> Points, Tangents, Parameters
graph_13 = GraphMapper(range_14, x0=0, x1=1, y0=0, y1=1, container_name="Sine", Equation_px=[0, 0.4951313436], Equation_py=[1, 0.4908394217])
Z_53 = UnitZ(Factor=1)

graph_14 = GraphMapper(
    range_14,
    x0=0,
    x1=1,
    y0=0,
    y1=1,
    container_name="Bezier",
    cpx=[0, 0.4113026559, 0.5921719074, 1],
    cpy=[1, 1, 0.8718845844, 0.1669567823])

multiplication_13 = Multiplication(A=graph_14, B=Slider(8, range=0..10))
amp_13 = Amplitude(Vector=Z_53, Amplitude=multiplication_13)
move_37 = Move(Geometry=divide_38.Points, Motion=amp_13)  # -> Geometry, Transform
intcrv_15 = Interpolate(Vertices=move_37.Geometry, Degree=3, Periodic=False, KnotStyle=1)  # -> Curve, Length, Domain
loft_44 = Loft(
    Curves=flatten([intcrv_15.Curve, item_63]),
    Options={Adjust=False, Closed=False, LoftEnds=0, LoftSimp=0, LoftType=0, Rebuild=10, Refit=0.01})

flip_16 = Flip(Surface=loft_44)  # -> Surface, Result
cluster_9 = Cluster_2(start_and_end_curve=[item_32, intcrv_15.Curve], tween_curve_a=item_32, tween_curve_b=intcrv_15.Curve, S=flip_16.Surface)
edges_30 = BrepEdges(Brep=loft_44)  # -> Naked, Interior, NonManifold
cluster_10 = Cluster(G=loft_44, A=Slider(0.3, range=0..1))
item_64 = ListItem(List=edges_30.Naked, Index=number_slider_22, Wrap=True)
divide_39 = DivideDomain²(Domain=cluster_9, UCount=Slider(1, range=0..10), VCount=Slider(12, range=0..100))
subsrf_5 = Isotrim(Surface=cluster_9, Domain=divide_39)
edges_31 = BrepEdges(Brep=loft_44)  # -> Naked, Interior, NonManifold
item_65 = ListItem(List=edges_31.Naked, Index=number_slider_24, Wrap=True)

number_slider_68 = Slider(20, range=0..100)
range_15 = Range(Domain=Domain(0, 1), Steps=number_slider_68)
divide_40 = DivideCurve(Curve=item_34, Count=number_slider_68, Kinks=False)  # -> Points, Tangents, Parameters
graph_15 = GraphMapper(range_15, x0=0, x1=1, y0=0, y1=1, container_name="Sine", Equation_px=[0, 0.5000813603], Equation_py=[0.4971481562, 1])
Z_54 = UnitZ(Factor=1)

graph_16 = GraphMapper(
    range_15,
    x0=0,
    x1=1,
    y0=0,
    y1=1,
    container_name="Bezier",
    cpx=[0, 0.2478275001, 0.6072449684, 1],
    cpy=[0.1942032576, 1, 0.8144920468, 0.5014489293])

multiplication_14 = Multiplication(A=graph_16, B=Slider(8, range=0..10))
amp_14 = Amplitude(Vector=Z_54, Amplitude=multiplication_14)
move_38 = Move(Geometry=divide_40.Points, Motion=amp_14)  # -> Geometry, Transform
intcrv_16 = Interpolate(Vertices=move_38.Geometry, Degree=3, Periodic=False, KnotStyle=1)  # -> Curve, Length, Domain
loft_45 = Loft(
    Curves=flatten([item_34, intcrv_16.Curve]),
    Options={Adjust=False, Closed=False, LoftEnds=0, LoftSimp=0, LoftType=0, Rebuild=10, Refit=0.01})

flip_17 = Flip(Surface=loft_45)  # -> Surface, Result
edges_32 = BrepEdges(Brep=loft_45)  # -> Naked, Interior, NonManifold
cluster_11 = Cluster(G=loft_45, A=Slider(0.3, range=0..1))
cluster_12 = Cluster_2(start_and_end_curve=[item_31, intcrv_16.Curve], tween_curve_a=item_31, tween_curve_b=intcrv_16.Curve, S=flip_17.Surface)
item_66 = ListItem(List=edges_32.Naked, Index=number_slider_22, Wrap=True)
divide_41 = DivideDomain²(Domain=cluster_12, UCount=Slider(1, range=0..10), VCount=Slider(12, range=0..100))
subsrf_6 = Isotrim(Surface=cluster_12, Domain=divide_41)
edges_33 = BrepEdges(Brep=loft_45)  # -> Naked, Interior, NonManifold
item_67 = ListItem(List=edges_33.Naked, Index=number_slider_24, Wrap=True)
flip_18 = FlipCurve(Curve=item_67)  # -> Curve, Flag
loft_46 = Loft(
    Curves=flatten([flip_18.Curve, item_65]),
    Options={Adjust=False, Closed=False, LoftEnds=0, LoftSimp=0, LoftType=0, Rebuild=10, Refit=0.01})
m_rhombitrihexagonal_2 = RhombitrihexagonalTiling(
    S=[loft_29, loft_30, loft_45, loft_44, loft_21, loft_20],
    O=0,
    U=division,
    V=number_slider_26,
    F=False,
    T=0.366025,
    C=Toggle(True))  # -> out, M; inputs S: Surface; same code as m_rhombitrihexagonal
medges_12 = MeshEdges(Mesh=m_rhombitrihexagonal_2.M)  # -> NakedEdges, InteriorEdges, NonManifoldEdges
move_39 = Move(Geometry=[loft_31, loft_46, loft_22], Motion=Z_23)  # -> Geometry, Transform
extr_14 = Extrude(Base=move_39.Geometry, Direction=Z_24)
edges_34 = BrepEdges(Brep=[subsrf_6, subsrf_3, subsrf_5, subsrf, subsrf_2, subsrf_4])  # -> Naked, Interior, NonManifold
bang_35 = ExplodeTree(Data=graft(move_39.Geometry))  # -> Branch0, Branch1, Branch2
edges_35 = BrepEdges(Brep=loft_46)  # -> Naked, Interior, NonManifold
pipe_4 = Pipe(Curve=edges_34.Naked, Radius=Slider(0.1, range=0..1), Caps=0)
edges_36 = BrepEdges(Brep=bang_35.Branch2)  # -> Naked, Interior, NonManifold
edges_37 = BrepEdges(Brep=bang_35.Branch0)  # -> Naked, Interior, NonManifold
edges_38 = BrepEdges(Brep=bang_35.Branch1)  # -> Naked, Interior, NonManifold
join_13 = JoinCurves(Curves=edges_37.Naked, Preserve=False)
join_14 = JoinCurves(Curves=edges_36.Naked, Preserve=False)
join_15 = JoinCurves(Curves=edges_38.Naked, Preserve=False)
join_16 = JoinCurves(Curves=edges_35.Naked, Preserve=False)
loft_47 = Loft(
    Curves=flatten([join_15, join_16]),
    Options={Adjust=False, Closed=False, LoftEnds=0, LoftSimp=0, LoftType=0, Rebuild=10, Refit=0.01})
loft_48 = Loft(
    Curves=flatten([join_13, join_12]),
    Options={Adjust=False, Closed=False, LoftEnds=0, LoftSimp=0, LoftType=0, Rebuild=10, Refit=0.01})
loft_49 = Loft(
    Curves=flatten([join_14, join_9]),
    Options={Adjust=False, Closed=False, LoftEnds=0, LoftSimp=0, LoftType=0, Rebuild=10, Refit=0.01})
len_18 = Length(Curve=edges_37.Naked)
len_19 = Length(Curve=edges_38.Naked)
len_20 = Length(Curve=edges_35.Naked)
len_21 = Length(Curve=edges_36.Naked)
smaller_13 = SmallerThan(FirstNumber=len_18, SecondNumber=25)  # -> SmallerThan, OrEqualTo
smaller_14 = SmallerThan(FirstNumber=len_19, SecondNumber=25)  # -> SmallerThan, OrEqualTo
smaller_15 = SmallerThan(FirstNumber=len_20, SecondNumber=25)  # -> SmallerThan, OrEqualTo
smaller_16 = SmallerThan(FirstNumber=len_21, SecondNumber=25)  # -> SmallerThan, OrEqualTo
dispatch_32 = Dispatch(List=edges_37.Naked, DispatchPattern=smaller_13.SmallerThan)  # -> ListA, ListB
dispatch_33 = Dispatch(List=edges_38.Naked, DispatchPattern=smaller_14.SmallerThan)  # -> ListA, ListB
dispatch_34 = Dispatch(List=edges_35.Naked, DispatchPattern=smaller_15.SmallerThan)  # -> ListA, ListB
bang_36 = ExplodeTree(Data=simplify(dispatch_34.ListB))  # -> Branch0, Branch1
dispatch_35 = Dispatch(List=edges_36.Naked, DispatchPattern=smaller_16.SmallerThan)  # -> ListA, ListB
divide_42 = DivideCurve(Curve=dispatch_32.ListB, Count=number_slider_33, Kinks=False)  # -> Points, Tangents, Parameters
divide_43 = DivideCurve(Curve=dispatch_33.ListA, Count=number_slider_32, Kinks=False)  # -> Points, Tangents, Parameters
divide_44 = DivideCurve(Curve=dispatch_34.ListA, Count=number_slider_32, Kinks=False)  # -> Points, Tangents, Parameters
divide_45 = DivideCurve(Curve=dispatch_34.ListB, Count=number_slider_33, Kinks=False)  # -> Points, Tangents, Parameters
divide_46 = DivideCurve(Curve=dispatch_35.ListA, Count=number_slider_32, Kinks=False)  # -> Points, Tangents, Parameters
divide_47 = DivideCurve(Curve=dispatch_35.ListB, Count=number_slider_33, Kinks=False)  # -> Points, Tangents, Parameters
divide_48 = DivideCurve(Curve=dispatch_32.ListA, Count=number_slider_32, Kinks=False)  # -> Points, Tangents, Parameters
divide_49 = DivideCurve(Curve=dispatch_33.ListB, Count=number_slider_33, Kinks=False)  # -> Points, Tangents, Parameters

bang_37 = ExplodeTree(Data=simplify(graft(dispatch_34.ListB)))  # -> Branch0, Branch1
flip_19 = FlipCurve(Curve=bang_37.Branch0)  # -> Curve, Flag
bang_38 = ExplodeTree(Data=simplify(divide_45.Points))  # -> Branch0, Branch1
rev_3 = ReverseList(List=bang_38.Branch0)  # -> graft(List)
tweencrv_9 = TweenCurve(CurveA=flip_19.Curve, CurveB=bang_37.Branch1, Factor=0.5, BlendType=0)
graft_7 = GraftTree(Tree=bang_38.Branch1, IncludeEmptyLists=True, IncludeNullItems=True)
Z_55 = UnitZ(Factor=number_slider_66)
move_40 = Move(Geometry=tweencrv_9, Motion=expr("-x", Z_55))  # -> Geometry, Transform
pshift_3 = ShiftPaths(Data=graft_7, Offset=1)  # -> graft(Data)
divide_50 = DivideCurve(Curve=move_40.Geometry, Count=number_slider_33, Kinks=False)  # -> graft(Points), Tangents, Parameters
path_mapper_7 = PathMapper(divide_50.Points, source="{A;B;C}", target="{B;C}")
path_mapper_8 = PathMapper(pshift_3, source="{A;B}", target="{B;A}")
arc_9 = Arc3Pt(PointA=rev_3, PointB=path_mapper_7, PointC=path_mapper_8)  # -> Arc, Plane, Radius

shift_9 = ShiftList(List=divide_42.Points, Shift=1, Wrap=invert(True))
shift_10 = ShiftList(List=divide_43.Points, Shift=1, Wrap=invert(True))
shift_11 = ShiftList(List=divide_49.Points, Shift=1, Wrap=invert(True))
shift_12 = ShiftList(List=divide_46.Points, Shift=1, Wrap=invert(True))
shift_13 = ShiftList(List=divide_47.Points, Shift=1, Wrap=invert(True))
shift_14 = ShiftList(List=divide_48.Points, Shift=1, Wrap=invert(True))
ln_24 = Line(StartPoint=divide_48.Points, EndPoint=divide_34.Points)
ln_25 = Line(StartPoint=shift_14, EndPoint=divide_34.Points)
ln_26 = Line(StartPoint=divide_42.Points, EndPoint=divide_35.Points)
ln_27 = Line(StartPoint=shift_9, EndPoint=divide_35.Points)
ln_28 = Line(StartPoint=divide_43.Points, EndPoint=divide_44.Points)
ln_29 = Line(StartPoint=shift_10, EndPoint=divide_44.Points)
ln_30 = Line(StartPoint=divide_49.Points, EndPoint=divide_45.Points)
ln_31 = Line(StartPoint=shift_11, EndPoint=divide_45.Points)
ln_32 = Line(StartPoint=divide_46.Points, EndPoint=divide_20.Points)
ln_33 = Line(StartPoint=shift_12, EndPoint=divide_20.Points)
ln_34 = Line(StartPoint=divide_47.Points, EndPoint=divide_21.Points)
ln_35 = Line(StartPoint=shift_13, EndPoint=divide_21.Points)
srf_11 = Surface([cluster_5, cluster_12, cluster_9, loft_32, cluster, cluster_2])
filter_3 = StreamFilter(Gate=Toggle(True), Stream0=[loft_20, loft_21, loft_44, loft_45, loft_30, loft_29], Stream1=srf_11)
m_cairo = CairoTiling(S=filter_3, U=Slider(4, range=0..10), V=Slider(55, range=0..100), T=0.211325)  # -> out, M; inputs S: Surface
# ---------- m_cairo: VB ----------
    Component.Params.Input(0).Name = "Surface"
    Component.Params.Input(0).Description = "The base surface to mesh"
    Component.Params.Input(1).Name = "U Count"
    Component.Params.Input(1).Description = "The number of quads in the U direction"
    Component.Params.Input(2).Name = "V Count"
    Component.Params.Input(2).Description = "The number of quads in the V direction"
    Component.Params.Input(3).Name = "Evaluate"
    Component.Params.Input(3).Description = "A unitized value which symmetrically shifts the location of internal vertices within each new quad"

    Component.Params.Output(1).Name = "Mesh"
    Component.Params.Output(1).Description = "If successful, the resulting mesh"

    If s IsNot Nothing Then
      Dim i,j,k As Integer
      Dim wu,wv As New list(Of Integer)
      Dim bu, bv As Boolean
      Dim cu, cv,au,av As Integer
      Dim arrPts As New list(Of point3d)
      Dim arrFaces As New list(Of MeshFace)
      Dim mo As New mesh
      Dim mv As New list(Of point3d)
      Dim mf As New list(Of meshface)
      Dim uva(,) As Integer
      Dim uvb(,) As Integer
      Dim uvc(,) As Integer

      U += 1
      V += 1
      bu = s.IsClosed(0)
      bv = s.IsClosed(1)

      S.SetDomain(0, New interval(0, 1))
      S.SetDomain(1, New interval(0, 1))

      If (bu And (u Mod 2)) Then
        wu = appendprepend(U)
        cu = u - 1
        au = 1
      Else
        wu = series(U)
        cu = u
        au = 0
      end if

      If (bv And (v Mod 2)) Then
        wv = appendprepend(V)
        cv = v - 1
        av = 1
      Else
        wv = series(V)
        cV = v
        av = 0
      End If

      ReDim uva(cu - 1, cv - 1)
      ReDim uvb(cu - 1, cv - 1)
      ReDim uvc(cu - 1, cv - 1)

      For i = 0 To cu - 1 Step 1
        For j = 0 To cv - 1 Step 1
          mv.add(S.PointAt(i * (1 / (U - 1)), j * (1 / (V - 1))))
          uva(i, j) = k
          k += 1
        Next
      Next

      For i = 0 To cu - 1 Step 1
        For j = 0 To cv - 1 Step 1
          Dim pt(1) As point3d

          pt(0) = S.PointAt(i * (1 / (U - 1)), j * (1 / (V - 1)))
          pt(1) = S.PointAt(i * (1 / (U - 1)), (j + 1) * (1 / (V - 1)))

          mv.add(evalP(pt((i + j) Mod 2), pt((i + j + 1) Mod 2), t))
          uvb(i, j) = k
          k += 1
        Next
      Next

      For i = 0 To u - 2 Step 1
        For j = 0 To cv - 1 Step 1
          Dim pt(1) As point3d

          pt(0) = S.PointAt((i + 1) * (1 / (U - 1)), j * (1 / (V - 1)))
          pt(1) = S.PointAt(i * (1 / (U - 1)), j * (1 / (V - 1)))

          mv.add(evalP(pt((i + j) Mod 2), pt((i + j + 1) Mod 2), t))
          uvc(i, j) = k
          k += 1
        Next
      Next

      For i = 0 To cu - 1 Step 1
        For j = 0 To v - 2 Step 1
          mv.add(S.PointAt((1 / (U - 1)) / 2 + i * (1 / (U - 1)), (1 / (V - 1)) / 2 + j * (1 / (V - 1))))
        Next
      Next

      For i = 0 To u - 2 Step 1
        For j = 0 To v - 2 Step 1
          mf.add(New MeshFace(uvc(i, j), k, uvb(wu(i), j), uva(wu(i), j)))
          mf.add(New MeshFace(uvb(wu(i), j), k, uvc(i, wv(j + 1)), uva(wu(i), wv(j + 1))))
          mf.add(New MeshFace(uvc(i, wv(j + 1)), k, uvb(wu(i + 1), j), uva(wu(i + 1), wv(j + 1))))
          mf.add(New MeshFace(uvb(wu(i + 1), j), k, uvc(i, j), uva(wu(i + 1), j)))
          k += 1
        Next
      Next
      mo.Vertices.AddVertices(mv.toarray())
      mo.Faces.AddFaces(mf.toarray())
      mo.FaceNormals.ComputeFaceNormals()
      mo.Normals.ComputeNormals()
      

      M = mo
    End If
# ---------- m_cairo: VB additional code ----------
  Private Function appendprepend(ByVal i As Integer)
    Dim srsEnum As IEnumerable(Of Integer) = Enumerable.Range(0, i - 1)
    Dim arrVal As New list(Of Integer)
    arrVal = srsEnum.tolist()
    arrVal.add(0)
    Return arrVal
  End Function

  Private Function series(ByVal i As Integer)
    Dim srsEnum As IEnumerable(Of Integer) = Enumerable.Range(0, i)
    Dim arrVal As New list(Of Integer)
    arrVal = srsEnum.tolist()
    Return arrVal
  End Function

  Private Function evalP(ByVal op As point3d, ByVal tp As Point3d, ByVal t As Double)
    Return New point3d(op + (tp - op) * t)
  End Function
# ---------- end m_cairo ----------
medges_13 = MeshEdges(Mesh=m_cairo.M)  # -> NakedEdges, InteriorEdges, NonManifoldEdges

# ----
# WINDSCREENS
extr_15 = Extrude(Base=subsrf_4, Direction=amp_12)
extr_16 = Extrude(Base=subsrf_3, Direction=amp_12)
extr_17 = Extrude(Base=subsrf_6, Direction=amp_12)
extr_18 = Extrude(Base=subsrf_5, Direction=amp_12)
extr_19 = Extrude(Base=loft_45, Direction=cluster_11)
extr_20 = Extrude(Base=loft_44, Direction=cluster_10)
extr_21 = Extrude(Base=subsrf, Direction=amp_12)
extr_22 = Extrude(Base=subsrf_2, Direction=amp_12)
extr_23 = Extrude(Base=flip_2.Surface, Direction=cluster_3)
extr_24 = Extrude(Base=flip_3.Surface, Direction=cluster_4)

bang_39 = ExplodeTree(Data=arc_9.Arc)  # -> Branch0, Branch1, Branch2, Branch3, Branch4, Branch5, Branch6, Branch7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
loft_50 = Loft(
    Curves=flatten([bang_39.Branch10, bang_39.Branch11]),
    Options={Adjust=False, Closed=False, LoftEnds=0, LoftSimp=0, LoftType=0, Rebuild=10, Refit=0.01})
loft_51 = Loft(
    Curves=flatten([bang_39.Branch0, bang_39.Branch1]),
    Options={Adjust=False, Closed=False, LoftEnds=0, LoftSimp=0, LoftType=0, Rebuild=10, Refit=0.01})
loft_52 = Loft(
    Curves=flatten([bang_39.Branch2, bang_39.Branch3]),
    Options={Adjust=False, Closed=False, LoftEnds=0, LoftSimp=0, LoftType=0, Rebuild=10, Refit=0.01})
loft_53 = Loft(
    Curves=flatten([bang_39.Branch6, bang_39.Branch7]),
    Options={Adjust=False, Closed=False, LoftEnds=0, LoftSimp=0, LoftType=0, Rebuild=10, Refit=0.01})
loft_54 = Loft(
    Curves=flatten([bang_39.Branch8, bang_39.Branch9]),
    Options={Adjust=False, Closed=False, LoftEnds=0, LoftSimp=0, LoftType=0, Rebuild=10, Refit=0.01})
loft_55 = Loft(
    Curves=flatten([bang_39.Branch4, bang_39.Branch5]),
    Options={Adjust=False, Closed=False, LoftEnds=0, LoftSimp=0, LoftType=0, Rebuild=10, Refit=0.01})
edges_39 = BrepEdges(Brep=[loft_51, loft_52, loft_55, loft_53, loft_54, loft_50])  # -> Naked, Interior, NonManifold
shift_15 = ShiftList(List=divide_45.Points, Shift=2, Wrap=invert(True))  # -> simplify(List)
cull_17 = CullPattern(List=edges_39.Naked, CullPattern=[True, False])
srf_12 = Surface([flip_15.Surface, loft_50, loft_54, loft_53, loft_55, loft_52, loft_51, loft_33, loft_38, loft_37, loft_36, loft_35, loft_34])
m_cairo_2 = CairoTiling(S=srf_12, U=Slider(4, range=0..10), V=Slider(5, range=0..10), T=0.211325)  # -> out, M; inputs S: Surface; same code as m_cairo
ln_36 = Line(StartPoint=shift_15, EndPoint=divide_23.Points)
medges_14 = MeshEdges(Mesh=m_cairo_2.M)  # -> NakedEdges, InteriorEdges, NonManifoldEdges
crv_24 = Curve([edges_27.Naked, edges_35.Naked, edges_17.Naked])
len_22 = Length(Curve=crv_24)
larger_8 = LargerThan(FirstNumber=len_22, SecondNumber=Slider(25, range=0..100))  # -> LargerThan, OrEqualTo
cull_18 = CullPattern(List=crv_24, CullPattern=larger_8.LargerThan)
dispatch_36 = Dispatch(List=cull_18, DispatchPattern=[True, False])  # -> ListA, ListB
flip_20 = FlipCurve(Curve=dispatch_36.ListB)  # -> Curve, Flag
bang_40 = ExplodeTree(Data=graft(dispatch_36.ListA))  # -> Branch0, Branch1, Branch2
bang_41 = ExplodeTree(Data=graft(flip_20.Curve))  # -> Branch0, Branch1, Branch2
curvepoint_7 = PointOnCurve(bang_40.Branch0, parameter=0.898)
curvepoint_8 = PointOnCurve(bang_40.Branch0, parameter=0.503)
curvepoint_9 = PointOnCurve(bang_40.Branch1, parameter=0.1)
curvepoint_10 = PointOnCurve(bang_40.Branch1, parameter=0.503)
curvepoint_11 = PointOnCurve(bang_40.Branch2, parameter=0.299)
curvepoint_12 = PointOnCurve(bang_40.Branch2, parameter=0.699)
curvepoint_13 = PointOnCurve(bang_41.Branch0, parameter=0.898)
curvepoint_14 = PointOnCurve(bang_41.Branch0, parameter=0.503)
curvepoint_15 = PointOnCurve(bang_41.Branch1, parameter=0.1)
curvepoint_16 = PointOnCurve(bang_41.Branch1, parameter=0.503)
curvepoint_17 = PointOnCurve(bang_41.Branch2, parameter=0.299)
curvepoint_18 = PointOnCurve(bang_41.Branch2, parameter=0.699)
pt_15 = Point([curvepoint_7, curvepoint_8, curvepoint_9, curvepoint_10, curvepoint_11, curvepoint_12])
pt_16 = Point([curvepoint_13, curvepoint_14, curvepoint_15, curvepoint_16, curvepoint_17, curvepoint_18])
crv_cp_15 = CurveClosestPoint(Point=pt_15, Curve=[bang_40.Branch0, bang_40.Branch1, bang_40.Branch2])  # -> Point, Parameter, Distance
crv_cp_16 = CurveClosestPoint(Point=pt_16, Curve=[bang_41.Branch0, bang_41.Branch1, bang_41.Branch2])  # -> Point, Parameter, Distance
shatter_12 = Shatter(Curve=[bang_40.Branch0, bang_40.Branch1, bang_40.Branch2], Parameters=crv_cp_15.Parameter)  # -> simplify(Segments)
shatter_13 = Shatter(Curve=[bang_41.Branch0, bang_41.Branch1, bang_41.Branch2], Parameters=crv_cp_16.Parameter)  # -> simplify(Segments)
item_68 = ListItem(List=shatter_12, Index=1, Wrap=True)
item_69 = ListItem(List=shatter_13, Index=1, Wrap=True)
bang_42 = ExplodeTree(Data=item_69)  # -> Branch0, Branch1, Branch2
bang_43 = ExplodeTree(Data=item_68)  # -> Branch0, Branch1, Branch2
tweencrv_10 = TweenCurve(CurveA=item_68, CurveB=item_69, Factor=0.5, BlendType=0)
move_41 = Move(Geometry=tweencrv_10, Motion=Z_25)  # -> Geometry, Transform
divide_51 = DivideCurve(Curve=move_41.Geometry, Count=10, Kinks=False)  # -> Points, Tangents, Parameters
divide_52 = DivideCurve(Curve=item_68, Count=10, Kinks=False)  # -> Points, Tangents, Parameters
divide_53 = DivideCurve(Curve=item_69, Count=10, Kinks=False)  # -> Points, Tangents, Parameters
loft_56 = Loft(
    Curves=flatten([bang_43.Branch0, bang_42.Branch0]),
    Options={Adjust=False, Closed=False, LoftEnds=0, LoftSimp=0, LoftType=0, Rebuild=10, Refit=0.01})
loft_57 = Loft(
    Curves=flatten([bang_43.Branch1, bang_42.Branch1]),
    Options={Adjust=False, Closed=False, LoftEnds=0, LoftSimp=0, LoftType=0, Rebuild=10, Refit=0.01})
loft_58 = Loft(
    Curves=flatten([bang_43.Branch2, bang_42.Branch2]),
    Options={Adjust=False, Closed=False, LoftEnds=0, LoftSimp=0, LoftType=0, Rebuild=10, Refit=0.01})
arc_10 = Arc3Pt(PointA=divide_52.Points, PointB=divide_51.Points, PointC=divide_53.Points)  # -> Arc, Plane, Radius
area_5 = Area(Geometry=loft_57)  # -> Area, Centroid
area_6 = Area(Geometry=loft_58)  # -> Area, Centroid
shift_16 = ShiftList(List=divide_52.Points, Shift=Slider(6, range=0..10), Wrap=True)
loft_59 = Loft(Curves=arc_10.Arc, Options={Adjust=False, Closed=False, LoftEnds=0, LoftSimp=0, LoftType=0, Rebuild=10, Refit=0.01})
bang_44 = ExplodeTree(Data=loft_59)  # -> Branch0, Branch1, Branch2

area_7 = Area(Geometry=bang_44.Branch0)  # -> Area, Centroid
circle_5 = CircleCNR(Center=area_7.Centroid, Normal=Vector(0, 0, 1), Radius=Slider(2.2, range=0..10))
Z_56 = UnitZ(Factor=Slider(20, range=0..100))
neg_9 = Negative(Value=Slider(10, range=0..10))
Z_57 = UnitZ(Factor=neg_9)
move_42 = Move(Geometry=circle_5, Motion=Z_57)  # -> Geometry, Transform
extr_25 = Extrude(Base=move_42.Geometry, Direction=Z_56)
join_17 = BrepJoin(Breps=extr_25)  # -> Breps, Closed

area_8 = Area(Geometry=bang_44.Branch1)  # -> Area, Centroid
circle_6 = CircleCNR(Center=area_8.Centroid, Normal=Vector(0, 0, 1), Radius=Slider(2.2, range=0..10))
Z_58 = UnitZ(Factor=Slider(20, range=0..100))
neg_10 = Negative(Value=Slider(11, range=0..100))
Z_59 = UnitZ(Factor=neg_10)
move_43 = Move(Geometry=circle_6, Motion=Z_59)  # -> Geometry, Transform
extr_26 = Extrude(Base=move_43.Geometry, Direction=Z_58)
join_18 = BrepJoin(Breps=extr_26)  # -> Breps, Closed

area_9 = Area(Geometry=bang_44.Branch2)  # -> Area, Centroid
number_slider_69 = Slider(10, range=0..10)
circle_7 = CircleCNR(Center=area_9.Centroid, Normal=Vector(0, 0, 1), Radius=Slider(2.2, range=0..10))
Z_60 = UnitZ(Factor=Slider(20, range=0..100))
neg_11 = Negative(Value=Slider(12, range=0..100))
Z_61 = UnitZ(Factor=neg_11)
move_44 = Move(Geometry=circle_7, Motion=Z_61)  # -> Geometry, Transform
extr_27 = Extrude(Base=move_44.Geometry, Direction=Z_60)
join_19 = BrepJoin(Breps=extr_27)  # -> Breps, Closed

item_70 = ListItem(List=arc_10.Arc, Index=0, Wrap=True)  # -> Item1, Item
bang_45 = ExplodeTree(Data=item_70.Item)  # -> Branch0, Branch1, Branch2
bang_46 = ExplodeTree(Data=item_70.Item1)  # -> Branch0, Branch1, Branch2

curvepoint_19 = PointOnCurve(bang_41.Branch0, parameter=0.403)
curvepoint_20 = PointOnCurve(bang_40.Branch0, parameter=0.4)
curvepoint_21 = PointOnCurve(bang_45.Branch0, parameter=0.5)
flatten_7 = FlattenTree(Tree=[curvepoint_20, curvepoint_21, curvepoint_19], Path="{0}")
flip_21 = FlipCurve(Curve=bang_45.Branch0)  # -> Curve, Flag
shift_17 = ShiftList(List=flatten_7, Shift=Slider(2, range=0..10), Wrap=True)
intcrv_17 = Interpolate(Vertices=shift_17, Degree=3, Periodic=False, KnotStyle=1)  # -> Curve, Length, Domain
loft_60 = Loft(
    Curves=flatten([flip_21.Curve, intcrv_17.Curve]),
    Options={Adjust=False, Closed=False, LoftEnds=0, LoftSimp=0, LoftType=0, Rebuild=10, Refit=0.01})

curvepoint_22 = PointOnCurve(bang_40.Branch0, parameter=1)
curvepoint_23 = PointOnCurve(bang_46.Branch0, parameter=0.5)
curvepoint_24 = PointOnCurve(bang_41.Branch0, parameter=1)
flatten_8 = FlattenTree(Tree=[curvepoint_22, curvepoint_23, curvepoint_24], Path="{0}")
flip_22 = FlipCurve(Curve=bang_46.Branch0)  # -> Curve, Flag
shift_18 = ShiftList(List=flatten_8, Shift=Slider(2, range=0..10), Wrap=True)
intcrv_18 = Interpolate(Vertices=shift_18, Degree=3, Periodic=False, KnotStyle=1)  # -> Curve, Length, Domain
loft_61 = Loft(
    Curves=flatten([flip_22.Curve, intcrv_18.Curve]),
    Options={Adjust=False, Closed=False, LoftEnds=0, LoftSimp=0, LoftType=0, Rebuild=10, Refit=0.01})

geodesic = Geodesic(Surface=loft_59, Start=divide_53.Points, End=shift_16)

curvepoint_25 = PointOnCurve(bang_46.Branch1, parameter=0.5)
curvepoint_26 = PointOnCurve(bang_40.Branch1, parameter=0.601)
curvepoint_27 = PointOnCurve(bang_41.Branch1, parameter=0.601)
flatten_9 = FlattenTree(Tree=[curvepoint_27, curvepoint_25, curvepoint_26], Path="{0}")
flip_23 = FlipCurve(Curve=bang_46.Branch1)  # -> Curve, Flag
shift_19 = ShiftList(List=flatten_9, Shift=Slider(1, range=0..10), Wrap=True)
intcrv_19 = Interpolate(Vertices=shift_19, Degree=3, Periodic=False, KnotStyle=1)  # -> Curve, Length, Domain
loft_62 = Loft(
    Curves=flatten([bang_46.Branch1, intcrv_19.Curve]),
    Options={Adjust=False, Closed=False, LoftEnds=0, LoftSimp=0, LoftType=0, Rebuild=10, Refit=0.01})

curvepoint_28 = PointOnCurve(bang_40.Branch1, parameter=0)
curvepoint_29 = PointOnCurve(bang_45.Branch1, parameter=0.5)
curvepoint_30 = PointOnCurve(bang_41.Branch1, parameter=0)
flatten_10 = FlattenTree(Tree=[curvepoint_28, curvepoint_29, curvepoint_30], Path="{0}")
flip_24 = FlipCurve(Curve=bang_45.Branch1)  # -> Curve, Flag
shift_20 = ShiftList(List=flatten_10, Shift=Slider(1, range=0..10), Wrap=True)
intcrv_20 = Interpolate(Vertices=shift_20, Degree=3, Periodic=False, KnotStyle=1)  # -> Curve, Length, Domain
loft_63 = Loft(
    Curves=flatten([flip_24.Curve, intcrv_20.Curve]),
    Options={Adjust=False, Closed=False, LoftEnds=0, LoftSimp=0, LoftType=0, Rebuild=10, Refit=0.01})

srf_13 = Surface([loft_60, loft_61])
join_20 = BrepJoin(Breps=flatten([srf_13, bang_44.Branch0]))  # -> Breps, Closed
edges_40 = BrepEdges(Brep=join_20.Breps)  # -> Naked, Interior, NonManifold
bang_47 = ExplodeTree(Data=simplify(graft(edges_40.Naked)))  # -> Branch0, Branch1, Branch2, Branch3, Branch4, Branch5, Branch6, Branch7
join_21 = JoinCurves(Curves=flatten([bang_47.Branch0, bang_47.Branch3, bang_47.Branch7]), Preserve=False)
join_22 = JoinCurves(Curves=flatten([bang_47.Branch2, bang_47.Branch5, bang_47.Branch6]), Preserve=False)
reb_3 = RebuildCurve(Curve=join_21, Count=10, Tangents=False)
reb_4 = RebuildCurve(Curve=join_22, Count=10, Tangents=False)
edgesrf_6 = EdgeSurface(CurveA=reb_3, CurveB=bang_47.Branch1, CurveC=reb_4, CurveD=bang_47.Branch4)
area_10 = Area(Geometry=move_42.Geometry)  # -> Area, Centroid
split_11 = SplitBrep(Brep=edgesrf_6, Cutter=join_17.Breps)
range_16 = Range(Domain=Domain(0, 1), Steps=10)
item_71 = ListItem(List=split_11, Index=Slider(0, range=0..1), Wrap=True)
mesh_9 = MeshBrep(
    Brep=item_71,
    Settings={GridMaxCount=0, GridMinCount=16, JaggedSeams=False, MaxEdgeLength=0, MinEdgeLength=0.0001, MinTolerance=0, Refine=True, RefineAngle=0, RelativeTolerance=0.65, SimplePlanes=True, Tolerance=0})
medges_15 = MeshEdges(Mesh=mesh_9)  # -> NakedEdges, InteriorEdges, NonManifoldEdges
join_23 = JoinCurves(Curves=medges_15.NakedEdges, Preserve=False)
item_72 = ListItem(List=reverse(join_23), Index=0, Wrap=True)
project_14 = Project(Geometry=item_72, Plane=area_10.Centroid)  # -> Geometry, Transform
tweencrv_11 = TweenCurve(CurveA=item_72, CurveB=project_14.Geometry, Factor=range_16, BlendType=0)
shift_21 = ShiftList(List=tweencrv_11, Shift=-1, Wrap=False)  # -> graft(List)
shift_22 = ShiftList(List=tweencrv_11, Shift=1, Wrap=False)  # -> graft(List)
loft_64 = Loft(
    Curves=[shift_21, shift_22],
    Options={Adjust=False, Closed=False, LoftEnds=0, LoftSimp=0, LoftType=0, Rebuild=10, Refit=0.01})
debrep_5 = DeconstructBrep(Brep=loft_64)  # -> flatten(Faces), Edges, Vertices
smesh_4 = SimpleMesh(Brep=debrep_5.Faces)
mjoin_6 = MeshJoin(Meshes=flatten([smesh_4, mesh_9]))
weldvertices_6 = MeshWeldVertices(Mesh=mjoin_6, Tolerance=0.01)  # -> RuntimeMessage, Mesh
unifynormals_6 = MeshUnifyNormals(Mesh=weldvertices_6.Mesh)
nv_5 = NakedVertices(Mesh=unifynormals_6)  # -> ClothedIndex, NakedIndex, ClothedPts, NakedPts
demesh_4 = DeconstructMesh(Mesh=unifynormals_6)  # -> Vertices, Faces, Colours, Normals
item_73 = ListItem(List=demesh_4.Vertices, Index=nv_5.NakedIndex, Wrap=True)
number_slider_70 = Slider(0.4, range=0..1)
item_74 = ListItem(List=demesh_4.Vertices, Index=nv_5.ClothedIndex, Wrap=True)
medges_16 = MeshEdges(Mesh=unifynormals_6)  # -> NakedEdges, InteriorEdges, NonManifoldEdges
crv_25 = Curve([medges_16.NakedEdges, medges_16.InteriorEdges])
timer_4 = Timer(TimerInterval=20, Target=kangaroo_4)  # disabled
springs_4 = SpringsFromLine(
    Connection=crv_25,
    Stiffness=Slider(2, range=0..100),
    Damping=10,
    RestLength=0,
    UpperCutoff=0,
    LowerCutoff=0,
    Plasticity=0)
kangaroo_4 = KangarooPhysics(ForceObjects=flatten(springs_4), AnchorPoints=item_73, Settings=null, Geometry=item_74, SimulationReset=Toggle(False))  # -> Out, Iterations, ParticlesOut, GeometryOut, KE
nv_6 = NakedVertices(Mesh=unifynormals_6)  # -> ClothedIndex, NakedIndex, ClothedPts, NakedPts
pt_17 = Point(kangaroo_4.GeometryOut)
pt_18 = Point(item_73)
merge_7 = Merge(Data1=pt_17, Data2=pt_18)
merge_8 = Merge(Data1=nv_5.ClothedIndex, Data2=nv_5.NakedIndex)
sort_9 = SortList(Keys=merge_8, ValuesA=merge_7)  # -> Keys, ValuesA
conmesh_4 = ConstructMesh(Vertices=sort_9.ValuesA, Faces=demesh_4.Faces)

srf_14 = Surface([loft_62, loft_63])
join_24 = BrepJoin(Breps=flatten([bang_44.Branch1, srf_14]))  # -> Breps, Closed
edges_41 = BrepEdges(Brep=join_24.Breps)  # -> Naked, Interior, NonManifold
bang_48 = ExplodeTree(Data=simplify(graft(edges_41.Naked)))  # -> Branch0, Branch1, Branch2, Branch3, Branch4, Branch5, Branch6, Branch7
join_25 = JoinCurves(Curves=flatten([bang_48.Branch1, bang_48.Branch3, bang_48.Branch7]), Preserve=False)
join_26 = JoinCurves(Curves=flatten([bang_48.Branch0, bang_48.Branch4, bang_48.Branch6]), Preserve=False)
reb_5 = RebuildCurve(Curve=join_26, Count=10, Tangents=False)
reb_6 = RebuildCurve(Curve=join_25, Count=10, Tangents=False)
edgesrf_7 = EdgeSurface(CurveA=reb_5, CurveB=bang_48.Branch2, CurveC=reb_6, CurveD=bang_48.Branch5)
area_11 = Area(Geometry=move_43.Geometry)  # -> Area, Centroid
split_12 = SplitBrep(Brep=edgesrf_7, Cutter=join_18.Breps)
range_17 = Range(Domain=Domain(0, 1), Steps=10)
item_75 = ListItem(List=split_12, Index=Slider(0, range=0..1), Wrap=True)
mesh_10 = MeshBrep(
    Brep=item_75,
    Settings={GridMaxCount=0, GridMinCount=16, JaggedSeams=False, MaxEdgeLength=0, MinEdgeLength=0.0001, MinTolerance=0, Refine=True, RefineAngle=0, RelativeTolerance=0.65, SimplePlanes=True, Tolerance=0})
medges_17 = MeshEdges(Mesh=mesh_10)  # -> NakedEdges, InteriorEdges, NonManifoldEdges
join_27 = JoinCurves(Curves=medges_17.NakedEdges, Preserve=False)
item_76 = ListItem(List=reverse(join_27), Index=0, Wrap=True)
project_15 = Project(Geometry=item_76, Plane=area_11.Centroid)  # -> Geometry, Transform
tweencrv_12 = TweenCurve(CurveA=item_76, CurveB=project_15.Geometry, Factor=range_17, BlendType=0)
shift_23 = ShiftList(List=tweencrv_12, Shift=-1, Wrap=False)  # -> graft(List)
shift_24 = ShiftList(List=tweencrv_12, Shift=1, Wrap=False)  # -> graft(List)
loft_65 = Loft(
    Curves=[shift_23, shift_24],
    Options={Adjust=False, Closed=False, LoftEnds=0, LoftSimp=0, LoftType=0, Rebuild=10, Refit=0.01})
debrep_6 = DeconstructBrep(Brep=loft_65)  # -> flatten(Faces), Edges, Vertices
smesh_5 = SimpleMesh(Brep=debrep_6.Faces)
mjoin_7 = MeshJoin(Meshes=flatten([smesh_5, mesh_10]))
weldvertices_7 = MeshWeldVertices(Mesh=mjoin_7, Tolerance=0.01)  # -> RuntimeMessage, Mesh
unifynormals_7 = MeshUnifyNormals(Mesh=weldvertices_7.Mesh)
nv_7 = NakedVertices(Mesh=unifynormals_7)  # -> ClothedIndex, NakedIndex, ClothedPts, NakedPts
demesh_5 = DeconstructMesh(Mesh=unifynormals_7)  # -> Vertices, Faces, Colours, Normals
item_77 = ListItem(List=demesh_5.Vertices, Index=nv_7.NakedIndex, Wrap=True)
number_slider_71 = Slider(0.4, range=0..1)
item_78 = ListItem(List=demesh_5.Vertices, Index=nv_7.ClothedIndex, Wrap=True)
medges_18 = MeshEdges(Mesh=unifynormals_7)  # -> NakedEdges, InteriorEdges, NonManifoldEdges
crv_26 = Curve([medges_18.NakedEdges, medges_18.InteriorEdges])
timer_5 = Timer(TimerInterval=20, Target=kangaroo_5)  # disabled
springs_5 = SpringsFromLine(
    Connection=crv_26,
    Stiffness=Slider(2, range=0..100),
    Damping=10,
    RestLength=0,
    UpperCutoff=0,
    LowerCutoff=0,
    Plasticity=0)
kangaroo_5 = KangarooPhysics(ForceObjects=flatten(springs_5), AnchorPoints=item_77, Settings=null, Geometry=item_78, SimulationReset=Toggle(False))  # -> Out, Iterations, ParticlesOut, GeometryOut, KE
nv_8 = NakedVertices(Mesh=unifynormals_7)  # -> ClothedIndex, NakedIndex, ClothedPts, NakedPts
pt_19 = Point(kangaroo_5.GeometryOut)
pt_20 = Point(item_77)
merge_9 = Merge(Data1=pt_19, Data2=pt_20)
merge_10 = Merge(Data1=nv_7.ClothedIndex, Data2=nv_7.NakedIndex)
sort_10 = SortList(Keys=merge_10, ValuesA=merge_9)  # -> Keys, ValuesA
conmesh_5 = ConstructMesh(Vertices=sort_10.ValuesA, Faces=demesh_5.Faces)

curvepoint_31 = PointOnCurve(bang_46.Branch2, parameter=0.5)
curvepoint_32 = PointOnCurve(bang_41.Branch2, parameter=0.804)
curvepoint_33 = PointOnCurve(bang_40.Branch2, parameter=0.801)
flatten_11 = FlattenTree(Tree=[curvepoint_33, curvepoint_31, curvepoint_32], Path="{0}")
flip_25 = FlipCurve(Curve=bang_46.Branch2)  # -> Curve, Flag
shift_25 = ShiftList(List=flatten_11, Shift=Slider(1, range=0..10), Wrap=True)
intcrv_21 = Interpolate(Vertices=shift_25, Degree=3, Periodic=False, KnotStyle=1)  # -> Curve, Length, Domain
loft_66 = Loft(
    Curves=flatten([flip_25.Curve, intcrv_21.Curve]),
    Options={Adjust=False, Closed=False, LoftEnds=0, LoftSimp=0, LoftType=0, Rebuild=10, Refit=0.01})

curvepoint_34 = PointOnCurve(bang_40.Branch2, parameter=0.199)
curvepoint_35 = PointOnCurve(bang_45.Branch2, parameter=0.5)
curvepoint_36 = PointOnCurve(bang_41.Branch2, parameter=0.203)
flatten_12 = FlattenTree(Tree=[curvepoint_34, curvepoint_35, curvepoint_36], Path="{0}")
flip_26 = FlipCurve(Curve=bang_45.Branch2)  # -> Curve, Flag
shift_26 = ShiftList(List=flatten_12, Shift=Slider(1, range=0..10), Wrap=True)
intcrv_22 = Interpolate(Vertices=shift_26, Degree=3, Periodic=False, KnotStyle=1)  # -> Curve, Length, Domain
loft_67 = Loft(
    Curves=flatten([flip_26.Curve, intcrv_22.Curve]),
    Options={Adjust=False, Closed=False, LoftEnds=0, LoftSimp=0, LoftType=0, Rebuild=10, Refit=0.01})

srf_15 = Surface([loft_66, loft_67])
join_28 = BrepJoin(Breps=flatten([bang_44.Branch2, srf_15]))  # -> Breps, Closed
edges_42 = BrepEdges(Brep=join_28.Breps)  # -> Naked, Interior, NonManifold
bang_49 = ExplodeTree(Data=simplify(graft(edges_42.Naked)))  # -> Branch0, Branch1, Branch2, Branch3, Branch4, Branch5, Branch6, Branch7
join_29 = JoinCurves(Curves=flatten([bang_49.Branch1, bang_49.Branch4, bang_49.Branch6]), Preserve=False)
join_30 = JoinCurves(Curves=flatten([bang_49.Branch0, bang_49.Branch3, bang_49.Branch7]), Preserve=False)
reb_7 = RebuildCurve(Curve=join_30, Count=10, Tangents=False)
reb_8 = RebuildCurve(Curve=join_29, Count=10, Tangents=False)
edgesrf_8 = EdgeSurface(CurveA=reb_7, CurveB=bang_49.Branch2, CurveC=reb_8, CurveD=bang_49.Branch5)
area_12 = Area(Geometry=move_44.Geometry)  # -> Area, Centroid
split_13 = SplitBrep(Brep=edgesrf_8, Cutter=join_19.Breps)
range_18 = Range(Domain=Domain(0, 1), Steps=10)
item_79 = ListItem(List=split_13, Index=Slider(0, range=0..1), Wrap=True)
mesh_11 = MeshBrep(
    Brep=item_79,
    Settings={GridMaxCount=0, GridMinCount=16, JaggedSeams=False, MaxEdgeLength=0, MinEdgeLength=0.0001, MinTolerance=0, Refine=True, RefineAngle=0, RelativeTolerance=0.65, SimplePlanes=True, Tolerance=0})
medges_19 = MeshEdges(Mesh=mesh_11)  # -> NakedEdges, InteriorEdges, NonManifoldEdges
join_31 = JoinCurves(Curves=medges_19.NakedEdges, Preserve=False)
item_80 = ListItem(List=reverse(join_31), Index=0, Wrap=True)
project_16 = Project(Geometry=item_80, Plane=area_12.Centroid)  # -> Geometry, Transform
tweencrv_13 = TweenCurve(CurveA=item_80, CurveB=project_16.Geometry, Factor=range_18, BlendType=0)
shift_27 = ShiftList(List=tweencrv_13, Shift=-1, Wrap=False)  # -> graft(List)
shift_28 = ShiftList(List=tweencrv_13, Shift=1, Wrap=False)  # -> graft(List)
loft_68 = Loft(
    Curves=[shift_27, shift_28],
    Options={Adjust=False, Closed=False, LoftEnds=0, LoftSimp=0, LoftType=0, Rebuild=10, Refit=0.01})
debrep_7 = DeconstructBrep(Brep=loft_68)  # -> flatten(Faces), Edges, Vertices
smesh_6 = SimpleMesh(Brep=debrep_7.Faces)
mjoin_8 = MeshJoin(Meshes=flatten([smesh_6, mesh_11]))
weldvertices_8 = MeshWeldVertices(Mesh=mjoin_8, Tolerance=0.01)  # -> RuntimeMessage, Mesh
unifynormals_8 = MeshUnifyNormals(Mesh=weldvertices_8.Mesh)
nv_9 = NakedVertices(Mesh=unifynormals_8)  # -> ClothedIndex, NakedIndex, ClothedPts, NakedPts
demesh_6 = DeconstructMesh(Mesh=unifynormals_8)  # -> Vertices, Faces, Colours, Normals
item_81 = ListItem(List=demesh_6.Vertices, Index=nv_9.NakedIndex, Wrap=True)
number_slider_72 = Slider(0.4, range=0..1)
item_82 = ListItem(List=demesh_6.Vertices, Index=nv_9.ClothedIndex, Wrap=True)
medges_20 = MeshEdges(Mesh=unifynormals_8)  # -> NakedEdges, InteriorEdges, NonManifoldEdges
crv_27 = Curve([medges_20.NakedEdges, medges_20.InteriorEdges])
timer_6 = Timer(TimerInterval=20, Target=kangaroo_6)  # disabled
springs_6 = SpringsFromLine(
    Connection=crv_27,
    Stiffness=Slider(2, range=0..100),
    Damping=10,
    RestLength=0,
    UpperCutoff=0,
    LowerCutoff=0,
    Plasticity=0)
kangaroo_6 = KangarooPhysics(ForceObjects=flatten(springs_6), AnchorPoints=item_81, Settings=null, Geometry=item_82, SimulationReset=Toggle(False))  # -> Out, Iterations, ParticlesOut, GeometryOut, KE
nv_10 = NakedVertices(Mesh=unifynormals_8)  # -> ClothedIndex, NakedIndex, ClothedPts, NakedPts
pt_21 = Point(kangaroo_6.GeometryOut)
pt_22 = Point(item_81)
merge_11 = Merge(Data1=pt_21, Data2=pt_22)
merge_12 = Merge(Data1=nv_9.ClothedIndex, Data2=nv_9.NakedIndex)
sort_11 = SortList(Keys=merge_12, ValuesA=merge_11)  # -> Keys, ValuesA
conmesh_6 = ConstructMesh(Vertices=sort_11.ValuesA, Faces=demesh_6.Faces)

srf_16 = Surface(edgesrf_7)
srf_17 = Surface(edgesrf_6)
srf_18 = Surface(edgesrf_8)
edges_43 = BrepEdges(Brep=[srf_17, srf_16, srf_18])  # -> Naked, Interior, NonManifold
len_23 = Length(Curve=edges_43.Naked)
larger_9 = LargerThan(FirstNumber=len_23, SecondNumber=Slider(50, range=0..100))  # -> LargerThan, OrEqualTo
panel_20 = Panel(len_23)
cull_19 = CullPattern(List=edges_43.Naked, CullPattern=larger_9.LargerThan)  # -> simplify(List)
flip_27 = FlipMatrix(Data=cull_19)
bang_50 = ExplodeTree(Data=flip_27)  # -> Branch0, Branch1
flip_28 = FlipCurve(Curve=bang_50.Branch0)  # -> Curve, Flag
flip_29 = FlipMatrix(Data=[flip_28.Curve, bang_50.Branch1])
number_slider_73 = Slider(7, range=0..100)
divide_54 = DivideCurve(Curve=graft(flip_29), Count=number_slider_73, Kinks=False)  # -> simplify(Points), Tangents, Parameters
division_7 = Division(A=number_slider_73, B=2)
bang_51 = ExplodeTree(Data=divide_54.Points)  # -> Branch0, Branch1, Branch2, Branch3, Branch4, Branch5
pt_23 = Point(bang_51.Branch2)
addition = Addition(A=division_7, B=1)
shift_29 = ShiftList(List=bang_51.Branch1, Shift=division_7, Wrap=True)
shift_30 = ShiftList(List=bang_51.Branch3, Shift=division_7, Wrap=True)
shift_31 = ShiftList(List=bang_51.Branch5, Shift=division_7, Wrap=True)
geodesic_2 = Geodesic(Surface=srf_17, Start=bang_51.Branch0, End=shift_29)
geodesic_3 = Geodesic(Surface=srf_16, Start=bang_51.Branch2, End=shift_30)
geodesic_4 = Geodesic(Surface=srf_18, Start=bang_51.Branch4, End=shift_31)
split_14 = SplitList(List=geodesic_2, Index=addition)  # -> ListA, ListB
split_15 = SplitList(List=geodesic_3, Index=addition)  # -> ListA, ListB
split_16 = SplitList(List=geodesic_4, Index=addition)  # -> ListA, ListB
loft_69 = Loft(
    Curves=flatten(split_14.ListB),
    Options={Adjust=False, Closed=False, LoftEnds=0, LoftSimp=0, LoftType=0, Rebuild=10, Refit=0.01})
loft_70 = Loft(
    Curves=flatten(split_14.ListA),
    Options={Adjust=False, Closed=False, LoftEnds=0, LoftSimp=0, LoftType=0, Rebuild=10, Refit=0.01})
pipe_5 = Pipe(Curve=[geodesic_3, geodesic_4, geodesic_2], Radius=Slider(0.1, range=0..1), Caps=0)
loft_71 = Loft(
    Curves=flatten(split_15.ListA),
    Options={Adjust=False, Closed=False, LoftEnds=0, LoftSimp=0, LoftType=0, Rebuild=10, Refit=0.01})
loft_72 = Loft(
    Curves=flatten(split_15.ListB),
    Options={Adjust=False, Closed=False, LoftEnds=0, LoftSimp=0, LoftType=0, Rebuild=10, Refit=0.01})
loft_73 = Loft(
    Curves=flatten(split_16.ListA),
    Options={Adjust=False, Closed=False, LoftEnds=0, LoftSimp=0, LoftType=0, Rebuild=10, Refit=0.01})
loft_74 = Loft(
    Curves=flatten(split_16.ListB),
    Options={Adjust=False, Closed=False, LoftEnds=0, LoftSimp=0, LoftType=0, Rebuild=10, Refit=0.01})
md_slider_2 = MDSlider(
    slider_value=Point(0.4924294076, 0.5400009155, 0.5),
    SliderMode=0,
    x_domain=Domain(0, 1),
    y_domain=Domain(0, 1),
    z_domain=Domain(0, 1))
evalsrf_3 = EvaluateSurface(Surface=reparameterize([loft_70, loft_69, loft_71, loft_72, loft_73, loft_74]), Point=md_slider_2)  # -> Point, Normal, Frame
amp_15 = Amplitude(Vector=evalsrf_3.Normal, Amplitude=Slider(0.1, range=0..1))
extr_28 = Extrude(Base=[loft_70, loft_69, loft_71, loft_72, loft_73, loft_74], Direction=amp_15)

mesh_12 = MeshBrep(
    Brep=filter_3,
    Settings={GridMaxCount=0, GridMinCount=16, JaggedSeams=False, MaxEdgeLength=0, MinEdgeLength=0.0001, MinTolerance=0, Refine=True, RefineAngle=0, RelativeTolerance=0.65, SimplePlanes=True, Tolerance=0})

# ==== cluster Cluster
G = ClusterInput()
area = Area(Geometry=G)  # -> Area, Centroid
srf_cp = SurfaceClosestPoint(Point=area.Centroid, Surface=G)  # -> Point, UVPoint, Distance
A = ClusterInput()
evalsrf = EvaluateSurface(Surface=G, Point=srf_cp.UVPoint)  # -> Point, Normal, Frame
amp = Amplitude(Vector=evalsrf.Normal, Amplitude=expr("-x", A))
V = ClusterOutput(amp)

# ==== cluster Cluster_2
S = ClusterInput()
md_slider = MDSlider(slider_value=Point(0.5, 0, 0.5), SliderMode=0, x_domain=Domain(0, 1), y_domain=Domain(0, 1), z_domain=Domain(0, 1))
evalsrf = EvaluateSurface(Surface=reparameterize(S), Point=md_slider)  # -> Point, Normal, Frame
start_and_end_curve = ClusterInput()
srf_cp = SurfaceClosestPoint(Point=evalsrf.Point, Surface=S)  # -> Point, UVPoint, Distance
tween_curve_a = ClusterInput()
tween_curve_b = ClusterInput()
evalsrf_2 = EvaluateSurface(Surface=S, Point=srf_cp.UVPoint)  # -> Point, Normal, Frame
tweencrv = TweenCurve(CurveA=tween_curve_a, CurveB=tween_curve_b, Factor=0.5, BlendType=0)
amp = Amplitude(Vector=evalsrf_2.Normal, Amplitude=Slider(2.5, range=0..10))
move = Move(Geometry=tweencrv, Motion=expr("-x", amp))  # -> Geometry, Transform
loft = Loft(
    Curves=flatten([move.Geometry, start_and_end_curve]),
    Options={Adjust=False, Closed=False, LoftEnds=0, LoftSimp=0, LoftType=0, Rebuild=10, Refit=0.01})
L = ClusterOutput(loft)

# ==== cluster RemoveEnds: Removes first and last item of a list
L = ClusterInput()
cull_i = CullIndex(List=reverse(L), Indices=0, Wrap=True)
cull_i_2 = CullIndex(List=reverse(cull_i), Indices=0, Wrap=True)
L_2 = ClusterOutput(cull_i_2)
