# Grasshopper definition 011_PP_Comments.gh (Grasshopper 0.9.76)
# plug-ins: Karamba

# ---- group: Islands
crv = Curve(<curve referenced from the Rhino model>)
crv_2 = Curve(<curve referenced from the Rhino model>)
pt = Point([<point referenced from the Rhino model> x4])
circle = CircleCNR(Center=pt, Normal=Vector(0, 0, 1), Radius=Slider(10, range=0..100))
neg = Negative(Value=Slider(30, range=0..100))
area = Area(Geometry=[crv, crv_2])  # -> Area, Centroid
divide = DivideCurve(Curve=graft([crv_2, crv]), Count=13, Kinks=False)  # -> Points, Tangents, Parameters
Z = UnitZ(Factor=neg)
avr = Average(Input=area.Centroid)
extr = Extrude(Base=[crv, crv_2], Direction=Z)
dist = Distance(PointA=avr, PointB=divide.Points)
cap = CapHoles(Brep=extr)
sort = SortList(Keys=dist, ValuesA=divide.Points)  # -> Keys, ValuesA
series = Series(Start=0, Step=1, Count=Slider(3, range=0..10))
cull_i = CullIndex(List=sort.ValuesA, Indices=series, Wrap=True)  # -> simplify(List)

# ----
pt_2 = Point(<point referenced from the Rhino model>)
pt_3 = Point(<point referenced from the Rhino model>)
pt_4 = Point(<point referenced from the Rhino model>)
neg_2 = Negative(Value=Slider(20, range=0..100))
Z_2 = UnitZ(Factor=neg_2)
number_slider = Slider(2, range=0..10)
move = Move(Geometry=pt_2, Motion=Z_2)  # -> Geometry, Transform
move_2 = Move(Geometry=pt_4, Motion=Z_2)  # -> Geometry, Transform
cyl = Cylinder(Base=move_2.Geometry, Radius=number_slider, Length=Slider(77, range=0..100))

# ---- group: central island
crv_3 = Curve(<curve referenced from the Rhino model>)
Z_3 = UnitZ(Factor=Slider(25, range=0..100))
extr_2 = Extrude(Base=crv_3, Direction=Z_3)
divide_2 = DivideCurve(Curve=crv_3, Count=Slider(8, range=0..10), Kinks=False)  # -> Points, Tangents, Parameters
debrep = DeconstructBrep(Brep=extr_2)  # -> Faces, Edges, Vertices
Z_4 = UnitZ(Factor=Slider(25, range=0..100))
move_3 = Move(Geometry=divide_2.Points, Motion=Z_4)  # -> Geometry, Transform
item = ListItem(List=debrep.Edges, Index=Slider(1, range=0..1), Wrap=True)
item_2 = ListItem(List=debrep.Edges, Index=Slider(4, range=0..10), Wrap=True)
cap_2 = CapHoles(Brep=extr_2)
preview = CustomPreview(Geometry=cap_2, Shader=ColourSwatch(SwatchColor=RGB(153, 99, 18)))
item_3 = ListItem(List=move_3.Geometry, Index=Slider(8, range=0..10), Wrap=True)
item_4 = ListItem(List=move_3.Geometry, Index=Slider(4, range=0..10), Wrap=True)
item_5 = ListItem(List=move_3.Geometry, Index=Slider(6, range=0..10), Wrap=True)
item_6 = ListItem(List=move_3.Geometry, Index=Slider(10, range=0..10), Wrap=True)

# ----
cyl_2 = Cylinder(Base=move.Geometry, Radius=number_slider, Length=Slider(100, range=0..100))
preview_2 = CustomPreview(Geometry=cap, Shader=ColourSwatch(SwatchColor=RGB(166, 51, 38)))
partition = PartitionList(List=cull_i, Size=[1, 2])
edges = BrepEdges(Brep=cyl_2)  # -> Naked, Interior, NonManifold
edges_2 = BrepEdges(Brep=cyl)  # -> Naked, Interior, NonManifold
crv_4 = Curve(edges_2.Naked)
crv_5 = Curve(edges.Naked)
cull_i_2 = CullIndex(List=crv_4, Indices=2, Wrap=True)
cull_i_3 = CullIndex(List=crv_5, Indices=2, Wrap=True)
divide_3 = DivideCurve(Curve=cull_i_2, Count=20, Kinks=False)  # -> Points, Tangents, Parameters
divide_4 = DivideCurve(Curve=cull_i_3, Count=20, Kinks=False)  # -> Points, Tangents, Parameters
shift = ShiftList(List=divide_4.Points, Shift=6, Wrap=True)

# ---- group: deck
ln = Line(StartPoint=pt_3, EndPoint=pt_2)
ln_2 = Line(StartPoint=pt_4, EndPoint=pt_3)
neg_3 = Negative(Value=Slider(4, range=0..10))
offset = Offset(Curve=[ln_2, ln], Distance=graft([Slider(4, range=0..10), neg_3]), Plane=PlaneXY(0, 0, 0), Corners=1)
Z_5 = UnitZ(Factor=Slider(5, range=0..10))
move_4 = Move(Geometry=offset, Motion=Z_5)  # -> Geometry, Transform
divdist = DivideDistance(Curve=move_4.Geometry, Distance=Slider(13, range=0..100))  # -> Points, Tangents, Parameters
viewer = ParamViewer(divdist.Points)
crv_6 = Curve([<curve referenced from the Rhino model> x2])
crv_7 = Curve(<curve referenced from the Rhino model>)
item_7 = ListItem(List=viewer, Index=0, Wrap=True)
boundary = BoundarySurfaces(Edges=[crv_7, crv_6])
branch = TreeBranch(Tree=divdist.Points, Path=item_7, MaintainPaths=True)
item_8 = ListItem(List=branch, Index=simplify(flatten(Slider(6, range=0..10))), Wrap=True)

# ----
shift_2 = ShiftList(List=divide_3.Points, Shift=-5, Wrap=True)
cull_i_4 = CullIndex(List=shift, Indices=[0, 1, 2, 3, 4, 5, 6, 7, 8, 9], Wrap=True)
cull_i_5 = CullIndex(List=shift_2, Indices=[0, 1, 2, 3, 4, 5, 6, 7, 8, 9], Wrap=True)
group = Group(Objects=cull_i_5)
group_2 = Group(Objects=cull_i_4)
merge = Merge(Data1=cull_i_5, Data2=cull_i_4)  # -> simplify(graft(Result))
merge_2 = Merge(Data1=group, Data2=group_2)  # -> simplify(graft(Result))
debrep_2 = DeconstructBrep(Brep=extr)  # -> Faces, Edges, Vertices
ungroup = Ungroup(Group=merge_2)  # -> simplify(Objects)
explode = Explode(Curve=crv_2, Recursive=True)  # -> Segments, Vertices
explode_2 = Explode(Curve=crv, Recursive=True)  # -> Segments, Vertices
ln_3 = Line(StartPoint=ungroup, EndPoint=cull_i)
item_9 = ListItem(List=debrep_2.Faces, Index=Slider(3, range=0..10), Wrap=True)
item_10 = ListItem(List=debrep_2.Faces, Index=Slider(5, range=0..10), Wrap=True)
item_11 = ListItem(List=explode.Vertices, Index=[2, 3], Wrap=True)
pull = PullCurve(Curve=flatten(offset), Surface=item_10)
item_12 = ListItem(List=explode_2.Vertices, Index=[0, 1], Wrap=True)  # -> reverse(Item)
pull_2 = PullCurve(Curve=flatten(offset), Surface=item_9)
crv_8 = Curve(<curve referenced from the Rhino model>)
crv_9 = Curve(<curve referenced from the Rhino model>)
eval = EvaluateLength(Curve=move_4.Geometry, Length=0.5, Normalized=True)  # -> simplify(Point), Tangent, Parameter
merge_3 = Merge(Data1=item_4, Data2=item_6, Data3=item_5, Data4=item_3)  # -> flatten(Result)
weave = Weave(Pattern=[0, 1], Stream0=item_11, Stream1=item_12, NullGaps=False)  # -> flatten(Weave)
end = EndPoints(Curve=[crv_8, crv_9])  # -> Start, End
flatten = FlattenTree(Tree=eval.Point, Path="{0}")
Z_6 = UnitZ(Factor=Slider(5, range=0..10))
move_5 = Move(Geometry=[end.Start, end.End], Motion=Z_6)  # -> Geometry, Transform
merge_4 = Merge(Data1=graft(weave), Data2=graft(flatten), Data3=graft(merge_3))
points = PointList(Points=flatten)
neg_4 = Negative(Value=Slider(1, range=0..10))
Z_7 = UnitZ(Factor=neg_4)
item_13 = ListItem(List=merge_4, Index=0, Wrap=True)  # -> Item, Item1, Item2
intcrv = Interpolate(Vertices=merge_4, Degree=3, Periodic=False, KnotStyle=1)  # -> Curve, Length, Domain
extr_3 = Extrude(Base=boundary, Direction=Z_7)
pline = PolyLine(Vertices=merge_4, Closed=False)
cap_3 = CapHoles(Brep=extr_3)
item_14 = ListItem(List=move_5.Geometry, Index=Slider(4, range=0..10), Wrap=True)
item_15 = ListItem(List=move_5.Geometry, Index=Slider(6, range=0..10), Wrap=True)
item_16 = ListItem(List=move_5.Geometry, Index=Slider(3, range=0..10), Wrap=True)
item_17 = ListItem(List=move_5.Geometry, Index=Slider(1, range=0..10), Wrap=True)
arc = Arc3Pt(PointA=item_13.Item, PointB=item_13.Item1, PointC=item_13.Item2)  # -> Arc, Plane, Radius
preview_3 = CustomPreview(Geometry=cap_3, Shader=ColourSwatch(SwatchColor=RGB(49, 182, 212)))

# ---- group: handrail
item_18 = ListItem(List=flatten(intcrv.Curve), Index=Slider(2, range=0..10), Wrap=True)
item_19 = ListItem(List=flatten(intcrv.Curve), Index=Slider(1, range=0..10), Wrap=True)
item_20 = ListItem(List=flatten(intcrv.Curve), Index=Slider(4, range=0..10), Wrap=True)
item_21 = ListItem(List=flatten(intcrv.Curve), Index=Slider(3, range=0..10), Wrap=True)
offset_l = OffsetLoose(Curve=item_20, Distance=expr("-x", 1))  # -> graft(Curve)
offsets = OffsetOnSrf(Curve=item_18, Distance=1, Surface=boundary)
offsets_2 = OffsetOnSrf(Curve=item_19, Distance=1, Surface=boundary)
offsets_3 = OffsetOnSrf(Curve=item_21, Distance=expr("-x", 1), Surface=boundary)
crv_10 = Curve([offsets_3, offsets_2, offsets, offset_l])
divlength = DivideLength(Curve=crv_10, Length=Slider(2, range=0..10))  # -> Points, Tangents, Parameters
Z_8 = UnitZ(Factor=Slider(1.1, range=0..10))
move_6 = Move(Geometry=divlength.Points, Motion=Z_8)  # -> Geometry, Transform
ln_4 = Line(StartPoint=divlength.Points, EndPoint=move_6.Geometry)
pline_2 = PolyLine(Vertices=move_6.Geometry, Closed=False)
pipe = Pipe(Curve=[ln_4, pline_2], Radius=Slider(0.2, range=0..1), Caps=2)

# ----
divlength_2 = DivideLength(Curve=[item_21, item_19], Length=Slider(5, range=0..10))  # -> Points, Tangents, Parameters
divlength_3 = DivideLength(Curve=[item_20, item_18], Length=Slider(5, range=0..10))  # -> Points, Tangents, Parameters
ln_5 = Line(StartPoint=graft(cull_i_4), EndPoint=graft(divlength_2.Points))
ln_6 = Line(StartPoint=graft(cull_i_5), EndPoint=divlength_3.Points)
Z_9 = UnitZ(Factor=Slider(1.55, range=0..10))
move_7 = Move(Geometry=offsets, Motion=Z_9)  # -> Geometry, Transform
move_8 = Move(Geometry=offset_l, Motion=Z_9)  # -> Geometry, Transform
move_9 = Move(Geometry=offsets_2, Motion=Z_9)  # -> Geometry, Transform
move_10 = Move(Geometry=offsets_3, Motion=Z_9)  # -> Geometry, Transform
loft = Loft(
    Curves=[offsets, move_7.Geometry],
    Options={Adjust=False, Closed=False, LoftEnds=0, LoftSimp=0, LoftType=0, Rebuild=10, Refit=0.01})
loft_2 = Loft(
    Curves=[move_8.Geometry, offset_l],
    Options={Adjust=False, Closed=False, LoftEnds=0, LoftSimp=0, LoftType=0, Rebuild=10, Refit=0.01})
loft_3 = Loft(
    Curves=[move_9.Geometry, offsets_2],
    Options={Adjust=False, Closed=False, LoftEnds=0, LoftSimp=0, LoftType=0, Rebuild=10, Refit=0.01})
loft_4 = Loft(
    Curves=[offsets_3, move_10.Geometry],
    Options={Adjust=False, Closed=False, LoftEnds=0, LoftSimp=0, LoftType=0, Rebuild=10, Refit=0.01})

# ---- group: Windscreen
Y = UnitY(Factor=Slider(0.25, range=0..10))
neg_5 = Negative(Value=Y)
move_11 = Move(Geometry=[loft_2, loft_3], Motion=neg_5)  # -> Geometry, Transform
move_12 = Move(Geometry=[loft_4, loft], Motion=Y)  # -> Geometry, Transform

# ----
crv_11 = Curve([crv_2, crv])
pline_3 = PolyLine(Vertices=divide.Points, Closed=False)
flatten_2 = FlattenTree(Tree=ln_6, Path="{0}")
explode_3 = Explode(Curve=pline_3, Recursive=True)  # -> Segments, flatten(Vertices)
flatten_3 = FlattenTree(Tree=ln_5, Path="{0}")
flatten_4 = FlattenTree(Tree=ln_3, Path="{0}")
pline_4 = PolyLine(Vertices=divlength_2.Points, Closed=False)
pline_5 = PolyLine(Vertices=divlength_3.Points, Closed=False)
rdpoints = RemoveDuplicatePointsKaramba(Point=flatten([divlength_3.Points, divlength_2.Points]), LDist=0.005)  # -> OutPoint, Info, Indexes
end_2 = EndPoints(Curve=flatten([pline_5, pline_4]))  # -> Start, End
cp = ClosestPoint(Point=end_2.Start, Cloud=explode_3.Vertices)  # -> ClosestPoint, CPIndex, Distance
ln_7 = Line(StartPoint=move_2.Geometry, EndPoint=cull_i_5)
ln_8 = Line(StartPoint=move.Geometry, EndPoint=cull_i_4)

# ---- group: Set position of point load here
slider = Slider(6, range=0..40)  # disabled

# ----
ln_9 = Line(StartPoint=end_2.Start, EndPoint=cp.ClosestPoint)
number_slider_2 = Slider(25, range=0..300)
pline_6 = PolyLine(Vertices=end_2.End, Closed=True)
explode_4 = Explode(Curve=flatten([pline_5, pline_4, pline_6, pline_3, ln_9]), Recursive=True)  # -> flatten(Segments), Vertices
# all points
pt_5 = Point(flatten(rdpoints.OutPoint))
panel = Panel("cable")
# position point load
item_22 = ListItem(Index=slider, Wrap=True)  # disabled
linetobeam = LineToBeamKaramba(Line=flatten([ln_7, ln_8]), New=True, Remove=True, LDist=0.005, Identifier=graft("mast"))  # -> Point, Beam, Info
end_3 = EndPoints(Curve=[pline_5, pline_4])  # -> Start, End
end_4 = EndPoints(Curve=[ln_7, ln_8])  # -> Start, End
cross_sections = CrossSectionsKaramba(
    ElementsIdentifiers="mast",
    Diameter_cm=Slider(200, range=0..300),
    WallThickness_cm=Slider(25, range=0..300),
    mode="Circular Hollow")
number_slider_3 = Slider(20, range=0..50)
linetobeam_2 = LineToBeamKaramba(Line=explode_4.Segments, New=True, Remove=True, LDist=0.005, Identifier=graft("deckFrame"))  # -> Point, Beam, Info
cross_sections_2 = CrossSectionsKaramba(
    ElementsIdentifiers="deckFrame",
    Height_cm=Slider(50, range=0..300),
    UpperFlangeWidth_cm=number_slider_2,
    LowerFlangeWidth_cm=number_slider_2,
    UpperFlangeThickness_cm=0.4,
    LowerFlangeThickness_cm=0.4,
    SidewallsThickness_cm=0.4,
    FilletRadius_cm=0.6,
    mode="Box")
# convert axis
# to beams
linetobeam_3 = LineToBeamKaramba(Line=[flatten_4, flatten_2, flatten_3], New=True, Remove=True, LDist=0.005)  # -> Point, Beam, Info
panel_2 = Panel("0,0,-200")  # disabled
# define supports
supp = SupportKaramba(menu=[buttons(on, on, on, on, off, off)])  # disabled
supp_2 = SupportKaramba(PosInd=flatten([end_3.Start, end_3.End, end_4.Start, end_4.End]), menu=[buttons(on, on, on, on, on, on)])
loads = LoadsKaramba(ForceVector=panel_2, Local=True, PosInd=item_22, LCase=0, mode="Point")  # disabled
# add gravity
loads_2 = LoadsKaramba(Vector="0,0,-1", LCase=0, mode="Gravity")
# modify beam
modifyelem = ModifyElementKaramba(Beam=linetobeam_3.Beam, Height_cm="15", Thickness_cm="6", Bending="0", mode="Beam")
# assemble
assemble = AssembleModelKaramba(
    Elem=flatten([linetobeam_2.Beam, linetobeam.Beam, modifyelem]),
    Support=flatten(supp_2),
    Load=flatten(loads_2),
    CrossSection=flatten([cross_sections_2, cross_sections]),
    LDist=0.005)  # -> Model, Info, Mass, CenterOfGravity
# analyze
analyzethi = AnalyzeThIKaramba(Model=assemble.Model)  # -> ModelWithDisplacements, MaximumDisplacement_m, ResultingForceOfGravity_kN, ElasticEnergy_kNm
# view result
modelview = ModelViewKaramba(Model=analyzethi.ModelWithDisplacements, LoadCaseFactorsForLinearSuperposition=1, IndexIncrementOfVisibleLoadcase=0)  # -> Model, MeshOfRendering, DeformedStructure, DeformedModel
beamview = BeamViewKaramba(Model=modelview.Model)  # -> Model, MeshOfRendering, DeformedBeamAxes, LegendColors, LegendTags
