# Grasshopper definition CableStayedBridge.gh (Grasshopper 0.9.76)
# plug-ins: Karamba

height = Slider(33, range=1..100)
# A suspension bridge under a wandering point load
# create axis geometry
panel = Panel("""-120
-60
-54
60
66""")
panel_2 = Panel("""10
1
19
1
10""")
series = Series(Start=panel, Step="6", Count=panel_2)
range = Range(Domain=height, Steps="9")
panel_3 = Panel("""-60
60""")
vec = VectorXYZ(XComponent=graft(panel_3), YComponent=0, ZComponent="-20")  # -> Vector, Length
vec_2 = VectorXYZ(XComponent=graft(panel_3), YComponent=0, ZComponent=range)  # -> Vector, Length
vec_3 = VectorXYZ(XComponent=series, YComponent=0, ZComponent=0)  # -> Vector, Length
bang = ExplodeTree(Data=vec_2.Vector)  # -> flatten(Branch0), flatten(Branch1)
bang_2 = ExplodeTree(Data=vec_3.Vector)  # -> Branch0, Branch1, Branch2, Branch3, Branch4
sort_pt = SortPoints(Points=[vec_2.Vector, vec.Vector])  # -> Points, Indices
cull_i = CullIndex(List=reverse(bang_2.Branch4), Indices=0, Wrap=False)  # -> reverse(flatten(List))
cull_i_2 = CullIndex(List=bang_2.Branch0, Indices=0, Wrap=False)  # -> reverse(flatten(List))
pline = PolyLine(Vertices=flatten(vec_3.Vector), Closed=False)
cull_i_3 = CullIndex(List=bang.Branch0, Indices=0, Wrap=False)  # -> flatten(List)
split = SplitList(List=bang_2.Branch2, Index=9)  # -> flatten(ListA), ListB
cull_i_4 = CullIndex(List=bang.Branch1, Indices=0, Wrap=False)  # -> flatten(List)
pline_2 = PolyLine(Vertices=sort_pt.Points, Closed=False)
pt = Point(flatten(vec.Vector))
cull_i_5 = CullIndex(List=split.ListB, Indices=0, Wrap=False)  # -> reverse(flatten(List))
pt_2 = Point([vec_3.Vector, vec_2.Vector, vec.Vector])
merge = Merge(Data1=graft(cull_i_2), Data2=graft(cull_i_3), Data3=graft(split.ListA))
merge_2 = Merge(Data1=graft(cull_i_5), Data2=graft(cull_i_4), Data3=graft(cull_i))
pline_3 = PolyLine(Vertices=merge_2, Closed=False)
pline_4 = PolyLine(Vertices=merge, Closed=False)
explode = Explode(Curve=pline_3, Recursive=True)  # -> flatten(Segments), Vertices
explode_2 = Explode(Curve=pline_2, Recursive=True)  # -> flatten(Segments), Vertices
explode_3 = Explode(Curve=pline, Recursive=True)  # -> flatten(Segments), Vertices
explode_4 = Explode(Curve=pline_4, Recursive=True)  # -> flatten(Segments), Vertices
rdpoints = RemoveDuplicatePointsKaramba(Point=flatten(pt_2), LDist=0.005)  # -> OutPoint, Info, Indexes
path_mapper = PathMapper([explode_4.Segments, explode.Segments], source="{A}", target="{0}")
path_mapper_2 = PathMapper(explode_3.Segments, source="{A}", target="{1}")
path_mapper_3 = PathMapper(explode_2.Segments, source="{A}", target="{2}")

# ---- group: Set position of point load here
slider = Slider(6, range=0..40)

# ----
panel_4 = Panel(path_mapper)
# all points
pt_3 = Point(flatten(rdpoints.OutPoint))
# position point load
item = ListItem(List=flatten(vec_3.Vector), Index=slider, Wrap=True)
panel_5 = Panel("""A
B
C""")
# convert axis
# to beams
linetobeam = LineToBeamKaramba(
    Point=pt_3,
    Line=[path_mapper, path_mapper_2, path_mapper_3],
    New=True,
    Remove=True,
    LDist=0.005,
    Identifier=graft(panel_5))  # -> Point, Beam, Info
end = EndPoints(Curve=pline)  # -> Start, End
# define supports
supp = SupportKaramba(PosInd=flatten(pt), menu=[buttons(on, on, on, on, off, off)])
supp_2 = SupportKaramba(PosInd=flatten([end.Start, end.End]), menu=[buttons(off, off, on, off, off, off)])
loads = LoadsKaramba(ForceVector="0,0,-200", Local=True, PosInd=item, LCase=0, mode="Point")
# add gravity
loads_2 = LoadsKaramba(Vector="0,0,-1", LCase=0, mode="Gravity")
panel_6 = Panel("""0
1
1""")
panel_7 = Panel("""15
60
200""")
panel_8 = Panel("""6
5
5""")
# modify beam
modifyelem = ModifyElementKaramba(Beam=linetobeam.Beam, Height_cm=graft(panel_7), Thickness_cm=graft(panel_8), Bending=graft(panel_6), mode="Beam")
# assemble
assemble = AssembleModelKaramba(Point=pt_3, Elem=flatten(modifyelem), Support=[supp_2, supp], Load=[loads, loads_2], LDist=0.005)  # -> Model, Info, Mass, CenterOfGravity
# analyze
analyzethi = AnalyzeThIKaramba(Model=assemble.Model)  # -> ModelWithDisplacements, MaximumDisplacement_m, ResultingForceOfGravity_kN, ElasticEnergy_kNm
# view result
modelview = ModelViewKaramba(Model=analyzethi.ModelWithDisplacements, LoadCaseFactorsForLinearSuperposition=1, IndexIncrementOfVisibleLoadcase=0)  # -> Model, MeshOfRendering, DeformedStructure, DeformedModel
beamview = BeamViewKaramba(Model=modelview.Model)  # -> Model, MeshOfRendering, DeformedBeamAxes, LegendColors, LegendTags
