# Grasshopper definition Tut 003 - Anemone Explanation.gh (Grasshopper 0.9.76)
# plug-ins: Anemone

# N: This value will determine how many loops will occur.
# Toggle this to restart the loop.
# Changing any D(#) value will also restart the loop.
# D(#): This is what Anemone will loop over.
toggle = BooleanToggle(False)
polygon = Polygon(Plane=PlaneXY(0, 0, 0), Radius=3, Segments=6, FilletRadius=0)  # -> Polygon, Length
int = Integer(4)
int_2 = Integer(0)
int_3 = Integer(0)
int_4 = Integer(5)
int_5 = Integer(5)
panel = Panel("FRACTAL")
loop_start = LoopStart(Repeat=int, Trigger=Toggle(True), Data=polygon.Polygon)  # -> port, Counter, Data
loop_start_2 = LoopStart(Repeat=int_5, Trigger=Toggle(True), Data=int_3)  # -> port, Counter, Data
loop_start_3 = LoopStart(Repeat=int_4, Trigger=toggle, Data=int_2)  # -> port, Counter, Data
explode = Explode(Curve=loop_start.Data, Recursive=True)  # -> Segments, Vertices
# Right Click: Right Click the Output of the loop to get access to the Record Data option. With this on, the output will contain all the results of the loop.
expression = Expression(x=loop_start_2.Data, Expression="x+1")
expression_2 = Expression(x=loop_start_3.Data, Expression="x+1")
loop_end = LoopEnd(port=loop_start_2.port, Exit=False, Data=expression, pausedState=False, state="Constant & Record", TimeOutVal=0)
loop_end_2 = LoopEnd(port=loop_start_3.port, Exit=False, Data=expression_2, pausedState=False, state="Constant output", TimeOutVal=0)
hframe = HorizontalFrame(Curve=reparameterize(explode.Segments), Parameter=0.333333)
hframe_2 = HorizontalFrame(Curve=reparameterize(explode.Segments), Parameter=0.666667)
eval = EvaluateLength(Curve=explode.Segments, Length=0, Normalized=True)  # -> Point, Tangent, Parameter
eval_2 = EvaluateLength(Curve=explode.Segments, Length=1, Normalized=True)  # -> Point, Tangent, Parameter
panel_2 = Panel(loop_end)
dist = Distance(PointA=eval.Point, PointB=hframe)
dist_2 = Distance(PointA=hframe_2, PointB=eval_2.Point)
panel_3 = Panel(loop_end_2)
arc = Arc(Plane=hframe, Radius=dist, Angle=Domain(3.141592654, 6.283185307))  # -> Arc, Length
arc_2 = Arc(Plane=hframe_2, Radius=dist_2, Angle=Domain(3.141592654, 6.283185307))  # -> Arc, Length
ccx = CurveCurve(CurveA=arc.Arc, CurveB=arc_2.Arc)  # -> simplify(Points), ParamsA, ParamsB
merge = Merge(
    Data1=simplify(graft(eval.Point)),
    Data2=simplify(graft(hframe)),
    Data3=simplify(ccx.Points),
    Data4=simplify(graft(hframe_2)),
    Data5=simplify(graft(eval_2.Point)))
pline = PolyLine(Vertices=merge, Closed=False)
join = JoinCurves(Curves=flatten(pline), Preserve=False)
loop_end_3 = LoopEnd(port=loop_start.port, Exit=False, Data=join, pausedState=False, state="Constant output", TimeOutVal=0)
